# Grasshopper definition applyForceTest.gh (Grasshopper 0.9.75)
# plug-ins: Agent

number_slider = Slider(15, range=0..100)
box = DomainBox(Base=PlaneXY(0, 0, 0), X=number_slider, Y=number_slider, Z=number_slider)

number_slider_2 = Slider(100, range=0..100)
# POINT EMITTER
# Point from which to emit agents.
# If continuous flow, Agents will be consistently emitted. Limit the number of agnets allowed at once with the Number of Agents setting.
toggle = BooleanToggle(True)
agent_vision_radius_multiplier = Slider(2, range=0..10)
agent_cohesion_vision_radius = Slider(5, range=0..10)

# ----
# CONSTRUCT AGENT
# Agent Settings:
# Initializes agents with these settings. The settings cannot change once the agent has been emitted. If there is just 1 Agent output from A, all the agents will have that setting. If you would like a diversity of agent settings for each agent, feed in a list of values into the settings you would like to be different.
agent = ConstructAgent(Lifespan=30, Mass=1, BodySize=1, MaxSpeed=Slider(0.5, range=0..1), MaxForce=Slider(0.1, range=0..1), HistoryLength=1)
boxemit = BoxEmitter(Box=box, ContinuousFlow=toggle, CreationRate=1, NumberOfAgents=0)
# SYSTEM
# Creates a system of Agents that the engine will be able to run.
system = System(Agents=agent, Emitters=boxemit)
# Pause the simlation by double-clicking the Timer.
timer = Timer(TimerInterval=20, Target=[engine, system])
# Reset the simulation by double-clicking the reset switch.
toggle_2 = BooleanToggle(False)
# DECONSTRUCT SYSTEM
# Exposes the list of Agents, A, and the AgentCollection, AC, which is a spatial data structure that allows for the fast lookup of neighbors.
# The Agent's vision radius for separation here has a stable ratio to the cohesion vision radius so that a stable behavior is formed
division = Division(A=agent_cohesion_vision_radius, B=agent_vision_radius_multiplier)
deconstructsystem = DeconstructSystem(System=system)  # -> Agents, AgentCollection
engine = Engine(Reset=toggle_2, System=system)
# Finds all agents 5 units away
neighbors = GetNeighborsInRadius(
    Agent=deconstructsystem.Agents,
    AgentCollection=deconstructsystem.AgentCollection,
    VisionRadius=agent_cohesion_vision_radius,
    VisionAngle=360)
# Looks at all agents within 5 units away and finds the ones within 5/3 units away - this makes the runtime faster
number_slider_3 = Slider(10, range=0..100)
# DECONSTRUCT AGENT:
# Exposes the Agents' Position and other fields so you can see them.
deconstructagent = DeconstructAgent(Agent=deconstructsystem.Agents)  # -> Position, Velocity, Acceleration, Lifespan, PositionHistory
box_2 = DomainBox(Base=PlaneXY(0, 0, 0), X=number_slider_3, Y=number_slider_3, Z=number_slider_3)
neighbors_2 = GetNeighborsInRadius(Agent=deconstructsystem.Agents, AgentCollection=neighbors, VisionRadius=division, VisionAngle=360)
brepinc = PointInBrep(Brep=box_2, Point=deconstructagent.Position, Strict=False)
separate = SeparateForce(Agent=deconstructsystem.Agents, WeightMultiplier=1, ApplyForce=brepinc, GetNeighborsInRadius=neighbors_2)
panel = Panel(separate)
# COHESE AND SEPARATE:
# A takes in agent. This will look at each individual agent in the system.
# AC takes in output from neighbors component to get all of the neighbors within the vision radius.
# W is the strength of the force. Default to 1.
vec = VectorXYZ(XComponent=0, YComponent=0, ZComponent=0)  # -> Vector, Length
panel_2 = Panel(brepinc)
equals = Equality(FirstNumber=separate, SecondNumber=vec.Vector)  # -> Equality, Inequality
cohese = CoheseForce(Agent=deconstructsystem.Agents, WeightMultiplier=1, ApplyForce=equals.Equality, GetNeighborsInRadius=neighbors)
vdis = VectorDisplay(Anchor=deconstructagent.Position, Vector=cohese)
# You can preview the force vectors from each force component by using the vector preview component.
vdis_2 = VectorDisplay(Anchor=deconstructagent.Position, Vector=separate)
panel_3 = Panel(equals.Equality)
