# Grasshopper definition architecture2FinalTest.gh (Grasshopper 0.9.75)
# plug-ins: Agent

number_slider = Slider(15, range=0..100)
pemit = PointEmitter(Point=Point(0, 0, 0), ContinuousFlow=True, CreationRate=1, NumberOfAgents=0)
box = DomainBox(Base=PlaneXY(0, 0, 0), X=number_slider, Y=number_slider, Z=number_slider)
crv = Curve(<curve referenced from the Rhino model>)
boxemit = BoxEmitter(Box=box, ContinuousFlow=True, CreationRate=1, NumberOfAgents=0)
crvemit = CurveEmitter(Curve=crv, ContinuousFlow=True, CreationRate=1, NumberOfAgents=0)
agent = ConstructAgent(
    Lifespan=30,
    Mass=1,
    BodySize=1,
    MaxSpeed=0.5,
    MaxForce=0.1,
    VisionAngle=15,
    VisionRadius=5,
    HistoryLength=Slider(10, range=0..10))
wires = BrepWireframe(Brep=box, Density=-1)
timer = Timer(TimerInterval=20, Target=[system, engine])  # disabled
system = System(Agents=agent, Emitters=boxemit)
aaboxenv = AxisAlignedBoxEnvironment(Box=box)
deconstructsystem = DeconstructSystem(System=system)  # -> Agents, AgentCollection
neighbors = GetNeighborsInRadius(Agent=deconstructsystem.Agents, AgentCollection=deconstructsystem.AgentCollection, VisionRadius=5, VisionAngle=15)
cohese = CoheseForce(Agent=deconstructsystem.Agents, GetNeighborsInRadius=neighbors, WeightMultiplier=1)  # disabled
contain = ContainForce(VisionAngle=15, VisionRadiusMutliplier=1)
contain_2 = ContainForce(Agent=deconstructsystem.Agents, Environment=aaboxenv, WeightMultiplier=1, VisionRadius=Slider(1, range=0..1))
neighbors_2 = GetNeighborsInRadius(Agent=deconstructsystem.Agents, AgentCollection=neighbors, VisionRadius=Slider(1.667, range=0..10), VisionAngle=15)
deconstructagent = DeconstructAgent(Agent=deconstructsystem.Agents)  # -> Position, Velocity, Acceleration, Lifespan, PositionHistory
engine = Engine(Reset=Toggle(False), System=system)
separate = SeparateForce(Agent=deconstructsystem.Agents, GetNeighborsInRadius=neighbors_2, WeightMultiplier=1)
intcrv = Interpolate(Vertices=deconstructagent.PositionHistory, Degree=3, Periodic=False, KnotStyle=1)  # -> Curve, Length, Domain
