# Grasshopper definition architecture2MultipleSystemsTest.gh (Grasshopper 0.9.75)
# plug-ins: Agent

number_slider = Slider(15, range=0..100)
number_slider_2 = Slider(15, range=0..100)
number_slider_3 = Slider(100, range=0..100)
pt = ConstructPoint(XCoordinate=Slider(7, range=0..10), YCoordinate=0, ZCoordinate=0)
toggle = BooleanToggle(False)
number_slider_4 = Slider(100, range=0..100)
number_slider_5 = Slider(100, range=0..100)
number_slider_6 = Slider(1000, range=0..1000)
number_slider_7 = Slider(10000, range=0..10000)
box = DomainBox(Base=PlaneXY(0, 0, 0), X=number_slider, Y=number_slider, Z=number_slider)
box_2 = DomainBox(Base=pt, X=number_slider_2, Y=number_slider_2, Z=number_slider_2)
boxemit = BoxEmitter(Box=box, ContinuousFlow=toggle, CreationRate=1, NumberOfAgents=number_slider_3)
agent = Agent(
    Lifespan=number_slider_6,
    Mass=1,
    BodySize=1,
    MaximumSpeed=0.5,
    MaximumForce=0.1,
    VisionAngle=15,
    VisionRadius=Slider(5, range=0..10),
    LengthOfPositionHistory=1)
aaboxenv = AxisAlignedBoxEnvironment(Box=box)
boxemit_2 = BoxEmitter(Box=box_2, ContinuousFlow=toggle, CreationRate=1, NumberOfAgents=number_slider_3)
agent_2 = Agent(
    Lifespan=number_slider_6,
    Mass=1,
    BodySize=1,
    MaximumSpeed=0.5,
    MaximumForce=0.1,
    VisionAngle=15,
    VisionRadius=5,
    LengthOfPositionHistory=1)
aaboxenv_2 = AxisAlignedBoxEnvironment(Box=box_2)
number_slider_8 = Slider(0.15, range=0..1)
number_slider_9 = Slider(1, range=0..1)
system = AgentSystem(Agents=agent, Emitters=boxemit)
system_2 = AgentSystem(Agents=agent_2, Emitters=boxemit_2)
separate = SeparateForce(System1=system, System2=system_2, VisionAngle=360, VisionRadiusMultiplier=number_slider_9)
contain = ContainForce(System=system, Environment=aaboxenv, VisionAngle=360, VisionRadiusMutliplier=number_slider_8)
cohese = CoheseForce(System1=system, System2=system, VisionAngle=360, VisionRadiusMutliplier=1)  # disabled
separate_2 = SeparateForce(System1=system_2, System2=system, VisionAngle=360, VisionRadiusMultiplier=number_slider_9)
contain_2 = ContainForce(System=system_2, Environment=aaboxenv_2, VisionAngle=360, VisionRadiusMutliplier=number_slider_8)
cohese_2 = CoheseForce(System1=system_2, System2=system_2, VisionAngle=360, VisionRadiusMutliplier=1)  # disabled
bouncecontain = BounceContainBehavior(System=system_2)
merge = Merge(Data1=simplify(graft(separate_2)), Data2=simplify(graft(contain_2)), Data3=simplify(graft(cohese_2)))
merge_2 = Merge(Data1=simplify(graft(cohese)), Data2=simplify(graft(separate)), Data3=simplify(graft(contain)))
ma = MassAddition(Input=merge)  # -> flatten(Result), PartialResults
ma_2 = MassAddition(Input=merge_2)  # -> flatten(Result), PartialResults
timer = Timer(TimerInterval=20, Target=[engine, system, system_2])
entwine = Entwine(Branch00=ma_2.Result, Branch01=ma.Result)  # -> simplify(Result)
deconstructsystem = DeconstructSystem(System=system_2)  # -> Agents, AgentSystem
vec = Vector(entwine)
engine = Engine(Reset=Toggle(False), System=simplify(graft([system, system_2])), Forces=vec)
deconstructagent = DeconstructAgent(Agent=deconstructsystem.Agents)  # -> Position, Velocity, Acceleration, Lifespan, PositionHistory
deconstructsystem_2 = DeconstructSystem(System=system)  # -> Agents, AgentSystem
deconstructagent_2 = DeconstructAgent(Agent=deconstructsystem_2.Agents)  # -> Position, Velocity, Acceleration, Lifespan, PositionHistory
vdis = VectorDisplay(Anchor=deconstructagent.Position, Vector=separate_2)
vdis_2 = VectorDisplay(Anchor=deconstructagent_2.Position, Vector=separate)
preview = CustomPreview(Geometry=deconstructagent.Position, Shader=ColourSwatch(SwatchColor=RGB(255, 0, 255)))
preview_2 = CustomPreview(Geometry=deconstructagent_2.Position, Shader=ColourSwatch(SwatchColor=RGB(0, 255, 255)))
