# Grasshopper definition architecture2PerformanceTest.gh (Grasshopper 0.9.75)
# plug-ins: Agent

number_slider = Slider(13, range=0..100)
number_slider_2 = Slider(420, range=0..1000)
pt = ConstructPoint(XCoordinate=Slider(150, range=0..1000), YCoordinate=0, ZCoordinate=0)
dom = ConstructDomain(DomainStart=expr("-x", number_slider), DomainEnd=number_slider)
number_slider_3 = Slider(1000, range=0..1000)
toggle = BooleanToggle(False)
box = DomainBox(Base=PlaneXY(0, 0, 0), X=dom, Y=dom, Z=dom)
agent = Agent(
    Lifespan=number_slider_3,
    Mass=1,
    BodySize=1,
    MaximumSpeed=0.5,
    MaximumForce=0.1,
    VisionAngle=15,
    VisionRadius=Slider(5, range=0..100),
    LengthOfPositionHistory=1)  # disabled
cohese = CoheseForce(Weight=1, VisionMultiplier=1)  # disabled
boxemit = BoxEmitter(Box=box, ContinuousFlow=toggle, CreationRate=1, NumberOfAgents=number_slider_2)  # disabled
boxemit_2 = BoxEmitter(Box=box, ContinuousFlow=toggle, CreationRate=1, NumberOfAgents=number_slider_2)
agent_2 = Agent(
    Lifespan=number_slider_3,
    Mass=1,
    BodySize=1,
    MaximumSpeed=0.5,
    MaximumForce=0.1,
    VisionAngle=15,
    VisionRadius=5,
    LengthOfPositionHistory=1)
pemit = PointEmitter(Point=Point(0, 0, 0), ContinuousFlow=toggle, CreationRate=1, NumberOfAgents=number_slider_2)  # disabled
aaboxenv = AxisAlignedBoxEnvironment(Box=box)
system = AgentSystem(Agents=agent_2, Emitters=boxemit_2)
system_2 = AgentSystem(Agents=agent, Emitters=boxemit, Forces=cohese)  # disabled
cohese_2 = CoheseForce(System1=system, System2=system, VisionAngle=360, VisionRadius=Slider(1, range=0..1))
separate = SeparateForce(System1=system, System2=system, VisionAngle=360, VisionRadiusMultiplier=Slider(0.333, range=0..1))
contain = ContainForce(System=system, Environment=aaboxenv, VisionAngle=360, VisionRadiusMutliplier=Slider(0.1, range=0..1))
timer = Timer(TimerInterval=20, Target=[engine, engine_2, agent_2])  # disabled
toggle_2 = BooleanToggle(True)
bouncecontain = BounceContainBehavior(System=system, Environment=aaboxenv)
merge = Merge(Data2=graft(separate))
engine = Engine(Reset=toggle_2, Systems=system_2)  # disabled
panel = Panel(bouncecontain)
ma = MassAddition(Input=merge)  # -> flatten(Result), PartialResults
engine_2 = Engine(Reset=toggle_2, System=system, Forces=ma.Result)
deconstructagent = DeconstructAgent(Agent=engine)  # -> Position, Velocity, Acceleration, Lifespan, PositionHistory; disabled
swatch = ColourSwatch(SwatchColor=RGB(255, 0, 255))  # disabled
deconstructsystem = DeconstructSystem(System=system)
vdis = VectorDisplay(Anchor=deconstructsystem, Vector=contain)
vdis_2 = VectorDisplay(Anchor=deconstructsystem, Vector=separate)
vdis_3 = VectorDisplay(Anchor=deconstructsystem, Vector=cohese_2)
preview = CustomPreview(Geometry=deconstructagent.Position, Shader=swatch)  # disabled
preview_2 = CustomPreview(Geometry=deconstructsystem, Shader=ColourSwatch(SwatchColor=RGB(0, 255, 255)))
