# Grasshopper definition architecture2Test.gh (Grasshopper 0.9.75)
# plug-ins: Agent

number_slider = Slider(15, range=0..100)
number_slider_2 = Slider(53, range=0..100)
number_slider_3 = Slider(22, range=0..100)
pt = ConstructPoint(XCoordinate=number_slider, YCoordinate=0, ZCoordinate=0)
number_slider_4 = Slider(1000, range=0..1000)
pt_2 = ConstructPoint(XCoordinate=number_slider, YCoordinate=0, ZCoordinate=0)
number_slider_5 = Slider(1000, range=0..1000)
box = DomainBox(Base=pt, X=number_slider_2, Y=number_slider_2, Z=number_slider_2)
box_2 = DomainBox(Base=pt_2, X=number_slider_3, Y=number_slider_3, Z=number_slider_3)
agent = Agent(
    Lifespan=Slider(100, range=0..100),
    Mass=1,
    BodySize=1,
    MaximumSpeed=0.5,
    MaximumForce=0.1,
    VisionAngle=15,
    VisionRadius=Slider(5, range=0..10),
    LengthOfPositionHistory=1)
agent_2 = Agent(
    Lifespan=Slider(100, range=0..100),
    Mass=1,
    BodySize=1,
    MaximumSpeed=0.5,
    MaximumForce=0.1,
    VisionAngle=15,
    VisionRadius=Slider(5, range=0..10),
    LengthOfPositionHistory=1)
boxemit = BoxEmitter(Box=box_2, ContinuousFlow=Toggle(False), CreationRate=1, NumberOfAgents=Slider(100, range=0..100))
number_slider_6 = Slider(5, range=0..100)
boxemit_2 = BoxEmitter(Box=box_2, ContinuousFlow=Toggle(False), CreationRate=1, NumberOfAgents=Slider(100, range=0..100))
system = AgentSystem(Agents=agent_2, Emitters=boxemit_2)
system_2 = AgentSystem(Agents=agent, Emitters=boxemit)
timer = Timer(TimerInterval=20, Target=[engine, system, system_2])
entwine = Entwine(Branch00=system, Branch01=system_2)  # -> simplify(Result)
cohese = CoheseForce(System1=system, System2=system, VisionAngle=360, VisionRadius=number_slider_6)
cohese_2 = CoheseForce(System1=system, System2=system_2, VisionAngle=360, VisionRadius=number_slider_6)
cohese_3 = CoheseForce(System1=system_2, System2=system_2, VisionAngle=360, VisionRadius=number_slider_6)
addition = Addition(A=cohese, B=cohese_2)
entwine_2 = Entwine(Branch00=addition)  # -> simplify(Result)
engine = Engine(Reset=Toggle(True), System=entwine, Forces=entwine_2)
deconstructagent = DeconstructAgent(Agent=engine)  # -> Position, Velocity, Acceleration, Lifespan, PositionHistory
vdis = VectorDisplay(Anchor=deconstructagent.Position, Vector=cohese)
deconstructsystem = DeconstructSystem(System=system)
deconstructsystem_2 = DeconstructSystem(System=system_2)
vdis_2 = VectorDisplay(Anchor=deconstructagent.Position, Vector=deconstructagent.Velocity)
