# Grasshopper definition architecturePrototype.gh (Grasshopper 0.9.75)
# plug-ins: Agent

agent = Agent(
    Lifespan=30,
    Mass=1,
    BodySize=1,
    MaximumSpeed=0.5,
    MaximumForce=0.1,
    VisionAngle=15,
    VisionRadius=5,
    LengthOfPositionHistory=1)
pemit = PointEmitter(Point=Point(0, 0, 0), ContinuousFlow=True, CreationRate=1, NumberOfAgents=0)
agent_2 = Agent(
    Lifespan=30,
    Mass=1,
    BodySize=1,
    MaximumSpeed=0.5,
    MaximumForce=0.1,
    VisionAngle=15,
    VisionRadius=5,
    LengthOfPositionHistory=1)
pemit_2 = PointEmitter(Point=Point(0, 0, 0), ContinuousFlow=True, CreationRate=1, NumberOfAgents=0)
number_slider = Slider(68, range=0..100)
number_slider_2 = Slider(6, range=5..6)
agents = CSharpScript(A=agent_2, E=pemit_2)  # -> Out, A
agents_2 = CSharpScript(A=agent, E=pemit)  # -> Out, A
pemit_3 = PointEmitter(Point=Point(0, 0, 0), ContinuousFlow=True, CreationRate=1, NumberOfAgents=0)
cohese = CoheseForce(Weight=1, VisionMultiplier=1)
agent_3 = Agent(
    Lifespan=Slider(100, range=0..100),
    Mass=1,
    BodySize=1,
    MaximumSpeed=0.5,
    MaximumForce=0.1,
    VisionAngle=15,
    VisionRadius=5,
    LengthOfPositionHistory=Slider(15, range=0..100))
cohese_2 = CSharpScript(A1=agents_2.A, A2=agents_2.A)  # -> Out, F
avoid = CSharpScript(A1=agents_2.A, A2=agents.A)  # -> Out, F
contain = CSharpScript(A=agents.A, En=agents.A)  # -> Out, F
eat = CSharpScript(A1=agents.A, A2=agents_2.A)  # -> Out, B
system = AgentSystem(Agents=agent_3, Emitters=pemit_3, Forces=cohese)
timer = Timer(TimerInterval=20, Target=[engine, system])
timer_2 = Timer(TimerInterval=20, Target=[engine_2, agents_2])  # disabled
deconstructsystem = DeconstructSystem(System=system)
addition = Addition(A=cohese_2.F, B=avoid.F)
merge = Merge(Data1=addition, Data2=contain.F)
entwine = Entwine(Branch01=eat.B)  # -> simplify(Result)
engine = Engine(Reset=Toggle(False), Systems=system)
engine_2 = CSharpScript(R=Toggle(False), A=simplify(graft([agents_2.A, agents.A])), F=simplify(graft(merge)), B=entwine)  # -> Out, A
deconstructagent = DeconstructAgent(Agent=engine)  # -> Position, Velocity, Acceleration, Lifespan, PositionHistory
pt = Point(deconstructsystem)
panel = Panel(pt)
pt_2 = Point(deconstructagent.Position)
intcrv = Interpolate(Vertices=deconstructagent.PositionHistory, Degree=3, Periodic=False, KnotStyle=1)  # -> Curve, Length, Domain
