# Grasshopper definition attractDemo.gh (Grasshopper 0.9.75)
# plug-ins: Agent

# ----
# POINT EMITTER
# Point from which to emit agents.
# If continuous flow, Agents will be consistently emitted. Limit the number of agnets allowed at once with the Number of Agents setting.
toggle = BooleanToggle(False)
agent_vision_radius_multiplier = Slider(3, range=0..10)
agent_cohesion_vision_radius = Slider(5, range=0..10)

number_slider = Slider(10, range=0..10)
# CONSTRUCT AGENT
# Agent Settings:
# Initializes agents with these settings. The settings cannot change once the agent has been emitted. If there is just 1 Agent output from A, all the agents will have that setting. If you would like a diversity of agent settings for each agent, feed in a list of values into the settings you would like to be different.
number_slider_2 = Slider(-1, range=-1..1000)
ptemit = PointEmitter(Point=Point(0, 0, 0), ContinuousFlow=toggle, CreationRate=1, NumberOfAgents=Slider(1, range=0..100))
agent = ConstructAgent(
    Lifespan=number_slider_2,
    Mass=1,
    BodySize=1,
    MaxSpeed=Slider(0.5, range=0..1),
    MaxForce=Slider(0.1, range=0..1),
    HistoryLength=Slider(100000, range=0..100000))
# SYSTEM
# Creates a system of Agents that the engine will be able to run.
system = System(Agents=agent, Emitters=ptemit)
# Pause the simlation by double-clicking the Timer.
timer = Timer(TimerInterval=20, Target=[engine, system, c_script])  # disabled
# Reset the simulation by double-clicking the reset switch.
toggle_2 = BooleanToggle(True)
# The Agent's vision radius for separation here has a stable ratio to the cohesion vision radius so that a stable behavior is formed
division = Division(A=agent_cohesion_vision_radius, B=agent_vision_radius_multiplier)
# DECONSTRUCT SYSTEM
# Exposes the list of Agents, A, and the AgentCollection, AC, which is a spatial data structure that allows for the fast lookup of neighbors.
deconstructsystem = DeconstructSystem(System=system)  # -> Agents, AgentCollection
vec = VectorXYZ(XComponent=0, YComponent=0, ZComponent=0)  # -> Vector, Length
initialvel = InitialVelocity(Agent=deconstructsystem.Agents, Apply=True, InitialDirection=vec.Vector)
engine = Engine(Reset=toggle_2, System=system)
# Finds all agents 5 units away
neighbors = GetNeighborsInRadius(
    Agent=deconstructsystem.Agents,
    AgentCollection=deconstructsystem.AgentCollection,
    VisionRadius=agent_cohesion_vision_radius,
    VisionAngle=360)
pt = ConstructPoint(XCoordinate=0, YCoordinate=0, ZCoordinate=0)
c_script = CSharpScript(reset=toggle_2)  # -> out, A; inputs reset: Boolean
# ---------- c_script: C# ----------
    if(reset) {
      count = 0;
    }
    else {
      count += 0.001;
    }
    A = count;
# ---------- c_script: C# additional code ----------
  double count = 0.0;
# ---------- end c_script ----------
# DECONSTRUCT AGENT:
# Exposes the Agents' Position and other fields so you can see them.
deconstructagent = DeconstructAgent(Agent=deconstructsystem.Agents)  # -> Position, Velocity, Acceleration, Lifespan, ReferencePosition
circle = CircleCNR(Center=pt, Normal=Vector(0, 0, 1), Radius=Slider(5, range=0..100))
eval = EvaluateCurve(Curve=reparameterize(circle), Parameter=c_script.A)  # -> Point, Tangent, Angle
item = ListItem(List=deconstructagent.Position, Index=0, Wrap=True)  # -> flatten(Item)
intcrv = Interpolate(Vertices=deconstructagent.Position, Degree=3, Periodic=False, KnotStyle=1)  # -> Curve, Length, Domain
# Looks at all agents within 5 units away and finds the ones within 5/3 units away - this makes the runtime faster
neighbors_2 = GetNeighborsInRadius(Agent=deconstructsystem.Agents, AgentCollection=neighbors, VisionRadius=division, VisionAngle=360)
vdis = VectorDisplay(Anchor=flatten(item), Vector=deconstructagent.Velocity)
attract = AttractForce(
    Agent=deconstructsystem.Agents,
    Apply=True,
    WeightMultiplier=1,
    TargetPoint=eval.Point,
    Mass=1,
    DistanceLowerLimit=5,
    DistanceUpperLimit=100)
# COHESE AND SEPARATE:
# A takes in agent. This will look at each individual agent in the system.
# AC takes in output from neighbors component to get all of the neighbors within the vision radius.
# W is the strength of the force. Default to 1.
separate = SeparateForce(Agent=deconstructsystem.Agents, Apply=True, WeightMultiplier=1, GetNeighborsInRadius=neighbors_2)  # disabled
cohese = CoheseForce(Agent=deconstructsystem.Agents, Apply=True, WeightMultiplier=1, GetNeighborsInRadius=neighbors)  # disabled
item_2 = ListItem(List=deconstructagent.Position, Index=0, Wrap=True)
# You can preview the force vectors from each force component by using the vector preview component.
vdis_2 = VectorDisplay(Anchor=item_2, Vector=separate)
