# Grasshopper definition avoidUnalignedCollisionTest.gh (Grasshopper 0.9.75)
# plug-ins: Agent

number_slider = Slider(0, range=0..1)  # disabled
position = Point(<point referenced from the Rhino model>)  # disabled
neighborposition = Point(<point referenced from the Rhino model>)  # disabled
futureposition = Point(<point referenced from the Rhino model>)  # disabled
neighborfutureposition = Point(<point referenced from the Rhino model>)  # disabled
number_slider_2 = Slider(0.15, range=0..1)
number_slider_3 = Slider(1.3, range=0..10)  # disabled
number_slider_4 = Slider(1, range=0..1)  # disabled
preview = CustomPreview(
    Geometry=position,
    Shader={ambient=RGB(0, 0, 0), diffuse=RGB(255, 105, 180), emission=RGB(76, 32, 54), shine=0.5, specular=RGB(255, 255, 255), transparency=0})  # disabled
vec2pt = Vector2Pt(PointA=position, PointB=futureposition, Unitize=False)  # -> Vector, Length; disabled
number_slider_5 = Slider(1, range=0..1)  # disabled
number_slider_6 = Slider(0.47, range=0..1)  # disabled
vdis = VectorDisplay(Anchor=position, Vector=vec2pt.Vector)  # disabled
vec2pt_2 = Vector2Pt(PointA=neighborposition, PointB=neighborfutureposition, Unitize=False)  # -> Vector, Length; disabled
neighborfutureposition_2 = Point(<point referenced from the Rhino model>)  # disabled
neighborposition_2 = Point(<point referenced from the Rhino model>)  # disabled
vec = VectorXYZ(XComponent=number_slider_2, YComponent=0, ZComponent=0)  # -> Vector, Length
vec_2 = VectorXYZ(XComponent=0, YComponent=number_slider_2, ZComponent=0)  # -> Vector, Length
futureposition_2 = Point(<point referenced from the Rhino model>)  # disabled
vdis_2 = VectorDisplay(Anchor=neighborposition, Vector=vec2pt_2.Vector)  # disabled
position_2 = Point(<point referenced from the Rhino model>)  # disabled
c_script = CSharpScript(
    agentPos=position,
    agentVel=vec2pt.Vector,
    BodySize=number_slider_4,
    neighborPos=neighborposition,
    neighborVel=vec2pt_2.Vector,
    checkDistance=number_slider_3,
    PotentialCollisionDistanceThreshold=number_slider,
    MaxSpeed=number_slider_5,
    RotationAngle=number_slider_6)  # -> out, NeighborFuturePosition, VectorToNeighborFuturePosition, DotProd, Ray, Projection, ProjectionToNeighborFuturePosition, B, DesiredVelocity; inputs agentPos: Point3d, agentVel: Vector3d, BodySize: Double, neighborPos: Point3d, neighborVel: Vector3d, checkDistance: Double, PotentialCollisionDistanceThreshold: Double, MaxSpeed: Double, RotationAngle: Double; disabled
# ---------- c_script: C# ----------
    Vector3d desiredVelocity = Vector3d.Zero;
    double bodySize = 1.0;

    Vector3d forward = agentVel;
    forward.Unitize();
    Point3d neighborFuturePosition2D = neighborPos;
    Vector3d neighborVelocity = neighborVel;
    neighborVelocity.Unitize();
    neighborFuturePosition2D += neighborVelocity * checkDistance;

    NeighborFuturePosition = neighborFuturePosition2D;//Out

    // Get the vector to the neighbors future position.
    Vector3d vectorToNeighborFuturePosition = Vector2Point(agentPos, neighborFuturePosition2D);

    VectorToNeighborFuturePosition = vectorToNeighborFuturePosition;//Out

    // Check to see if they might collide in the future.
    // (i.e. the future position is in front of the agent.
    double dotProduct = DotProduct(vectorToNeighborFuturePosition, forward);

    DotProd = dotProduct;//Out

    if (dotProduct > 0) // They might collide in the future.
    {
      // Cast a ray in the direction of current velocity with a length of checkDistance.
      Vector3d ray = agentVel;
      ray.Unitize();
      ray *= checkDistance;

      Ray = ray;//Out

      Vector3d projection = agentVel;
      projection.Unitize();
      projection *= dotProduct;

      Projection = projection;//Out

      Vector3d projectionToNeighborFuturePosition = Vector2Point(vectorToNeighborFuturePosition, projection);

      ProjectionToNeighborFuturePosition = projectionToNeighborFuturePosition;

      double distance = projectionToNeighborFuturePosition.Length;

      if(distance < bodySize / 2 + PotentialCollisionDistanceThreshold && projection.Length < ray.Length) {
        desiredVelocity = forward * MaxSpeed;
        Plane nrml = new Plane(agentPos, agentVel);
        desiredVelocity.Rotate(RotationAngle * Math.PI, nrml.YAxis); // Rotate it laterally from the collision site.
        desiredVelocity *= 1 - projection.Length / ray.Length; // scale it based on the distance between the position and collision site.
        B = true;
      }

    }

    DesiredVelocity = desiredVelocity;
# ---------- c_script: C# additional code ----------
  public static Vector3d Vector2Point(Point3d start, Point3d end)
  {
    return end - start;
  }

  public static Vector3d Vector2Point(Vector3d start, Vector3d end)
  {
    return end - start;
  }

  public static double DotProduct(Vector3d a, Vector3d b)
  {
    return a.Length * b.Length * Math.Cos(Vector3d.VectorAngle(a, b));
  }
# ---------- end c_script ----------
number_slider_7 = Slider(1, range=0..10)
particle = ConstructParticle(
    MinimumInitialVelocity=[vec.Vector, vec_2.Vector],
    MaximumInitialVelocity=[vec.Vector, vec_2.Vector],
    Acceleration=Vector(0, 0, 0),
    Lifespan=Slider(150, range=0..1000),
    Mass=1,
    BodySize=1,
    HistoryLength=1)
pt = Point(<point referenced from the Rhino model>)
vdis_3 = VectorDisplay(Anchor=pt, Vector=vec.Vector)
pt_2 = Point(<point referenced from the Rhino model>)
vdis_4 = VectorDisplay(Anchor=pt_2, Vector=vec_2.Vector)
number_slider_8 = Slider(3, range=0..10)  # disabled
vec2pt_3 = Vector2Pt(PointA=position_2, PointB=futureposition_2, Unitize=False)  # -> Vector, Length; disabled
vec2pt_4 = Vector2Pt(PointA=neighborposition_2, PointB=neighborfutureposition_2, Unitize=False)  # -> Vector, Length; disabled
number_slider_9 = Slider(0.78, range=0..1)
vdis_5 = VectorDisplay(Anchor=position_2, Vector=vec2pt_3.Vector)  # disabled
vdis_6 = VectorDisplay(Anchor=neighborposition_2, Vector=vec2pt_4.Vector)  # disabled
agent = ConstructAgent(Particle=particle, MaxSpeed=0.5, MaxForce=0.1, VisionRadius=5, VisionAngle=360)
ptemit = PointEmitter(ContinuousFlow=Toggle(False), CreationRate=1, NumberOfQuelea=Slider(1, range=0..10), Point=[pt, pt_2])
number_slider_10 = Slider(1.3, range=0..10)
timer = Timer(TimerInterval=20, Target=[engine, system])  # disabled
c_script_2 = CSharpScript(
    AgentPosition=neighborposition_2,
    AgentVelocity=vec2pt_4.Vector,
    NeighborPositions=position_2,
    NeighborVelocities=vec2pt_3.Vector,
    minTimeToCollision=number_slider_8)  # -> out, A, B, C, D; inputs AgentPosition: Point3d, AgentVelocity: Vector3d, NeighborPositions: list of Point3d, NeighborVelocities: list of Vector3d, minTimeToCollision: Double; disabled
# ---------- c_script_2: C# ----------
    IAgent agent = new IAgent(AgentPosition, AgentVelocity);
    List<IAgent> neighbors = new List<IAgent>(NeighborPositions.Count);
    for(int i = 0; i < NeighborPositions.Count; i++) {
      neighbors.Add(new IAgent(NeighborPositions[i], NeighborVelocities[i]));
    }

    //Vector3d desired = Vector3d.Zero;

    double steer = 0;

    IAgent threat = null;

    // Time (in seconds) until the most immediate collision threat found
    // so far.  Initial value is a threshold: don't look more than this
    // many frames into the future.
    double minTime = minTimeToCollision;

    // xxx solely for annotation
    Point3d xxxThreatPositionAtNearestApproach = Point3d.Unset;
    Point3d xxxOurPositionAtNearestApproach = Point3d.Unset;

    // for each of the other vehicles, determine which (if any)
    // pose the most immediate threat of collision.
    foreach(IAgent neighbor in neighbors)
    {
      if (neighbor != agent)
      {
        // avoid when future positions are this close (or less)
        double collisionDangerThreshold = agent.BodySize / 2 + neighbor.BodySize / 2;

        // predicted time until nearest approach of "this" and "other"
        double time = predictNearestApproachTime(agent, neighbor);
        D = time;
        // If the time is in the future, sooner than any other
        // threatened collision...
        if ((time >= 0) && (time < minTime))
        {
          D = time;
          // if the two will be close enough to collide,
          // make a note of it
          if (computeNearestApproachPositions(agent, neighbor, time) < collisionDangerThreshold)
          {
            //D = neighbor.Position;
            minTime = time;
            threat = neighbor;
            xxxThreatPositionAtNearestApproach = hisPositionAtNearestApproach;
            xxxOurPositionAtNearestApproach = ourPositionAtNearestApproach;
          }
        }
      }
    }

    // if a potential collision was found, compute steering to avoid
    if (threat != null)
    {
      D = threat.Position;
      // parallel: +1, perpendicular: 0, anti-parallel: -1
      double parallelness = DotProduct(agent.Forward, threat.Forward);
      double angle = 0.707;
      D = parallelness;
      if (parallelness < -angle)
      {
        // anti-parallel "head on" paths:
        // steer away from future threat position
        Vector3d offset = xxxThreatPositionAtNearestApproach - agent.Position;
        double sideDot = DotProduct(offset, agent.Side);
        steer = (sideDot > 0) ? -1.0 : 1.0;
      }
      else
      {
        if (parallelness > angle)
        {
          // parallel paths: steer away from threat
          Vector3d offset = threat.Position - agent.Position;
          double sideDot = DotProduct(offset, agent.Side);
          steer = (sideDot > 0) ? -1.0 : 1.0;
        }
        else
        {
          D = "else";
          D = "threat speed: " + threat.Speed.ToString() + "agent speed: " + agent.Speed.ToString();
          // perpendicular paths: steer behind threat
          // (only the slower of the two does this)
          if (threat.Speed <= agent.Speed)
          {
            D = threat.Speed;
            double sideDot = DotProduct(agent.Side, threat.Velocity);
            steer = (sideDot > 0) ? -1.0 : 1.0;
          }
        }
      }

      //annotateAvoidNeighbor(*threat, steer, xxxOurPositionAtNearestApproach, xxxThreatPositionAtNearestApproach);
    }

    A = agent.Side * steer;
    B = xxxOurPositionAtNearestApproach;
    C = xxxThreatPositionAtNearestApproach;
# ---------- c_script_2: C# additional code ----------
  Point3d ourPositionAtNearestApproach, hisPositionAtNearestApproach;

  public class IAgent {
    public Point3d Position;
    public Vector3d Velocity;
    public double BodySize;
    public IAgent(Point3d position, Vector3d velocity) {
      this.Position = position;
      this.Velocity = velocity;
      this.BodySize = 1.0;
    }

    public Vector3d Forward {
      get
      {
        Vector3d forward = Velocity;
        forward.Unitize();
        return forward;
      }
    }

    public double Speed {
      get
      {
        return Velocity.Length;
      }
    }

    public Vector3d Side {
      get
      {
        Vector3d side = Forward;
        side.Rotate(Math.PI / 2, Vector3d.ZAxis);
        return side;
      }
    }

    public Vector3d Up {
      get
      {
        Vector3d up = Forward;
        up.Rotate(Math.PI / 2, Vector3d.XAxis);
        return up;
      }
    }
  }

  // Given two vehicles, based on their current positions and velocities,
  // determine the time until nearest approach
  //
  // XXX should this return zero if they are already in contact?
  double predictNearestApproachTime (IAgent agent, IAgent neighbor)
  {
    // imagine we are at the origin with no velocity,
    // compute the relative velocity of the other vehicle
    Vector3d agentVelocity = agent.Velocity;
    Vector3d neighborVelocity = neighbor.Velocity;
    Vector3d relativeVelocity = neighborVelocity - agentVelocity;
    double relativeSpeed = relativeVelocity.Length;

    // for parallel paths, the vehicles will always be at the same distance,
    // so return 0 (aka "now") since "there is no time like the present"
    if (relativeSpeed == 0) return 0;

    // Now consider the path of the other vehicle in this relative
    // space, a line defined by the relative position and velocity.
    // The distance from the origin (our vehicle) to that line is
    // the nearest approach.

    // Take the unit tangent along the other vehicle's path
    Vector3d relativeTangent = relativeVelocity / relativeSpeed;

    // find distance from its path to origin (compute offset from
    // other to us, find length of projection onto path)
    Vector3d relativePosition = agent.Position - neighbor.Position;
    double projection = DotProduct(relativeTangent, relativePosition);

    return projection / relativeSpeed;
  }

  double computeNearestApproachPositions (IAgent agent, IAgent neighbor, double time)
  {

    Vector3d agentTravel = agent.Forward * agent.Speed * time;
    Vector3d neighborTravel = neighbor.Forward * neighbor.Speed * time;

    Point3d agentFinal = agent.Position + agentTravel;
    Point3d neighborFinal = neighbor.Position + neighborTravel;

    // xxx for annotation
    ourPositionAtNearestApproach = agentFinal;
    hisPositionAtNearestApproach = neighborFinal;

    return Vector2Point(agentFinal, neighborFinal).Length;
  }

  public static Vector3d Vector2Point(Point3d start, Point3d end)
  {
    return end - start;
  }

  public static Vector3d Vector2Point(Vector3d start, Vector3d end)
  {
    return end - start;
  }

  public static double DotProduct(Vector3d a, Vector3d b)
  {
    return a.Length * b.Length * Math.Cos(Vector3d.VectorAngle(a, b));
  }
# ---------- end c_script_2 ----------
system = System(Quelea=agent, Emitters=ptemit)  # -> System, Quelea, QueleaNetwork
division = Division(A=number_slider_4, B=2)  # disabled
neighbors = GetNeighborsInRadius(Agent=system.Quelea, QueleaNetwork=system.QueleaNetwork, VisionRadiusMultiplier=1, VisionAngleMultiplier=1)
engine = Engine(Reset=Toggle(True), System=system.System)
vdis_7 = VectorDisplay(Anchor=position, Vector=c_script.VectorToNeighborFuturePosition)  # disabled
pl = PlaneNormal(Origin=pt, ZAxis=vec.Vector)
pl_2 = PlaneNormal(Origin=pt_2, ZAxis=vec_2.Vector)
addition = Addition(A=division, B=number_slider)  # disabled
avoidcollision = AvoidUnalignedCollisionForce(
    Apply=True,
    WeightMultiplier=Slider(0.15, range=0..1),
    Agent=system.Quelea,
    GetNeighborsInRadius=neighbors,
    CheckDistance=5,
    PotentialCollisionDistanceThreshold=0.5,
    RotationAngleMutliplier=0.5)  # -> Force, DesiredVelocity
getposition = GetParticlePosition(Particle=system.Quelea)  # -> Position, SurfacePosition
neighborfutureposition_3 = Point(c_script.NeighborFuturePosition)  # disabled
vdis_8 = VectorDisplay(Anchor=neighborposition_2, Vector=c_script_2.A)  # disabled
panel = Panel(c_script.DotProd)  # disabled
panel_2 = Panel(c_script.B)  # disabled
panel_3 = Panel(c_script_2.D)  # disabled
circle = CircleCNR(Center=neighborfutureposition_3, Normal=Vector(0, 0, 1), Radius=addition)  # disabled
vdis_9 = VectorDisplay(Anchor=getposition.Position, Vector=avoidcollision.DesiredVelocity)
vdis_10 = VectorDisplay(Anchor=position, Vector=c_script.Projection)  # disabled
vdis_11 = VectorDisplay(Anchor=position, Vector=c_script.DesiredVelocity)  # disabled
vdis_12 = VectorDisplay(Anchor=neighborfutureposition_3, Vector=c_script.ProjectionToNeighborFuturePosition)  # disabled
vdis_13 = VectorDisplay(Anchor=position, Vector=c_script.Ray)  # disabled
