# Grasshopper definition binLattice2Test.gh (Grasshopper 0.9.75)
# plug-ins: Agent

number_slider = Slider(10, range=0..10)
box = DomainBox(Base=PlaneXY(0, 0, 0), X=number_slider, Y=number_slider, Z=number_slider)
agent = Agent(
    Lifespan=Slider(1000, range=0..1000),
    Mass=1,
    BodySize=1,
    MaximumSpeed=0.5,
    MaximumForce=0.1,
    VisionAngle=Slider(78, range=0..100),
    VisionRadius=5,
    LengthOfPositionHistory=1)
boxemit = BoxEmitter(Box=box, ContinuousFlow=Toggle(False), CreationRate=1, NumberOfAgents=Slider(1, range=0..10))
timer = Timer(TimerInterval=20, Target=[system, engine])
system = AgentSystem(Agents=agent, Emitters=boxemit)
engine = Engine(Reset=Toggle(True), System=system)
deconstructsystem = DeconstructSystem(System=system)
