# Grasshopper definition bounceContainTest.gh (Grasshopper 0.9.75)
# plug-ins: Agent

number_slider = Slider(15, range=0..100)
number_slider_2 = Slider(5, range=0..10)
number_slider_3 = Slider(0.1, range=0..0.1)
box = DomainBox(Base=PlaneXY(0, 0, 0), X=number_slider, Y=number_slider, Z=number_slider)
wires = BrepWireframe(Brep=box, Density=-1)
agent = ConstructAgent(
    Lifespan=Slider(100, range=0..100),
    Mass=1,
    BodySize=1,
    MaxSpeed=0.5,
    MaxForce=0.1,
    VisionAngle=15,
    VisionRadius=5,
    HistoryLength=1)
boxemit = BoxEmitter(Box=box, ContinuousFlow=True, CreationRate=1, NumberOfAgents=0)
timer = Timer(TimerInterval=20, Target=[engine, system])  # disabled
system = System(Agents=agent, Emitters=boxemit)
aaboxenv = AxisAlignedBoxEnvironment(Box=box)
deconstructsystem = DeconstructSystem(System=system)  # -> Agents, AgentCollection
neighbors = GetNeighborsInRadius(
    Agent=deconstructsystem.Agents,
    AgentCollection=deconstructsystem.AgentCollection,
    VisionRadius=Slider(1, range=0..10),
    VisionAngle=15)
engine = Engine(Reset=Toggle(False), System=system)
bouncecontain = BounceContainBehavior(System=system, Environment=aaboxenv)
separate = SeparateForce(Agent=deconstructsystem.Agents, GetNeighborsInRadius=neighbors, WeightMultiplier=1)
deconstructagent = DeconstructAgent(Agent=deconstructsystem.Agents)  # -> Position, Velocity, Acceleration, Lifespan, PositionHistory
dispatch = Dispatch(List=deconstructagent.Position, DispatchPattern=bouncecontain)  # -> ListA, ListB
preview = CustomPreview(
    Geometry=dispatch.ListA,
    Shader={ambient=RGB(0, 0, 0), diffuse=RGB(255, 105, 180), emission=RGB(76, 32, 54), shine=0.5, specular=RGB(255, 255, 255), transparency=0})
preview_2 = CustomPreview(Geometry=dispatch.ListB, Shader=ColourSwatch(SwatchColor=RGB(255, 255, 255)))
