# Grasshopper definition braitenbergOnSurface.gh (Grasshopper 0.9.75)
# plug-ins: Agent

# ---- group: Pre-Loaded Values
min = Panel("466000.0")
max = Panel("1259000.0")
solar_exposure_values = Panel("""1172436.75
1047414.5
1001287.875
1011595.25
1054090.75
1104832.0
1147844.5
1114301.25
1004563.25
1011193.75
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""")
solarexposurevalues = Number(solar_exposure_values)
min_2 = Number(min)
max_2 = Number(max)

# ---- group: inputs
V = Slider(7, range=1..100)
U = Slider(31, range=1..100)
inputsrf = Surface(<surface referenced from the Rhino model>)

# ----
divide = DivideDomain²(Domain=inputsrf, UCount=U, VCount=V)
subsrf = Isotrim(Surface=inputsrf, Domain=divide)
gradient = Gradient(LowerLimit=min_2, UpperLimit=max_2, Parameter=solarexposurevalues, stops=[0: RGB(255, 255, 255), 1: RGB(0, 0, 0)])
gradient_2 = Gradient(
    LowerLimit=min_2,
    UpperLimit=max_2,
    Parameter=solarexposurevalues,
    stops=[0: RGB(75, 107, 169), 0.329: RGB(254, 244, 84), 0.655: RGB(234, 126, 0), 1: RGB(234, 38, 0)])
number_slider = Slider(0.36, range=0..1)
preview = CustomPreview(Geometry=subsrf, Shader=gradient_2)
edges = BrepEdges(Brep=inputsrf)  # -> Naked, Interior, NonManifold
multiplication = Multiplication(B=Slider(1.5, range=0..10))
division = Division()
vec = VectorXYZ(XComponent=Slider(0.2, range=0..1), YComponent=0, ZComponent=0)  # -> Vector, Length
number_slider_2 = Slider(16, range=0..100)
vec_2 = VectorXYZ(XComponent=number_slider, YComponent=0, ZComponent=0)  # -> Vector, Length
planesrf = PlaneSurface(Plane=PlaneXY(0, 0, 0), XSize=multiplication, YSize=division)
srfenv = SurfaceEnvironment(Surface=planesrf)  # -> Environment, _2DReferenceSurface; disabled
srfenv_2 = SurfaceEnvironment(Surface=inputsrf)  # -> Environment, _2DReferenceSurface
srf = Surface(srfenv_2._2DReferenceSurface)
divide_2 = DivideDomain²(Domain=srf, UCount=U, VCount=V)
subsrf_2 = Isotrim(Surface=srf, Domain=divide_2)
crvpts = CrvPts(C=edges.Interior, N=number_slider_2)
preview_2 = CustomPreview(Geometry=subsrf_2, Shader=gradient_2)
crvpts_2 = CrvPts(C=edges.Interior, N=number_slider_2)
timer = Timer(TimerInterval=20, Target=[engine, system])  # disabled
srf_cp = SurfaceClosestPoint(Point=crvpts, Surface=inputsrf)  # -> Point, UVPoint, Distance
evalsrf = EvaluateSurface(Surface=inputsrf, Point=srf_cp.UVPoint)  # -> Point, Normal, Frame
deplane = DeconstructPlane(Plane=evalsrf.Frame)  # -> Origin, XAxis, YAxis, ZAxis
number_slider_3 = Slider(10, range=0..10)  # disabled
amp = Amplitude(Vector=deplane.XAxis, Amplitude=number_slider)
particle = ConstructParticle(
    MinimumInitialVelocity=amp,
    MaximumInitialVelocity=amp,
    Acceleration=Vector(0, 0, 0),
    Lifespan=Slider(-1, range=-1..1000),
    Mass=1,
    BodySize=1,
    HistoryLength=Slider(1000, range=0..1000))
agent = ConstructAgent(Particle=particle, MaxSpeed=0.5, MaxForce=0.1, VisionRadius=5, VisionAngle=360)
vehicle = ConstructVehicle(Agent=agent, Orientation=PlaneXY(0, 0, 0), WheelRadius=Slider(1, range=0..1))
move = Move(Geometry=crvpts, Motion=amp)  # -> Geometry, Transform
ptemit = PointEmitter(
    ContinuousFlow=Toggle(False),
    CreationRate=Slider(5, range=0..10),
    NumberOfQuelea=Slider(1, range=0..10),
    Point=move.Geometry)
system = System(Quelea=vehicle, Emitters=ptemit, Environment=srfenv_2.Environment)
desystem = DeconstructSystem(System=system)  # -> Quelea, QueleaNetwork
engine = Engine(Reset=Toggle(True), System=system)
vdis = VectorDisplay(Anchor=deplane.Origin, Vector=deplane.XAxis)
pt = Point(<point referenced from the Rhino model>)  # disabled
devehicle = DeconstructVehicle(Vehicle=desystem.Quelea)  # -> Orientation, simplify(WheelPositions), WheelTangentialVelocity, WheelAngles, WheelRadii, WheelAngularVelocity
departicle = DeconstructParticle(Particle=desystem.Quelea)  # -> simplify(Position), Velocity, Acceleration, Lifespan, Mass, BodySize, ReferencePosition, SurfaceVelocity, SurfaceAcceleration
contain = ContainForce(Apply=True, Agent=desystem.Quelea, WeightMultiplier=1, Environment=srfenv.Environment, VisionRadius=1)
pline = PolyLine(Vertices=departicle.Position, Closed=False)  # -> flatten(Polyline)
pln = Plane(devehicle.Orientation)
pt_2 = Point(departicle.ReferencePosition)
len = Length(Curve=pline)
divbyangle = CSharpScript()  # -> out, P; inputs crvs: list of Curve, angle: Double
# ---------- divbyangle: C# ----------
                                                                                                                              /*
  divideCrvsByDeltaTan : Curve[] * double -> LinkedList<Plane>
  REQUIRES: theta > 0
  ENSURES: divideCrvsByDeltaTan(crvs, theta) returns a linked list of planes
           along the curves s.t. there is a plane at every point along
           the curve where the change in the tangent vector between
           two points is greater than theta.
  */
    //initialize parameters
    double theta = angle;
    int n = crvs.Count;
    double stepSize = 0.5;
    Vector3d xAxis = new Vector3d(1, 0, 0);
    double rover; //steps along the curve by stepSize
    double oldRover; //stores the previous rover for comparison
    double discontinuity;
    Vector3d prevTan;
    Vector3d currTan;
    Curve crv;
    Interval dom;

    //initialize list
    List< Point3d > pts = new List<Point3d>();
    Point3d pt;

    Rhino.Geometry.Continuity c = Rhino.Geometry.Continuity.C1_continuous;

    for(int i = 0; i < n; i++)
    {
      crv = crvs[i];

      //initialize data
      dom = crv.Domain;
      rover = dom.Min;

      //Add plane at start point of curve to list
      pt = crv.PointAt(rover);
      pts.Add(pt);

      //Increment
      prevTan = crv.TangentAt(rover);
      oldRover = rover;
      rover += stepSize;

      while(rover < dom.Max)
      {
        currTan = crv.TangentAt(rover);
        //If there is a discontinuity between the oldRover and rover
        //then place a point at the discontinuity and update prevTan.
        bool isDisc = crv.GetNextDiscontinuity(c, oldRover, rover,
          out discontinuity);
        if(isDisc)
        {
          pt = crv.PointAt(discontinuity);
          pts.Add(pt);
          prevTan = crv.TangentAt(discontinuity);
        }

        //If the change in tangent vector is greater than theta,
        //then drop a target at the rover and update prevTan.
        double delta = RhinoMath.ToDegrees(Math.Abs(Vector3d.VectorAngle(prevTan, currTan)));
        if(delta > theta)
        {
          pt = crv.PointAt(rover);
          pts.Add(pt);
          prevTan = currTan;
        }
        //Increment
        oldRover = rover;
        rover += stepSize;
      }

      //Add target at end point of curve
      pt = crv.PointAt(dom.Max);
      pts.Add(pt);
    }
    P = pts;
# ---------- end divbyangle ----------
item = ListItem(List=departicle.Position, Index=0, Wrap=True)  # -> flatten(Item)
divide_3 = DivideCurve(Curve=pline, Count=len, Kinks=False)  # -> Points, Tangents, Parameters
srf_cp_2 = SurfaceClosestPoint(Point=divide_3.Points)  # -> Point, UVPoint, Distance
vdis_2 = VectorDisplay(Anchor=departicle.ReferencePosition, Vector=departicle.SurfaceVelocity)
vdis_3 = VectorDisplay(Anchor=item, Vector=departicle.Velocity)
preview_3 = CustomPreview(
    Geometry=item,
    Shader={ambient=RGB(0, 0, 0), diffuse=RGB(255, 105, 180), emission=RGB(76, 32, 54), shine=0.5, specular=RGB(255, 255, 255), transparency=0})
pln_2 = Plane(devehicle.Orientation)
deplane_2 = DeconstructPlane(Plane=pln_2)  # -> Origin, XAxis, YAxis, ZAxis
evalsrf_2 = EvaluateSurface(Surface=reparameterize(inputsrf), Point=srf_cp_2.UVPoint)  # -> Point, Normal, Frame
amp_2 = Amplitude(Vector=deplane_2.XAxis, Amplitude=Slider(1.5, range=0..10))
pline_2 = PolyLine(Vertices=evalsrf_2.Point, Closed=False)
dup = DuplicateData(Data=graft(amp_2), Number=2, Order=True)
swatch = ColourSwatch(SwatchColor=RGB(0, 255, 255))
preview_4 = CustomPreview(Geometry=pline, Shader=swatch)
move_2 = Move(Geometry=devehicle.WheelPositions, Motion=dup)  # -> Geometry, Transform
preview_5 = CustomPreview(Geometry=pline_2, Shader=swatch)
pdecon = Deconstruct(Point=move_2.Geometry)  # -> XComponent, YComponent, ZComponent
sdivide = DivideSurface(UCount=Slider(111, range=0..1000), VCount=Slider(18, range=0..100))  # -> Points, Normals, simplify(Parameters)
remap = RemapNumbers(Value=pdecon.XComponent, Source=Domain(0, 1), Target=Domain(0, 1))  # -> Mapped, Clipped
remap_2 = RemapNumbers(Value=pdecon.YComponent, Source=Domain(0, 1), Target=Domain(0, 1))  # -> Mapped, Clipped
pt_3 = ConstructPoint(XCoordinate=remap.Mapped, YCoordinate=remap_2.Mapped, ZCoordinate=0)
image = ImageSampler(
    simplify(sdivide.Parameters),
    FilePath="E:\OneDrive\Documents\cmu\11-Fall_2014\Thesis\Demos\ecoSkinBitmapBlurredSmall.jpg",
    Filter="Colour",
    Interpolate=False,
    Umax=1,
    Umin=0,
    Vmax=1,
    Vmin=0,
    Wrap=1)
panel = Panel("E:\OneDrive\Documents\cmu\11-Fall_2014\Thesis\Demos\ecoSkinBitmapBlurredSmall.jpg")
image_2 = ImageSampler(
    pt_3,
    FilePath="E:\OneDrive\Documents\cmu\11-Fall_2014\Thesis\Demos\ecoSkinBitmapBlurredSmall.jpg",
    Filter="Value",
    Interpolate=False,
    Umax=1,
    Umin=0,
    Vmax=1,
    Vmin=0,
    Wrap=1)
preview_6 = CustomPreview(Geometry=simplify(sdivide.Points), Shader=image)  # disabled
image_3 = LoadImage(Filepath=panel, Reload=False)
item_2 = ListItem(List=image_2, Index=1, Wrap=True)
item_3 = ListItem(List=image_2, Index=0, Wrap=True)
sensorforce = SensorForce(Apply=True, Vehicle=graft(desystem.Quelea), WeightMultiplier=1, SL=item_3, SR=item_2, Crossed=False)  # -> Force, SL, SR; disabled
sensefield = SensoryFieldForce(Apply=True, Vehicle=desystem.Quelea, WeightMultiplier=1, BitmapImage=image_3, Crossed=False)  # -> Force, SL, SR
panel_2 = Panel(sensefield.SL)
panel_3 = Panel(sensefield.SR)
addition = Addition(A=sensorforce.SL, B=sensorforce.SR)
remap_3 = RemapNumbers(Value=addition, Source=Domain(0, 2), Target=Domain(0, 1))  # -> Mapped, Clipped

crv = Curve(<curve referenced from the Rhino model>)  # disabled
pt_4 = Point(crvpts_2)  # disabled
incurve = PointInCurve(Point=item, Curve=crv)  # -> Relationship, Point; disabled
rev = ReverseList(List=pt_4)  # disabled
number_slider_4 = Slider(0.12, range=0..1)  # disabled
dom = ConstructDomain(DomainStart=number_slider_4, DomainEnd=1)  # disabled
dist = Distance(PointA=item, PointB=rev)  # disabled
bool = Boolean(incurve.Relationship)  # disabled
not = GateNot(A=bool)  # disabled

number_slider_5 = Slider(10, range=0..100)  # disabled
number_slider_6 = Slider(105, range=0..1000)  # disabled
number_slider_7 = Slider(0, range=0..100)  # disabled
number_slider_8 = Slider(0, range=0..1)  # disabled
number_slider_9 = Slider(1, range=0..1)  # disabled
X = UnitX(Factor=expr("-x", number_slider_5))  # disabled
move_3 = Move(Geometry=rev, Motion=X)  # -> Geometry, Transform; disabled
dist_2 = Distance(PointA=item, PointB=move_3.Geometry)  # disabled
dom_2 = ConstructDomain(DomainStart=number_slider_6, DomainEnd=number_slider_7)  # disabled
dom_3 = ConstructDomain(DomainStart=number_slider_8, DomainEnd=number_slider_9)  # disabled
remap_4 = RemapNumbers(Value=dist_2, Source=dom_2, Target=dom_3)  # -> Mapped, Clipped; disabled
graph = GraphMapper(remap_4.Mapped, x0=0, x1=1, y0=0, y1=1, container_name="Power", Gx=0.6594203115, Gy=0.3550724387, power=2.486666702)  # disabled
seek = SeekForce(Apply=not, Agent=desystem.Quelea, WeightMultiplier=graph, TargetPoint=move_3.Geometry)  # disabled

attract = AttractForce(
    Apply=not,
    Particle=desystem.Quelea,
    WeightMultiplier=1,
    TargetPoint=pt,
    Mass=number_slider_3,
    DistanceLowerLimit=5,
    DistanceUpperLimit=100)  # disabled

dom_4 = ConstructDomain(DomainStart=number_slider_5, DomainEnd=0)  # disabled
remap_5 = RemapNumbers(Value=dist, Source=dom_4, Target=dom)  # -> Mapped, Clipped; disabled
switch = CSharpScript(within=bool, low=number_slider_4, high=remap_5.Mapped)  # -> out, W; inputs within: Boolean, low: Double, high: Double; disabled
# ---------- switch: C# ----------
    double weight = low;
    if(within) {
      weight = high;
    }
    W = weight;
# ---------- end switch ----------
seek_2 = SeekForce(Apply=True, Agent=desystem.Quelea, WeightMultiplier=switch.W, TargetPoint=rev)  # disabled

# ==== cluster CrvPts
C = ClusterInput()
N = ClusterInput()
divide = DivideCurve(Curve=C, Count=expr("x-1", N), Kinks=False)  # -> Points, Tangents, Parameters
shift = ShiftList(List=divide.Points, Shift=1, Wrap=False)
shift_2 = ShiftList(List=shift, Shift=-1, Wrap=False)
L = ClusterOutput(shift_2)
