# Grasshopper definition braitenbergPoint_20150505.gh (Grasshopper 0.9.75)
# plug-ins: Agent

number_slider = Slider(0.1, range=0..1)
vec = VectorXYZ(XComponent=Slider(0.1, range=0..1), YComponent=0, ZComponent=0)  # -> Vector, Length
amp = Amplitude(Amplitude=Slider(0.1, range=0..1))
vdis = VectorDisplay(Vector=amp)
particle = ConstructParticle(
    UpDirection=Vector(0, 0, 1),
    Acceleration=Vector(0, 0, 0),
    Lifespan=Slider(-1, range=-1..1000),
    Mass=1,
    BodySize=1,
    HistoryLength=Slider(1000, range=0..1000))
agent = ConstructAgent(Particle=particle, MaxSpeed=0.5, MaxForce=0.1, VisionRadius=5, VisionAngle=360)
pt = Point(<point referenced from the Rhino model>)
vehicle = ConstructVehicle(Agent=agent, Orientation=PlaneXY(0, 0, 0), WheelRadius=Slider(1, range=0..5))
srfenv = SurfaceEnvironment()  # -> Environment, _2DReferenceSurface
ptemit = PointEmitter(
    ContinuousFlow=Toggle(False),
    CreationRate=Slider(5, range=0..10),
    NumberOfQuelea=Slider(1, range=0..10),
    MinimumInitialVelocity=vec.Vector,
    MaximumInitialVelocity=vec.Vector,
    Point=pt)  # -> flatten(Emitter)
system = System(Quelea=vehicle, Emitters=ptemit)  # -> System, Quelea, QueleaNetwork
item = ListItem(List=system.Quelea, Index=0, Wrap=True)
Z = UnitZ(Factor=1)
getposhist = GetParticlePositionHistory(Particle=system.Quelea)
getposition = GetParticlePosition(Particle=system.Quelea)  # -> Position, SurfacePosition
getvelocity = GetParticleVelocity(Particle=system.Quelea)  # -> Velocity, SurfaceVelocity
getorientation = GetOrientation(Particle=system.Quelea)
devehicle = DeconstructVehicle(Vehicle=item)  # -> Orientation, WheelPositions, WheelTangentialVelocity, WheelAngles, WheelRadii, WheelAngularVelocity
sph = Sphere(Base=devehicle.Orientation, Radius=expr("x/2", 1))
pln = Plane(devehicle.Orientation)
deplane = DeconstructPlane(Plane=simplify(pln))  # -> Origin, XAxis, YAxis, ZAxis
pline = PolyLine(Vertices=getposhist, Closed=False)  # -> flatten(Polyline)
vdis_2 = VectorDisplay(Anchor=getposition.Position, Vector=getvelocity.Velocity)
vdis_3 = VectorDisplay(Anchor=getposition.SurfacePosition, Vector=getvelocity.SurfaceVelocity)
timer = Timer(TimerInterval=20, Target=[engine, system])  # disabled
engine = Engine(Reset=Toggle(True), System=system.System)
vdis_4 = VectorDisplay(Anchor=devehicle.WheelPositions, Vector=devehicle.WheelTangentialVelocity)
pl = ConstructPlane(Origin=pln, XAxis=deplane.XAxis, YAxis=expr("-x", deplane.ZAxis))
circle = CircleCNR(Center=devehicle.WheelPositions, Normal=deplane.YAxis, Radius=devehicle.WheelRadii)
rotate = Rotate(Geometry=circle, Angle=devehicle.WheelAngles, Plane=pl)  # -> Geometry, Transform
pt_2 = Point(<point referenced from the Rhino model>)
pt_3 = Point(<point referenced from the Rhino model>)  # disabled
sensept = SensePointForce(
    Apply=True,
    WeightMultiplier=1,
    Vehicle=system.Quelea,
    VisionRadiusMultiplier=0.2,
    VisionAngleMultiplier=0.125,
    Crossed=Toggle(True),
    Point=[pt_2, pt_3],
    Radius=Slider(10, range=0..10))  # -> Force, DesiredVelocity, SensorValues, SensorPositions
divide = DivideCurve(Curve=rotate.Geometry, Count=5, Kinks=False)  # -> Points, Tangents, Parameters
ln = Line(StartPoint=graft(devehicle.WheelPositions), EndPoint=divide.Points)
curvepoint = PointOnCurve(rotate.Geometry, parameter=0)
panel = Panel(sensept.SensorValues)
