# Grasshopper definition flockingTest.gh (Grasshopper 0.9.75)
# plug-ins: Agent

number_slider = Slider(150, range=0..1000)
dom = ConstructDomain(DomainStart=Slider(0.7, range=0..1), DomainEnd=Slider(1, range=0..10))
dom_2 = ConstructDomain(DomainStart=Slider(0.07, range=0..1), DomainEnd=Slider(0.13, range=0..1))
dom_3 = ConstructDomain(DomainStart=Slider(1, range=0..10), DomainEnd=Slider(3, range=0..10))
random = Random(Range=dom, Number=number_slider, Seed=4)
random_2 = Random(Range=dom_2, Number=number_slider, Seed=3)
random_3 = Random(Range=dom_3, Number=number_slider, Seed=2)
number_slider_2 = Slider(5, range=0..10)
number_slider_3 = Slider(0.1, range=0..1)
number_slider_4 = Slider(1, range=0..1)
box = CenterBox(Base=PlaneXY(0, 0, 0), X=Slider(11, range=0..100), Y=Slider(3, range=0..100), Z=Slider(6, range=0..100))
particle = ConstructParticle(
    MinimumInitialVelocity=Vector(-0.1, -0.1, -0.1),
    MaximumInitialVelocity=Vector(0.1, 0.1, 0.1),
    UpDirection=Vector(0, 0, 1),
    Acceleration=Vector(0, 0, 0),
    Lifespan=Slider(-1, range=-1..1000),
    Mass=1,
    BodySize=1,
    HistoryLength=1)
box_2 = Box(box)
scale = Scale(Geometry=box_2, Center=Point(0, 0, 0), Factor=Slider(1.25, range=0..10))  # -> Geometry, Transform
agent = ConstructAgent(Particle=particle, MaxSpeed=random, MaxForce=random_2, VisionRadius=random_3, VisionAngle=360)
aaboxenv = AxisAlignedBoxEnvironment(Box=box_2)
aaboxenv_2 = AxisAlignedBoxEnvironment(Box=scale.Geometry)
boxemit = BoxEmitter(ContinuousFlow=Toggle(False), CreationRate=1, NumberOfQuelea=number_slider, Box=box_2)
number_slider_5 = Slider(0.002, range=0..0.01)
number_slider_6 = Slider(0, range=0..1)
Z = UnitZ(Factor=expr("-x", Slider(0.01, range=0..1)))
brep = Brep(<brep referenced from the Rhino model>)  # disabled
system = System(Quelea=agent, Emitters=boxemit, Environment=aaboxenv_2)  # -> System, Quelea, QueleaNetwork
timer = Timer(TimerInterval=20, Target=[engine, system])  # disabled
applyforce = ApplyCustomForce(Apply=True, WeightMultiplier=1, Particle=system.Quelea, ForceVector=Z)  # -> Force, DesiredVelocity
avoidobstacle = AvoidObstacleForce(Apply=True, WeightMultiplier=1, Agent=system.Quelea, Obstacle=brep, VisionRadiusMutliplier=0.2)  # -> Force, DesiredVelocity; disabled
engine = Engine(Reset=Toggle(True), System=system.System)
cluster = Cluster(A=system.Quelea, en=aaboxenv, qn=system.QueleaNetwork)
getposition = GetParticlePosition(Particle=system.Quelea)  # -> Position, SurfacePosition
getvelocity = GetParticleVelocity(Particle=system.Quelea)  # -> Velocity, SurfaceVelocity
vlen = VectorLength(Vector=getvelocity.Velocity)
vdis = VectorDisplay(Anchor=getposition.Position, Vector=getvelocity.Velocity)

# ==== cluster Cluster
number_slider = Slider(0.5, range=0..1)
number_slider_2 = Slider(0.125, range=0..1)  # disabled
A = ClusterInput()
qn = ClusterInput()
en = ClusterInput()
neighbors = GetNeighborsInRadius(Agent=A, QueleaNetwork=qn, VisionRadiusMultiplier=1, VisionAngleMultiplier=1)
neighbors_2 = GetNeighborsInRadius(Agent=A, QueleaNetwork=neighbors, VisionRadiusMultiplier=number_slider, VisionAngleMultiplier=1)
neighbors_3 = GetNeighborsInRadius(Agent=A, QueleaNetwork=neighbors_2, VisionRadiusMultiplier=Slider(0.333, range=0..1), VisionAngleMultiplier=1)
contain = ContainForce(Apply=True, WeightMultiplier=1, Agent=A, Environment=en, VisionRadiusMutliplier=Slider(1, range=0..1))  # -> Force, DesiredVelocity
neighbors_4 = GetNeighborsInRadius(Agent=A, QueleaNetwork=neighbors_2, VisionRadiusMultiplier=number_slider, VisionAngleMultiplier=number_slider_2)  # disabled
view = ViewForce(Apply=True, WeightMultiplier=1, Agent=A, GetNeighborsInRadius=neighbors_4)  # -> Force, DesiredVelocity; disabled
wander = WanderForce(
    Apply=True,
    WeightMultiplier=Slider(0.15, range=0..1),
    Agent=A,
    Strength=Slider(0.1, range=0..1),
    Rate=Slider(0.25, range=0..1))  # -> Force, DesiredVelocity, Sphere, TargetPoint; disabled
cohese = CoheseForce(Apply=True, WeightMultiplier=Slider(0.8, range=0..1), Agent=A, GetNeighborsInRadius=neighbors)  # -> Force, DesiredVelocity
align = AlignForce(Apply=True, WeightMultiplier=Slider(0.25, range=0..1), Agent=A, GetNeighborsInRadius=neighbors_2)  # -> Force, DesiredVelocity
separate = SeparateForce(Apply=True, WeightMultiplier=Slider(1, range=0..1), Agent=A, GetNeighborsInRadius=neighbors_3)  # -> Force, DesiredVelocity
