# Grasshopper definition neighbors3ComponentTest.gh (Grasshopper 0.9.75)
# plug-ins: Agent

number_slider = Slider(100, range=0..1000)
number_slider_2 = Slider(100, range=0..100)
number_slider_3 = Slider(15, range=0..100)
toggle = BooleanToggle(True)
toggle_2 = BooleanToggle(False)
timer = Timer(TimerInterval=20, Target=[engine_2, system, engine])  # disabled
box = DomainBox(Base=PlaneXY(0, 0, 0), X=number_slider_3, Y=number_slider_3, Z=number_slider_3)
agent = Agent(
    Lifespan=number_slider_2,
    Mass=1,
    BodySize=1,
    MaximumSpeed=0.5,
    MaximumForce=0.1,
    VisionAngle=15,
    VisionRadius=5,
    LengthOfPositionHistory=1)  # disabled
agent_2 = Agent(
    Lifespan=number_slider_2,
    Mass=1,
    BodySize=1,
    MaximumSpeed=0.5,
    MaximumForce=0.1,
    VisionAngle=15,
    VisionRadius=5,
    LengthOfPositionHistory=1)
boxemit = BoxEmitter(Box=box, ContinuousFlow=toggle_2, CreationRate=1, NumberOfAgents=number_slider)
boxemit_2 = BoxEmitter(Box=box, ContinuousFlow=toggle_2, CreationRate=1, NumberOfAgents=number_slider)
cohese = CoheseForce(Weight=1, VisionMultiplier=1)
system = AgentSystem(Agents=agent_2, Emitters=boxemit_2)
system_2 = AgentSystem(Agents=agent, Emitters=boxemit, Forces=cohese)
cohese3 = CoheseForce(VisionAngle=360, VisionRadiusMutliplier=1)
deconstructsystem = DeconstructSystem(System=system)  # -> Agents, AgentSystem
cohese_2 = CoheseForce(VisionAngle=360, VisionRadiusMutliplier=1)
neighbors = NeighborsInRadius(VisionRadius=5, VisionAngle=360)
cohese2 = CoheseForce()
engine = Engine(Reset=toggle, Systems=system_2)
neighbors_2 = NeighborsInRadius(Agent=deconstructsystem.Agents, System=system, VisionRadius=5, VisionAngle=360)  # disabled
neighbors3 = NeighborsInRadius(Agent=deconstructsystem.Agents, AgentCollection=deconstructsystem.AgentSystem, VisionRadius=5, VisionAngle=360)
deconstructagent = DeconstructAgent()  # -> Position, Velocity, Acceleration, Lifespan, PositionHistory
engine_2 = Engine(Reset=toggle, System=system)
cohese3_2 = CoheseForce(System1=system, System2=system, VisionAngle=360, VisionRadiusMutliplier=1)  # disabled
deconstructagent_2 = DeconstructAgent(Agent=engine)  # -> Position, Velocity, Acceleration, Lifespan, PositionHistory
neighbors2 = NeighborsInRadius(VisionRadius=5, VisionAngle=360)
cohese4 = CoheseForce(Agent=deconstructsystem.Agents, Neighbors=neighbors3)
deconstructac = DeconstructAgentCollection(AgentCollection=neighbors3)
deconstructagent_3 = DeconstructAgent(Agent=deconstructsystem.Agents)  # -> Position, Velocity, Acceleration, Lifespan, PositionHistory
preview = CustomPreview(Geometry=deconstructagent_2.Position, Shader=ColourSwatch(SwatchColor=RGB(0, 255, 255)))
vdis = VectorDisplay(Anchor=deconstructagent_3.Position, Vector=cohese4)
deconstructagent_4 = DeconstructAgent(Agent=deconstructac)  # -> Position, Velocity, Acceleration, Lifespan, PositionHistory
vdis_2 = VectorDisplay(Anchor=deconstructagent_3.Position, Vector=deconstructagent_3.Velocity)
preview_2 = CustomPreview(Geometry=deconstructagent_3.Position, Shader=ColourSwatch(SwatchColor=RGB(255, 0, 255)))
item = ListItem(List=deconstructsystem.Agents, Index=0, Wrap=True)
viewer = ParamViewer(deconstructagent_4.Position)
deconstructagent_5 = DeconstructAgent(Agent=item)  # -> Position, Velocity, Acceleration, Lifespan, PositionHistory
item_2 = ListItem(List=viewer, Index=0, Wrap=True)
branch = TreeBranch(Tree=deconstructagent_4.Position, Path=item_2, MaintainPaths=True)
sph = Sphere(Base=deconstructagent_5.Position, Radius=Slider(5, range=0..10))
preview_3 = CustomPreview(Geometry=deconstructagent_5.Position, Shader=ColourSwatch(SwatchColor=RGB(255, 255, 255)))
preview_4 = CustomPreview(Geometry=branch, Shader=ColourSwatch(SwatchColor=RGB(255, 255, 0)))
