# Grasshopper definition neighborsAngleTest.gh (Grasshopper 0.9.75)
# plug-ins: Agent

particle = ConstructParticle(
    MinimumInitialVelocity=Vector(-0.1, -0.1, -0.1),
    MaximumInitialVelocity=Vector(0.1, 0.1, 0.1),
    Acceleration=Vector(0, 0, 0),
    Lifespan=Slider(150, range=0..1000),
    Mass=1,
    BodySize=1,
    HistoryLength=1)
ptemit = PointEmitter(ContinuousFlow=Toggle(False), CreationRate=1, NumberOfQuelea=Slider(2, range=0..10), Point=Point(0, 0, 0))
agent = ConstructAgent(Particle=particle, MaxSpeed=0.5, MaxForce=0.1, VisionRadius=5, VisionAngle=360)
timer = Timer(TimerInterval=20, Target=[engine, system])  # disabled
system = System(Quelea=agent, Emitters=ptemit)
desystem = DeconstructSystem(System=system)  # -> Quelea, QueleaNetwork
engine = Engine(Reset=Toggle(False), System=system)
neighbors = GetNeighborsInRadius(Agent=desystem.Quelea, QueleaNetwork=desystem.QueleaNetwork, VisionRadius=5, VisionAngle=Slider(179, range=0..360))
departicle = DeconstructParticle(Particle=desystem.Quelea)  # -> simplify(Position), Velocity, Acceleration, Lifespan, Mass, BodySize, ReferencePosition
item = ListItem(List=neighbors, Index=0, Wrap=True)
item_2 = ListItem(List=departicle.Position, Index=0, Wrap=True)  # -> flatten(Item)
item_3 = ListItem(List=departicle.Velocity, Index=0, Wrap=True)
deconstructqn = DeconstructQueleaNetwork(QueleaNetwork=item)
item_4 = ListItem(List=item_2, Index=0, Wrap=True)
departicle_2 = DeconstructParticle(Particle=deconstructqn)  # -> simplify(Position), Velocity, Acceleration, Lifespan, Mass, BodySize, ReferencePosition
vdis = VectorDisplay(Anchor=item_4, Vector=item_3)
item_5 = ListItem(List=departicle_2.Position, Index=0, Wrap=True)  # -> flatten(Item)
preview = CustomPreview(Geometry=item_4, Shader=ColourSwatch(SwatchColor=RGB(255, 255, 255)))
preview_2 = CustomPreview(
    Geometry=item_5,
    Shader={ambient=RGB(0, 0, 0), diffuse=RGB(255, 105, 180), emission=RGB(76, 32, 54), shine=0.5, specular=RGB(255, 255, 255), transparency=0})
