# Grasshopper definition neighborsComponentTest.gh (Grasshopper 0.9.75)
# plug-ins: Agent

number_slider = Slider(15, range=0..100)
number_slider_2 = Slider(100, range=0..100)
number_slider_3 = Slider(500, range=0..1000)
toggle = BooleanToggle(False)
box = DomainBox(Base=PlaneXY(0, 0, 0), X=number_slider, Y=number_slider, Z=number_slider)
toggle_2 = BooleanToggle(False)
timer = Timer(TimerInterval=20, Target=[engine, system, engine_2])  # disabled
number_slider_4 = Slider(100, range=0..100)
int = Integer(Toggle(True))
agent = Agent(
    Lifespan=number_slider_4,
    Mass=1,
    BodySize=1,
    MaximumSpeed=0.5,
    MaximumForce=0.1,
    VisionAngle=15,
    VisionRadius=5,
    LengthOfPositionHistory=1)  # disabled
agent_2 = Agent(
    Lifespan=number_slider_4,
    Mass=1,
    BodySize=1,
    MaximumSpeed=0.5,
    MaximumForce=0.1,
    VisionAngle=int,
    VisionRadius=5,
    LengthOfPositionHistory=1)
boxemit = BoxEmitter(Box=box, ContinuousFlow=toggle, CreationRate=1, NumberOfAgents=number_slider_3)
boxemit_2 = BoxEmitter(Box=box, ContinuousFlow=toggle, CreationRate=1, NumberOfAgents=number_slider_3)
cohese = CoheseForce(Weight=1, VisionMultiplier=Slider(0.5, range=0..1))
cohese_2 = CoheseForce(Weight=1, VisionMultiplier=1)
system = AgentSystem(Agents=agent_2, Emitters=boxemit)
cohese_3 = CoheseForce(System1=system, System2=system, VisionAngle=360, VisionRadiusMutliplier=1)  # disabled
vdis = VectorDisplay(Vector=cohese_3)  # disabled
system_2 = AgentSystem(Agents=agent, Emitters=boxemit_2, Forces=cohese_2)
deconstructsystem = DeconstructSystem(System=system)
engine = Engine(Reset=toggle_2, System=system)
neighbors = NeighborsInRadius(Agent=deconstructsystem, System=system, VisionRadius=5, VisionAngle=360)  # -> simplify(Neighbors)
cohese3 = CoheseForce(System1=system, System2=system, VisionAngle=360, VisionRadiusMutliplier=1)
cohese_4 = CoheseForce(System1=system, System2=system, VisionAngle=360, VisionRadiusMutliplier=1)
engine_2 = Engine(Reset=toggle_2, Systems=system_2)
neighbors2 = NeighborsInRadius(System1=system, System2=system, VisionRadius=5, VisionAngle=360)
viewer = ParamViewer(neighbors2)  # disabled
cohese2 = CoheseForce(Agent=simplify(graft(deconstructsystem)), Neighbors=simplify(neighbors))  # -> simplify(CohesionForce)
deconstructagent = DeconstructAgent(Agent=engine_2)  # -> Position, Velocity, Acceleration, Lifespan, PositionHistory
cohese2_2 = CoheseForce(Agent=simplify(graft(deconstructsystem)), Neighbors=simplify(neighbors2))  # -> simplify(flatten(CohesionForce))
item = ListItem(List=viewer, Index=0, Wrap=True)  # disabled
merge = Merge(Data1=cohese2_2, Data2=cohese2)
item_2 = ListItem(List=deconstructsystem, Index=0, Wrap=True)  # disabled
branch = TreeBranch(Tree=neighbors2, Path=item, MaintainPaths=True)  # disabled
ma = MassAddition(Input=merge)  # -> flatten(Result), PartialResults
deconstructagent_2 = DeconstructAgent(Agent=item_2)  # -> Position, Velocity, Acceleration, Lifespan, PositionHistory; disabled
deconstructagent_3 = DeconstructAgent(Agent=branch)  # -> Position, Velocity, Acceleration, Lifespan, PositionHistory; disabled
vdis_2 = VectorDisplay(Vector=cohese2_2)
deconstructagent_4 = DeconstructAgent(Agent=deconstructsystem)  # -> Position, Velocity, Acceleration, Lifespan, PositionHistory
vdis_3 = VectorDisplay()  # disabled
viewer_2 = ParamViewer()  # disabled
swatch = ColourSwatch(SwatchColor=RGB(255, 255, 255))  # disabled
vdis_4 = VectorDisplay(Vector=cohese2)  # disabled
swatch_2 = ColourSwatch(SwatchColor=RGB(0, 255, 0))  # disabled
vdis_5 = VectorDisplay(Anchor=deconstructagent_2.Position, Vector=deconstructagent_2.Velocity)  # disabled
number_slider_5 = Slider(5, range=0..10)  # disabled
item_3 = ListItem(Index=0, Wrap=True)  # disabled
item_4 = ListItem(List=viewer_2, Index=0, Wrap=True)  # disabled
branch_2 = TreeBranch(Path=item_4, MaintainPaths=True)  # disabled
preview = CustomPreview(Geometry=deconstructagent_2.Position, Shader=swatch)  # disabled
preview_2 = CustomPreview(Geometry=deconstructagent_3.Position, Shader=swatch_2)  # disabled
swatch_3 = ColourSwatch(SwatchColor=RGB(255, 255, 255))  # disabled
swatch_4 = ColourSwatch(SwatchColor=RGB(0, 255, 255))  # disabled
sph = Sphere(Base=PlaneXY(0, 0, 0), Radius=number_slider_5)  # disabled
preview_3 = CustomPreview(Geometry=item_3, Shader=swatch_3)  # disabled
preview_4 = CustomPreview(Geometry=branch_2, Shader=swatch_4)  # disabled
