# Grasshopper definition neighborsInAngleTest.gh (Grasshopper 0.9.75)
# plug-ins: Agent

number_slider = Slider(5, range=0..100)
number_slider_2 = Slider(5, range=0..10)
box = DomainBox(Base=PlaneXY(0, 0, 0), X=number_slider, Y=number_slider, Z=number_slider)
wires = BrepWireframe(Brep=box, Density=-1)
boxemit = BoxEmitter(Box=box, ContinuousFlow=Toggle(False), CreationRate=1, NumberOfAgents=Slider(100, range=0..1000))
number_slider_3 = Slider(90, range=0..1000)
agent = ConstructAgent(
    Lifespan=Slider(1000, range=0..1000),
    Mass=1,
    BodySize=1,
    MaxSpeed=0.5,
    MaxForce=0.1,
    VisionAngle=number_slider_3,
    VisionRadius=number_slider_2,
    HistoryLength=Slider(5, range=0..10))
crv = Curve(<curve referenced from the Rhino model>)
aaboxenv = AxisAlignedBoxEnvironment(Box=box)
number_slider_4 = Slider(45, range=0..360)
system = System(Agents=agent, Emitters=boxemit)
timer = Timer(TimerInterval=20, Target=[system, engine])  # disabled
end = EndPoints(Curve=crv)  # -> Start, End
deconstructsystem = DeconstructSystem(System=system)  # -> Agents, AgentCollection
vec2pt = Vector2Pt(PointA=end.Start, PointB=end.End, Unitize=False)  # -> Vector, Length
engine = Engine(Reset=Toggle(False), System=system)
neighbors = GetNeighborsInRadius(
    Agent=deconstructsystem.Agents,
    AgentCollection=deconstructsystem.AgentCollection,
    VisionRadius=5,
    VisionAngle=number_slider_3)
pt = Point(<point referenced from the Rhino model>)
contain = ContainForce(Agent=deconstructsystem.Agents, Environment=aaboxenv, WeightMultiplier=1, VisionRadius=expr("x/5", number_slider_2))
vec = Vector(vec2pt.Vector)
pt_2 = Point(<point referenced from the Rhino model>)
cohese = CoheseForce(Agent=deconstructsystem.Agents, GetNeighborsInRadius=neighbors, WeightMultiplier=1)
c_script = CSharpScript(position=pt, velocity=vec, neighbor=pt_2, visionAngle=number_slider_4)  # -> out, A, B, C, D, E, F; inputs position: Point3d, velocity: Vector3d, neighbor: Point3d, visionAngle: Double
# ---------- c_script: C# ----------
    Plane pl1 = new Plane(position, velocity);
    pl1.Rotate(-Math.PI / 2, pl1.YAxis);
    B = pl1;
    Plane pl2 = pl1;
    pl2.Rotate(-Math.PI / 2, pl1.XAxis);
    C = pl2;

    Vector3d diff = Vector3d.Subtract(new Vector3d(neighbor), new Vector3d(position));
    double d = diff.Length;
    double angle1 = calcAngle(velocity, diff, pl1);
    D = angle1;
    double angle2 = calcAngle(velocity, diff, pl2);
    E = angle2;
    F = approximatelyEqual(angle1, visionAngle / 2, 0.0001);
    if(approximatelyEqual(angle1, visionAngle / 2, 0.0001) && approximatelyEqual(angle2, visionAngle / 2, 0.0001))
    {
      A = neighbor;
    }
# ---------- c_script: C# additional code ----------
  public static double RadToDeg(double rad)
  {
    return rad * (180 / Math.PI);
  }

  private double calcAngle(Vector3d vec, Vector3d diff, Plane pl) {
    double angle = Vector3d.VectorAngle(vec, diff, pl);
    angle = RadToDeg(angle);
    if(angle > 180) angle = 360 - angle;
    return angle;
  }

  bool approximatelyEqual(double a, double b, double epsilon)
  {
    return a - b <= ((a < b ? b : a) * epsilon);
  }

  bool essentiallyEqual(double a, double b, double epsilon)
  {
    return a - b <= (( a > b ? b : a) * epsilon);
  }

  bool definitelyGreaterThan(double a, double b, double epsilon)
  {
    return a - b > (( a < b ? b : a) * epsilon);
  }

  bool definitelyLessThan(double a, double b, double epsilon)
  {
    return (b - a) > (( a < b ? b : a) * epsilon);
  }
# ---------- end c_script ----------
c_script_2 = CSharpScript(position=pt, velocity=vec, neighbor=pt_2, visionAngle=number_slider_4)  # -> out, A, B, C, D; inputs position: Point3d, velocity: Vector3d, neighbor: Point3d, visionAngle: Double; disabled
# ---------- c_script_2: C# ----------
    Plane pl = new Plane(position, velocity, Vector3d.ZAxis);
    D = pl;
    Vector3d diff = Vector3d.Subtract(new Vector3d(neighbor), new Vector3d(position));
    B = diff;
    double d = diff.Length;
    double angle = Vector3d.VectorAngle(velocity, diff, pl);
    C = angle;
    angle = RadToDeg(angle);
    if (angle > 180) angle = angle - 360;
    if (Math.Abs(angle) <= visionAngle / 2)
    {
      A = neighbor;
    }
# ---------- c_script_2: C# additional code ----------
  public static double RadToDeg(double rad)
  {
    return rad * (180 / Math.PI);
  }
# ---------- end c_script_2 ----------
item = ListItem(List=deconstructsystem.Agents, Index=0, Wrap=True)
item_2 = ListItem(List=neighbors, Index=0, Wrap=True)
view = ViewForce(Agent=deconstructsystem.Agents, GetNeighborsInRadius=neighbors, WeightMultiplier=1)  # disabled
deconstructagent = DeconstructAgent(Agent=deconstructsystem.Agents)  # -> Position, Velocity, Acceleration, Lifespan, PositionHistory
vdis = VectorDisplay(Anchor=deconstructagent.Position, Vector=cohese)  # disabled
deconstructagent_2 = DeconstructAgent(Agent=item)  # -> Position, Velocity, Acceleration, Lifespan, PositionHistory; disabled
panel = Panel([c_script.E, c_script.F])
pln = Plane(c_script.C)
pt_3 = Point(c_script.A)
deconstructac = DeconstructAgentCollection(AgentCollection=item_2)  # disabled
vdis_2 = VectorDisplay(Anchor=c_script.A, Vector=c_script_2.B)
intcrv = Interpolate(Vertices=deconstructagent.PositionHistory, Degree=3, Periodic=False, KnotStyle=1)  # -> Curve, Length, Domain
vdis_3 = VectorDisplay(Anchor=deconstructagent_2.Position, Vector=deconstructagent_2.Velocity)  # disabled
pl = PlaneNormal(Origin=deconstructagent_2.Position, ZAxis=deconstructagent_2.Velocity)  # disabled
swatch = ColourSwatch(SwatchColor=RGB(0, 0, 255))  # disabled
preview = CustomPreview(
    Geometry=pt_3,
    Shader={ambient=RGB(0, 0, 0), diffuse=RGB(255, 105, 180), emission=RGB(76, 32, 54), shine=0.5, specular=RGB(255, 255, 255), transparency=0})
deconstructagent_3 = DeconstructAgent(Agent=deconstructac)  # -> Position, Velocity, Acceleration, Lifespan, PositionHistory; disabled
difference = SetDifference(SetA=deconstructagent.Position, SetB=deconstructagent_3.Position)  # disabled
equals = Equality(FirstNumber=deconstructagent.Position, SecondNumber=deconstructagent_3.Position)  # -> Equality, Inequality; disabled
deplane = DeconstructPlane(Plane=pl)  # -> Origin, XAxis, YAxis, ZAxis; disabled
swatch_2 = ColourSwatch(SwatchColor=RGB(255, 255, 255))  # disabled
preview_2 = CustomPreview(Geometry=difference, Shader=swatch)  # disabled
vrot = Rotate(Vector=deconstructagent_2.Velocity, Axis=deplane.XAxis, Angle=expr("x/2", number_slider_3))  # disabled
line = LineSDL(Start=deconstructagent_2.Position, Direction=expr("-x", vrot), Length=expr("x*2", number_slider_2))  # disabled
preview_3 = CustomPreview(Geometry=deconstructagent_3.Position, Shader=swatch_2)  # disabled
pl_2 = PlaneNormal(Origin=deconstructagent_2.Position, ZAxis=expr("-x", deconstructagent_2.Velocity))  # disabled
sph = Sphere(Base=deconstructagent_2.Position, Radius=number_slider_2)  # disabled
line_2 = LineSDL(Start=deplane.Origin, Direction=deplane.ZAxis, Length=1)  # disabled
amp = Amplitude(Vector=deconstructagent_2.Velocity, Amplitude=number_slider_2)  # disabled
revsrf = Revolution(Curve=line, Axis=line_2, Domain=Domain(0, 6.283185307))  # disabled
move = Move(Geometry=pl_2, Motion=amp)  # -> Geometry, Transform; disabled
cap = CapHoles(Brep=revsrf)  # disabled
sint = SolidIntersection(BrepsA=sph, BrepsB=cap)  # disabled
cone = Cone(Base=move.Geometry, Radius=0.5, Length=number_slider_2)  # -> Cone, Tip; disabled
