# Grasshopper definition orientationTest.gh (Grasshopper 0.9.75)
# plug-ins: Agent

number_slider = Slider(0.15, range=0..1)
number_slider_2 = Slider(1, range=0..10)
vec = VectorXYZ(XComponent=number_slider, YComponent=number_slider, ZComponent=0)  # -> Vector, Length
particle = ConstructParticle(
    MinimumInitialVelocity=expr("-x", vec.Vector),
    MaximumInitialVelocity=vec.Vector,
    UpDirection=Vector(0, 0, 1),
    Acceleration=Vector(0, 0, 0),
    Lifespan=Slider(150, range=0..1000),
    Mass=1,
    BodySize=1,
    HistoryLength=1)
pt = Point(<point referenced from the Rhino model>)
pt_2 = Point(<point referenced from the Rhino model>)
number_slider_3 = Slider(0.4, range=0..1)  # disabled
number_slider_4 = Slider(0.6, range=0..1)  # disabled
number_slider_5 = Slider(0.3, range=0..1)  # disabled
agent = ConstructAgent(
    Particle=particle,
    MaxSpeed=Slider(0.34, range=0..1),
    MaxForce=Slider(0.02, range=0..0.1),
    VisionRadius=5,
    VisionAngle=360)
ptemit = PointEmitter(ContinuousFlow=Toggle(False), CreationRate=1, NumberOfQuelea=Slider(10, range=0..1000), Point=[pt, pt_2])
pt_3 = ConstructPoint(XCoordinate=0, YCoordinate=0, ZCoordinate=0)  # disabled
vec_2 = VectorXYZ(XComponent=number_slider_3, YComponent=number_slider_4, ZComponent=number_slider_5)  # -> Vector, Length; disabled
vehicle = ConstructVehicle(Agent=agent, Orientation=PlaneXY(0, 0, 0), WheelRadius=1)
pl = ConstructPlane(Origin=pt_3, XAxis=Vector(1, 0, 0), YAxis=Vector(0, 1, 0))  # disabled
move = Move(Geometry=pt_3, Motion=vec_2.Vector)  # -> Geometry, Transform; disabled
Y = UnitY(Factor=1)
vec2pt = Vector2Pt(PointA=pl, PointB=move.Geometry, Unitize=False)  # -> Vector, Length; disabled
pt_4 = Point(<point referenced from the Rhino model>)
Z = UnitZ(Factor=1)
timer = Timer(TimerInterval=20, Target=[engine, system])  # disabled
vdis = VectorDisplay(Anchor=pl, Vector=vec2pt.Vector)  # disabled
system = System(Quelea=vehicle, Emitters=ptemit)  # -> System, Quelea, QueleaNetwork
panel = Panel(system.QueleaNetwork)
seek = SeekForce(Apply=True, WeightMultiplier=Slider(0.15, range=0..1), Agent=system.Quelea, TargetPoint=pt_4)  # -> Force, DesiredVelocity; disabled
c_script = CSharpScript(Orientation=pl, Position3D=move.Geometry, Velocity=vec2pt.Vector)  # -> out, A, B, C; inputs Orientation: Plane, Position3D: Point3d, Velocity: Vector3d; disabled
# ---------- c_script: C# ----------
    Plane orientation = Orientation;
    orientation.Origin = Position3D;
    double angle = Vector3d.VectorAngle(Velocity, orientation.XAxis, orientation);

    orientation.Rotate(angle, orientation.ZAxis);
    if (!ApproximatelyEqual(Vector3d.VectorAngle(Velocity, orientation.XAxis, orientation), 0, Rhino.RhinoDoc.ActiveDoc.ModelAbsoluteTolerance))
    {
      orientation.Rotate(-2 * angle, orientation.ZAxis);
    }
    Plane pln = new Plane(orientation.Origin, orientation.XAxis, -orientation.ZAxis);
    angle = Vector3d.VectorAngle(Velocity, orientation.XAxis, pln);
    orientation.Rotate(angle, orientation.YAxis);
    if (!ApproximatelyEqual(Vector3d.VectorAngle(Velocity, orientation.XAxis, pln), 0, Rhino.RhinoDoc.ActiveDoc.ModelAbsoluteTolerance))
    {
      orientation.Rotate(-2 * angle, orientation.YAxis);
    }
    if (!ApproximatelyEqual(Vector3d.VectorAngle(Velocity, orientation.XAxis, pln), 0, Rhino.RhinoDoc.ActiveDoc.ModelAbsoluteTolerance))
    {
      B = Vector3d.VectorAngle(Velocity, orientation.XAxis, pln);
      C = pln;
      //throw new ApplicationException("Plane not aligned.");
    }
    A = orientation;
# ---------- c_script: C# additional code ----------
  public static bool ApproximatelyEqual(double a, double b, double epsilon)
  {
    //return a - b <= ((a < b ? b : a) * epsilon);
    return Math.Abs(a - b) <= epsilon * Math.Max(Math.Max(1.0f, Math.Abs(a)), Math.Abs(b));
  }
# ---------- end c_script ----------
neighbors = GetNeighborsInRadius(Agent=system.Quelea, QueleaNetwork=system.QueleaNetwork, VisionRadiusMultiplier=1, VisionAngleMultiplier=1)
engine = Engine(Reset=Toggle(True), System=system.System)
getvelocity = GetParticleVelocity(Particle=system.Quelea)  # -> Velocity, SurfaceVelocity
c_script_2 = CSharpScript(velocity=getvelocity.Velocity, up=Z)  # -> out, A; inputs velocity: Vector3d, up: Vector3d
# ---------- c_script_2: C# ----------
    A = Vector3d.CrossProduct(velocity, up);
# ---------- end c_script_2 ----------
devehicle = DeconstructVehicle(Vehicle=system.Quelea)  # -> Orientation, WheelPositions, WheelTangentialVelocity, WheelAngles, WheelRadii, WheelAngularVelocity; disabled
panel_2 = Panel(c_script.B)  # disabled
pln = Plane(c_script.C)  # disabled
pln_2 = Plane(c_script.A)  # disabled
avoidcollision = AvoidUnalignedCollisionForce(
    Apply=Toggle(True),
    WeightMultiplier=Slider(1, range=0..1),
    Agent=system.Quelea,
    GetNeighborsInRadius=neighbors,
    MinumumTimeToCollision=5)  # -> Force, DesiredVelocity
pln_3 = Plane(devehicle.Orientation)
pl_2 = PlaneNormal(Origin=pln_3, ZAxis=getvelocity.Velocity)
deplane = DeconstructPlane(Plane=pl_2)  # -> Origin, XAxis, YAxis, ZAxis
pl_3 = ConstructPlane(Origin=pln_3, XAxis=getvelocity.Velocity, YAxis=c_script_2.A)
pl_4 = ConstructPlane(Origin=deplane.Origin, XAxis=deplane.YAxis, YAxis=deplane.ZAxis)
getorientation = GetOrientation(Particle=system.Quelea)
larger = LargerThan(FirstNumber=avoidcollision.DesiredVelocity, SecondNumber=0)  # -> LargerThan, OrEqualTo
velocity = SetVelocity(Apply=True)
getposition = GetParticlePosition(Particle=system.Quelea)  # -> Position, SurfacePosition; disabled
pl_5 = ConstructPlane(Origin=pln_3, XAxis=getvelocity.Velocity, YAxis=c_script_2.A)
vdis_2 = VectorDisplay(Anchor=getorientation, Vector=avoidcollision.Force)
panel_3 = Panel(getposition.Position)
vdis_3 = VectorDisplay(Anchor=getorientation, Vector=getvelocity.Velocity)
cone = Cone(Base=pl_3, Radius=0.5, Length=1)  # -> Cone, Tip
