# Grasshopper definition polymorphicTypeTest.gh (Grasshopper 0.9.75)
# plug-ins: Agent

number_slider = Slider(0.39, range=0..1)
number_slider_2 = Slider(0.03, range=0..1)
number_slider_3 = Slider(10, range=0..10)
vec = VectorXYZ(XComponent=expr("-x", number_slider), YComponent=expr("-x", number_slider), ZComponent=number_slider_2)  # -> Vector, Length
pt = ConstructPoint(XCoordinate=0, YCoordinate=0, ZCoordinate=0)
vec_2 = VectorXYZ(XComponent=number_slider, YComponent=number_slider, ZComponent=number_slider_2)  # -> Vector, Length
vec_3 = VectorXYZ(XComponent=0, YComponent=0, ZComponent=Slider(0.09, range=0..0.1))  # -> Vector, Length
number_slider_4 = Slider(1, range=0..10)
number_slider_5 = Slider(15, range=0..100)
vdis = VectorDisplay(Anchor=pt, Vector=vec.Vector)
vdis_2 = VectorDisplay(Anchor=pt, Vector=vec_2.Vector)
particle = ConstructParticle(
    MinimumInitialVelocity=vec.Vector,
    MaximumInitialVelocity=vec_2.Vector,
    Acceleration=Vector(0, 0, 0),
    Lifespan=Slider(-1, range=-1..1000),
    Mass=1,
    BodySize=1,
    HistoryLength=Slider(4, range=0..10))
box = CenterBox(Base=PlaneXY(0, 0, 0), X=number_slider_5, Y=number_slider_5, Z=number_slider_5)
wires = BrepWireframe(Brep=box, Density=-1)
ptemit = PointEmitter(ContinuousFlow=Toggle(True), CreationRate=1, NumberOfQuelea=0, Point=Point(0, 0, 0))
agent = ConstructAgent(Particle=particle, MaxSpeed=0.5, MaxForce=0.1, VisionRadius=5, VisionAngle=360)
timer = Timer(TimerInterval=20, Target=[system, engine])
aaboxenv = AxisAlignedBoxEnvironment(Box=box)
system = System(Quelea=agent, Emitters=ptemit, Environment=aaboxenv)
desystem = DeconstructSystem(System=system)  # -> Quelea, QueleaNetwork
bouncecontain = BounceContainBehavior(Apply=True, Particle=desystem.Quelea, Environment=aaboxenv)
engine = Engine(Reset=Toggle(True), System=system)
number_slider_6 = Slider(0.47, range=0..1)
neighbors = GetNeighborsInRadius(Agent=desystem.Quelea, QueleaNetwork=desystem.QueleaNetwork, VisionRadius=Slider(1, range=0..10), VisionAngle=360)  # disabled
swatch = ColourSwatch(SwatchColor=RGB(97, 169, 255))
panel = Panel(bouncecontain)
dequelea = DeconstructQuelea(Quelea=desystem.Quelea)  # -> simplify(Position), Velocity, Acceleration, Lifespan, ReferencePosition
not = GateNot(A=bouncecontain)
deconstructqn = DeconstructQueleaNetwork(QueleaNetwork=neighbors)
Z = UnitZ(Factor=expr("-x", Slider(0.01, range=0..0.1)))
number_slider_7 = Slider(0.15, range=0..1)
cloud = CloudDisplay(Points=flatten(dequelea.Position), Colours=swatch, Size=number_slider_7, SpriteType=0)  # disabled
separate = SeparateForce(Apply=True, Agent=desystem.Quelea, WeightMultiplier=number_slider_6, GetNeighborsInRadius=neighbors)
item = ListItem(List=dequelea.Position, Index=0, Wrap=True)
applyforce = ApplyCustomForce(Apply=not, Agent=desystem.Quelea, WeightMultiplier=1, ForceVector=Z)
cohese = CoheseForce(Apply=True, Agent=desystem.Quelea, WeightMultiplier=number_slider_6, GetNeighborsInRadius=neighbors)  # disabled
dots = DotDisplay(Point=dequelea.Position, Colour=swatch, Size=number_slider_7)  # disabled
panel_2 = Panel(dequelea.Position)
intcrv = Interpolate(Vertices=dequelea.Position, Degree=3, Periodic=False, KnotStyle=1)  # -> flatten(Curve), Length, Domain
