# Grasshopper definition polysrfEnvTest.gh (Grasshopper 0.9.75)
# plug-ins: Agent

number_slider = Slider(10, range=0..10)

# ----
# POINT EMITTER
# Point from which to emit agents.
# If continuous flow, Agents will be consistently emitted. Limit the number of agnets allowed at once with the Number of Agents setting.
toggle = BooleanToggle(True)
agent_vision_radius_multiplier = Slider(3, range=0..10)
agent_cohesion_vision_radius = Slider(5, range=0..10)

brep = Brep(<brep referenced from the Rhino model>)
# CONSTRUCT AGENT
# Agent Settings:
# Initializes agents with these settings. The settings cannot change once the agent has been emitted. If there is just 1 Agent output from A, all the agents will have that setting. If you would like a diversity of agent settings for each agent, feed in a list of values into the settings you would like to be different.
number_slider_2 = Slider(1000, range=0..1000)
brep_2 = Brep(<brep referenced from the Rhino model>)
pt = Point(<point referenced from the Rhino model>)
brep_3 = Brep(<brep referenced from the Rhino model>)
pt_2 = Point(<point referenced from the Rhino model>)
pt_3 = Point(<point referenced from the Rhino model>)
number_slider_3 = Slider(1, range=0..1)
brep_4 = Brep(<brep referenced from the Rhino model>)
brep_5 = Brep(<brep referenced from the Rhino model>)
Z = UnitZ(Factor=1)
vec2pt = Vector2Pt(PointA=pt_2, PointB=pt_3, Unitize=False)  # -> Vector, Length
ptemit = PointEmitter(Point=pt, ContinuousFlow=toggle, CreationRate=1, NumberOfAgents=Slider(7, range=0..100))
agent = ConstructAgent(
    Lifespan=number_slider_2,
    Mass=1,
    BodySize=Slider(0.5, range=0..1),
    MaxSpeed=Slider(0.1, range=0..1),
    MaxForce=Slider(0.03, range=0..1),
    HistoryLength=Slider(100, range=0..100))
polysrfenv = PolysurfaceEnvironment(Brep=brep_2, BorderExtrutionDirection=Vector(0, 0, 0))  # -> Environment, BorderWalls
Z_2 = UnitZ(Factor=1)
brep_6 = Brep(polysrfenv.BorderWalls)
c_script = CSharpScript(environment=brep_2, P=pt_2, V=vec2pt.Vector, S=number_slider_3, borderDir=Z_2)  # -> out, A, B, C, D, E, F, AA; inputs environment: Brep, P: Point3d, V: Vector3d, S: Double, borderDir: Vector3d
# ---------- c_script: C# ----------
    this.environment = environment;
    Curve[] borderCrvs = GetNakedEdges();
    A = borderCrvs.ToList();


    IList<Point3d> edgePts = DivByAngle(borderCrvs, 1.0);
    B = edgePts;
    IList<Vector3d> normals = new List<Vector3d>();
    if(borderDir.Equals(Vector3d.Zero)) {
      normals = GetBrepNormals(edgePts);
    }
    else {
      for(int i = 0; i < edgePts.Count; i++) {
        normals.Add(borderDir);
      }
    }
    C = normals;
    double borderSize = environment.GetBoundingBox(Plane.WorldXY).Diagonal.Length / 10;
    borderWalls = GetBorderWalls(borderCrvs, edgePts, normals, borderSize);
    D = borderWalls;

    AgentType agent = new AgentType(P, V, S);
    double distance = 1.0;

    Vector3d steer = new Vector3d();
    Vector3d avoidVec, parVec;

    Vector3d velocity = agent.Velocity;
    Point3d position = agent.Position;

    double tol = 0.01;

    Curve[] overlapCrvs;
    Point3d[] intersectPts;

    Curve[] feelers = GetFeelerCrvs(agent, distance, true);

    E = feelers.ToList();
    List<Vector3d> borderNormals = new List<Vector3d>();

    int count = 0;

    foreach (Curve feeler in feelers)
    {
      foreach (Brep brep in borderWalls)
      {
        //Check feeler intersection with each brep face
        foreach (BrepFace face in brep.Faces)
        {
          Rhino.Geometry.Intersect.Intersection.CurveBrepFace(feeler, face, tol, out overlapCrvs, out intersectPts);
          if (intersectPts.Length > 0)
          {
            Point3d testPt = feeler.PointAtEnd;
            double u, v;
            face.ClosestPoint(testPt, out u, out v);
            Vector3d normal = face.NormalAt(u, v);
            normal.Reverse();
            Vector.GetProjectionComponents(normal, velocity, out parVec, out avoidVec);
            avoidVec.Unitize();
            //weight by distance
            avoidVec = Vector3d.Divide(avoidVec, position.DistanceTo(intersectPts[0]));
            steer = Vector3d.Add(steer, avoidVec);
            count++;
            break; //Break when we hit a face
          }
        }
      }
    }
    if (count > 0)
    {
      steer = Vector3d.Divide(steer, count);
    }
    F = steer;
# ---------- c_script: C# additional code ----------
  public Brep environment;
  public Brep[] borderWalls;
  private Curve[] GetNakedEdges()
  {
    List<Curve> nakedEdges = new List<Curve>();
    foreach (BrepEdge edge in environment.Edges)
    {
      // Find only the naked edges
      if (edge.Valence == EdgeAdjacency.Naked)
      {
        Curve crv = edge.DuplicateCurve();
        if (null != crv)
          nakedEdges.Add(crv);
      }
    }
    RhinoDoc doc = RhinoDoc.ActiveDoc;
    double tol = 2.1 * doc.ModelAbsoluteTolerance;

    return Curve.JoinCurves(nakedEdges, tol);
  }

    /**
     * divideCrvsByDeltaTan : Curve[] * double -> LinkedList<Plane>
     * REQUIRES: theta > 0
     * ENSURES: divideCrvsByDeltaTan(crvs, theta) returns a linked list of planes
     *          along the curves s.t. there is a plane at every point along
     *          the curve where the change in the tangent vector between
     *          two points is greater than theta.
    **/
  private IList<Point3d> DivByAngle(Curve[] crvs, double angle)
  {

    //initialize parameters
    double theta = angle;
    const double stepSize = 0.5;

    //initialize list
    List<Point3d> pts = new List<Point3d>();

    Continuity c = Continuity.C1_continuous;

    foreach(Curve crv in crvs)
    {
      //initialize data
      Interval dom = crv.Domain;
      double rover = dom.Min; //steps along the curve by stepSize

      //Add plane at start point of curve to list
      Point3d pt = crv.PointAt(rover);
      pts.Add(pt);

      //Increment
      Vector3d prevTan = crv.TangentAt(rover);
      double oldRover = rover; //stores the previous rover for comparison
      rover += stepSize;

      while (rover < dom.Max)
      {
        Vector3d currTan = crv.TangentAt(rover);
        //If there is a discontinuity between the oldRover and rover
        //then place a point at the discontinuity and update prevTan.
        double discontinuity;
        bool isDisc = crv.GetNextDiscontinuity(c, oldRover, rover,
          out discontinuity);
        if (isDisc)
        {
          pt = crv.PointAt(discontinuity);
          pts.Add(pt);
          prevTan = crv.TangentAt(discontinuity);
        }

        //If the change in tangent vector is greater than theta,
        //then drop a target at the rover and update prevTan.
        double delta = RhinoMath.ToDegrees(Math.Abs(Vector3d.VectorAngle(prevTan, currTan)));
        if (delta > theta)
        {
          pt = crv.PointAt(rover);
          pts.Add(pt);
          prevTan = currTan;
        }
        //Increment
        oldRover = rover;
        rover += stepSize;
      }

      //Add target at end point of curve
      pt = crv.PointAt(dom.Max);
      pts.Add(pt);
    }
    return pts;
  }

  private IList<Vector3d> GetBrepNormals(IEnumerable<Point3d> pts)
  {
    //Initialize variables
    List<Surface> brepSrfs = new List<Surface>();
    List<Vector3d> normals = new List<Vector3d>();
    const double epsilon = 0.000001; //The minimum distance to determine which surface a pt is touching.

    //Explode brep
    Rhino.Geometry.Collections.BrepFaceList brepFaces = environment.Faces;
    foreach(BrepFace face in brepFaces)
    {
      Surface srf = face.ToBrep().Surfaces[0];
      if(face.OrientationIsReversed)
      {
        brepSrfs.Add(srf.Reverse(0));
      }
      else {
        brepSrfs.Add(srf);
      }
    }

      /*
      for each point, get the closest point to each surface
      */
    foreach(Point3d pt in pts) {
      List<Plane> framesTemp = new List<Plane>();
      foreach(Surface srf in brepSrfs) {
        double u;
        double v;
        srf.ClosestPoint(pt, out u, out v);
        Plane frame;
        srf.FrameAt(u, v, out frame);
        if(pt.DistanceTo(frame.Origin) <= epsilon) {
          framesTemp.Add(frame);
        }
      }
        /*
        if there is 1 close surface:
          add the two normal vectors together to get the bisector
        */
      Vector3d brepNormal;
      if(framesTemp.Count == 1) {
        brepNormal = framesTemp[0].Normal;
      }
        /*
        if there are 2 equally close surfaces:
          add the two normal vectors together to get the bisector
        */
      else {
        brepNormal = framesTemp[0].Normal;
        if(framesTemp.Count > 1) {
          for(int j = 1; j < framesTemp.Count; j++) {
            Plane pln = framesTemp[j];
            brepNormal = Vector3d.Add(brepNormal, pln.Normal);
          }
        }
      }

      //Set magnitude to distance.
      brepNormal.Unitize();

      normals.Add(brepNormal);
    }
    return normals;
  }

  private Brep[] GetBorderWalls(Curve[] borderCrvs, IEnumerable<Point3d> pts, IEnumerable<Vector3d> nrmls, double dist)
  {
    List<Point3d> ptsOut = new List<Point3d>();
    List<Point3d> ptsIn = new List<Point3d>();
    IEnumerator ptEnum = pts.GetEnumerator();
    IEnumerator nrmlEnum = nrmls.GetEnumerator();
    while ((ptEnum.MoveNext()) && (nrmlEnum.MoveNext()))
    {
      Point3d pt = (Point3d) ptEnum.Current;
      Vector3d nrml = (Vector3d) nrmlEnum.Current;
      Transform mvOut = Transform.Translation(nrml * dist);
      Transform mvIn = Transform.Translation(nrml * -dist);
      Point3d ptOut = new Point3d(pt);
      Point3d ptIn = new Point3d(pt);
      ptOut.Transform(mvOut);
      ptIn.Transform(mvIn);
      ptsOut.Add(ptOut);
      ptsIn.Add(ptIn);
    }

    Curve crvOut;
    Curve crvIn;

    if(borderCrvs[0].IsPolyline()) {
      crvOut = new PolylineCurve(ptsOut);
      crvIn = new PolylineCurve(ptsIn);
    }
    else {
      crvOut = Curve.CreateInterpolatedCurve(ptsOut, 3);
      crvIn = Curve.CreateInterpolatedCurve(ptsIn, 3);
    }
    List<Curve> crvs = new List<Curve>();
    crvs.Add(crvOut);
    crvs.Add(crvIn);
    Brep[] lofts = Brep.CreateFromLoft(crvs, Point3d.Unset, Point3d.Unset, LoftType.Normal, false);

    double minSoFar = Double.MaxValue;
    Interval interval = new Interval(0, 1);
    Point3d loftPt = lofts[0].Faces[0].PointAt(0, 0);
    BrepFace testFace = environment.Faces[0];
    Point3d facePt = testFace.PointAt(0.25, 0.25);
    foreach(BrepFace face in environment.Faces) {
      double u, v;
      face.ClosestPoint(loftPt, out u, out v);
      facePt = face.PointAt(u, v);
      dist = loftPt.DistanceTo(facePt);
      if(dist < minSoFar) {
        minSoFar = dist;
        testFace = face;
      }
    }

    Vector3d loftNrml = lofts[0].Faces[0].NormalAt(0, 0);
    testFace.SetDomain(0, interval);
    testFace.SetDomain(1, interval);
    facePt = testFace.PointAt(0.5, 0.5);
    Vector3d testVec = Vector3d.Subtract(new Vector3d(facePt), new Vector3d(loftPt));
    double dotProd = Vector3d.Multiply(loftNrml, testVec) / (loftNrml.Length * testVec.Length);
    if(dotProd >= 0) {
      foreach(Brep brep in lofts) {
        brep.Flip();
      }
    }
    return lofts;
  }

  private static Curve GetFeelerCrv(Vector3d feelerVec, Point3d position,
    double bodySize, double visionAngle,
    Vector3d rotAxis)
  {
    feelerVec.Rotate(visionAngle, rotAxis);
    feelerVec = Vector3d.Multiply(feelerVec, bodySize);
    return new Line(position, feelerVec).ToNurbsCurve();
  }

  private static Curve[] GetFeelerCrvs(AgentType agent, double visionDistance,
    bool accurate)
  {
    Curve[] feelers;
    if (accurate)
    {
      feelers = new Curve[5];
    }
    else
    {
      feelers = new Curve[1];
    }

    double feelerAngle = Math.PI / 2;
    //Calculate straight ahead feeler with length visionDistance
    Vector3d feelerVec = agent.Velocity;
    feelerVec.Unitize();
    feelerVec = Vector3d.Multiply(feelerVec, visionDistance);
    feelers[0] = new Line(agent.Position, feelerVec).ToNurbsCurve();

    if (!accurate)
    {
      return feelers;
    }

    //Calculate tertiary feelers with length bodySize
    feelerVec = agent.Velocity;
    feelerVec.Unitize();
    Plane rotPln = new Plane(agent.Position, agent.Velocity);
    Vector3d rotAxis = rotPln.XAxis;
    feelers[1] = GetFeelerCrv(feelerVec, agent.RefPosition, agent.BodySize, feelerAngle, rotAxis);
    feelers[2] = GetFeelerCrv(feelerVec, agent.RefPosition, agent.BodySize, -feelerAngle, rotAxis);
    rotAxis = rotPln.YAxis;
    feelers[3] = GetFeelerCrv(feelerVec, agent.RefPosition, agent.BodySize, feelerAngle, rotAxis);
    feelers[4] = GetFeelerCrv(feelerVec, agent.RefPosition, agent.BodySize, -feelerAngle, rotAxis);

    return feelers;
  }

  public Vector3d AvoidEdges(AgentType agent, double distance)
  {
    Vector3d steer = new Vector3d();
    Vector3d avoidVec, parVec;

    Vector3d velocity = agent.Velocity;
    Point3d position = agent.Position;

    double tol = 0.01;

    Curve[] overlapCrvs;
    Point3d[] intersectPts;

    Curve[] feelers = GetFeelerCrvs(agent, distance, true);
    int count = 0;

    foreach (Curve feeler in feelers)
    {
      foreach (Brep brep in borderWalls)
      {
        //Check feeler intersection with each brep face
        foreach (BrepFace face in brep.Faces)
        {
          Rhino.Geometry.Intersect.Intersection.CurveBrepFace(feeler, face, tol, out overlapCrvs, out intersectPts);
          if (intersectPts.Length > 0)
          {
            Point3d testPt = feeler.PointAtEnd;
            double u, v;
            face.ClosestPoint(testPt, out u, out v);
            Vector3d normal = face.NormalAt(u, v);
            normal.Reverse();
            Vector.GetProjectionComponents(normal, velocity, out parVec, out avoidVec);
            avoidVec.Unitize();
            //weight by distance
            avoidVec = Vector3d.Divide(avoidVec, position.DistanceTo(intersectPts[0]));
            steer = Vector3d.Add(steer, avoidVec);
            count++;
            break; //Break when we hit a face
          }
        }
      }
    }
    if (count > 0)
    {
      steer = Vector3d.Divide(steer, count);
    }

    return steer;
  }

  public class AgentType {
    public Point3d Position, RefPosition;
    public Vector3d Velocity;
    public double BodySize;
    public AgentType(Point3d position, Vector3d velocity, double bodySize) {
      this.Position = this.RefPosition = position;
      this.Velocity = velocity;
      this.BodySize = bodySize;
    }
  }

  class Vector
  {
    private Vector() { }

    public static double RadToDeg(double rad)
    {
      return rad * (180 / Math.PI);
    }

    public static double DotProduct(Vector3d a, Vector3d b)
    {
      return a.Length * b.Length * Math.Cos(Vector3d.VectorAngle(a, b));
    }

    public static Vector3d Reflect(Vector3d to, Vector3d about)
    {
      return Vector3d.Subtract(to, Vector3d.Multiply(2 * DotProduct(to, about), about));
    }

    public static void GetProjectionComponents(Vector3d of, Vector3d to, out Vector3d parVec, out Vector3d perpVec)
    {
      double scalar = DotProduct(of, to) / (to.Length * to.Length);
      parVec = Vector3d.Multiply(to, scalar);
      perpVec = Vector3d.Subtract(of, parVec);
    }

    public static double LengthSq(Vector3d vec)
    {
      return Math.Pow(vec.X, 2) + Math.Pow(vec.Y, 2) + Math.Pow(vec.Z, 2);
    }

    public static Vector3d Limit(Vector3d vec, double max)
    {
      if (LengthSq(vec) > max * max)
      {
        vec.Unitize();
        vec = Vector3d.Multiply(vec, max);
      }
      return vec;
    }

    public static double CalcAngle(Vector3d vec1, Vector3d vec2, Plane pl)
    {
      double angle = Vector3d.VectorAngle(vec1, vec2, pl);
      angle = RadToDeg(angle);
      if (angle > 180) angle = 360 - angle;
      return angle;
    }
  }
# ---------- end c_script ----------
c_script_2 = CSharpScript(environment=brep_2, P=pt_2, V=vec2pt.Vector, S=number_slider_3)  # -> out, A, B, C, D, E, F, AA; inputs environment: Brep, P: Point3d, V: Vector3d, S: Double
# ---------- c_script_2: C# ----------
    this.environment = environment;
    Curve[] borderCrvs = GetNakedEdges();
    A = borderCrvs.ToList();

    int n = borderCrvs.Length;

    Point3d[][] edgePtsArray = new Point3d[n][];
    for(int i = 0; i < n; i++) {
      edgePtsArray[i] = DivByAngle(borderCrvs[i], 1.0).ToArray();
    }

    B = ptArray2dToDatatree(edgePtsArray);

    Vector3d[][] normalsArray = new Vector3d[n][];
    for(int i = 0; i < n; i++) {
      normalsArray[i] = GetBrepNormals(edgePtsArray[i]).ToArray();
    }

    C = vecArray2dToDatatree(normalsArray);

    double borderSize = environment.GetBoundingBox(Plane.WorldXY).Diagonal.Length / 10;

    borderWallsArray = new Brep[n][];
    for(int i = 0; i < n; i++) {
      borderWallsArray[i] = GetBorderWalls(borderCrvs[i], edgePtsArray[i], normalsArray[i], borderSize);
    }

    D = brepArray2dToDatatree(borderWallsArray);

    AgentType agent = new AgentType(P, V, S);

    Vector3d velocity = agent.Velocity;
    Point3d position = agent.Position;

    double distance = 1.0;

    Vector3d steer = new Vector3d();
    Vector3d avoidVec, parVec;
    double tol = 0.01;
    Curve[] overlapCrvs;
    Point3d[] intersectPts;

    Curve[] feelers = GetFeelerCrvs(agent, distance, true);

    E = feelers.ToList();
    List<Vector3d> borderNormals = new List<Vector3d>();

    int count = 0;
    foreach(Brep[] borderWalls in borderWallsArray)
    {
      foreach (Brep brep in borderWalls)
      {
        foreach (Curve feeler in feelers)
        {
          //Check feeler intersection with each brep face
          foreach (BrepFace face in brep.Faces)
          {
            Rhino.Geometry.Intersect.Intersection.CurveBrepFace(feeler, face, tol, out overlapCrvs, out intersectPts);
            if (intersectPts.Length > 0)
            {
              Point3d testPt = feeler.PointAtEnd;
              double u, v;
              face.ClosestPoint(testPt, out u, out v);
              Vector3d normal = face.NormalAt(u, v);
              normal.Reverse();
              Vector.GetProjectionComponents(normal, velocity, out parVec, out avoidVec);
              avoidVec.Unitize();
              //weight by distance
              if (!position.DistanceTo(intersectPts[0]).Equals(0))
              {
                avoidVec = Vector3d.Divide(avoidVec, position.DistanceTo(intersectPts[0]));
              }
              steer = Vector3d.Add(steer, avoidVec);
              count++;
              break; //Break when we hit a face
            }
          }
        }
      }
    }
    if (count > 0)
    {
      steer = Vector3d.Divide(steer, count);
    }
    F = steer;
# ---------- c_script_2: C# additional code ----------
  public DataTree<Point3d> ptArray2dToDatatree(Point3d[][] array) {
    DataTree<Point3d> tree = new DataTree<Point3d>();
    GH_Path trunk = new GH_Path();
    GH_Path branch = new GH_Path();

    for(int i = 0; i < array.Length; i++) {
      branch = trunk.AppendElement(i);

      // ...with 4 items each
      for(int j = 0; j < array[i].Length; j++) {
        tree.Add(array[i][j], branch);
      }
    }
    return tree;
  }

  public DataTree<Vector3d> vecArray2dToDatatree(Vector3d[][] array) {
    DataTree<Vector3d> tree = new DataTree<Vector3d>();
    GH_Path trunk = new GH_Path();
    GH_Path branch = new GH_Path();

    for(int i = 0; i < array.Length; i++) {
      branch = trunk.AppendElement(i);

      // ...with 4 items each
      for(int j = 0; j < array[i].Length; j++) {
        tree.Add(array[i][j], branch);
      }
    }
    return tree;
  }

  public DataTree<Brep> brepArray2dToDatatree(Brep[][] array) {
    DataTree<Brep> tree = new DataTree<Brep>();
    GH_Path trunk = new GH_Path();
    GH_Path branch = new GH_Path();

    for(int i = 0; i < array.Length; i++) {
      branch = trunk.AppendElement(i);

      // ...with 4 items each
      for(int j = 0; j < array[i].Length; j++) {
        tree.Add(array[i][j], branch);
      }
    }
    return tree;
  }

  public Brep environment;
  public Brep[][] borderWallsArray;
  private Curve[] GetNakedEdges()
  {
    List<Curve> nakedEdges = new List<Curve>();
    foreach (BrepEdge edge in environment.Edges)
    {
      // Find only the naked edges
      if (edge.Valence == EdgeAdjacency.Naked)
      {
        Curve crv = edge.DuplicateCurve();
        if (null != crv)
          nakedEdges.Add(crv);
      }
    }
    RhinoDoc doc = RhinoDoc.ActiveDoc;
    double tol = 2.1 * doc.ModelAbsoluteTolerance;

    return Curve.JoinCurves(nakedEdges, tol);
  }

    /**
     * divideCrvsByDeltaTan : Curve[] * double -> LinkedList<Plane>
     * REQUIRES: theta > 0
     * ENSURES: divideCrvsByDeltaTan(crvs, theta) returns a linked list of planes
     *          along the curves s.t. there is a plane at every point along
     *          the curve where the change in the tangent vector between
     *          two points is greater than theta.
    **/
  private IEnumerable<Point3d> DivByAngle(Curve crv, double angle)
  {

    //initialize parameters
    double theta = angle;
    const double stepSize = 0.5;

    //initialize list
    List<Point3d> pts = new List<Point3d>();

    Continuity c = Continuity.C1_continuous;
    //initialize data
    Interval dom = crv.Domain;
    double rover = dom.Min; //steps along the curve by stepSize

    //Add plane at start point of curve to list
    Point3d pt = crv.PointAt(rover);
    pts.Add(pt);

    //Increment
    Vector3d prevTan = crv.TangentAt(rover);
    double oldRover = rover; //stores the previous rover for comparison
    rover += stepSize;

    while (rover < dom.Max)
    {
      Vector3d currTan = crv.TangentAt(rover);
      //If there is a discontinuity between the oldRover and rover
      //then place a point at the discontinuity and update prevTan.
      double discontinuity;
      bool isDisc = crv.GetNextDiscontinuity(c, oldRover, rover,
        out discontinuity);
      if (isDisc)
      {
        pt = crv.PointAt(discontinuity);
        pts.Add(pt);
        prevTan = crv.TangentAt(discontinuity);
      }

      //If the change in tangent vector is greater than theta,
      //then drop a target at the rover and update prevTan.
      double delta = RhinoMath.ToDegrees(Math.Abs(Vector3d.VectorAngle(prevTan, currTan)));
      if (delta > theta)
      {
        pt = crv.PointAt(rover);
        pts.Add(pt);
        prevTan = currTan;
      }
      //Increment
      oldRover = rover;
      rover += stepSize;
    }

    //Add target at end point of curve
    pt = crv.PointAt(dom.Max);
    pts.Add(pt);
    return pts;
  }

  private IEnumerable<Vector3d> GetBrepNormals(IEnumerable<Point3d> pts)
  {
    //Initialize variables
    List<Surface> brepSrfs = new List<Surface>();
    List<Vector3d> normals = new List<Vector3d>();
    const double epsilon = 0.0001; //The minimum distance to determine which surface a pt is touching.

    //Explode brep
    Rhino.Geometry.Collections.BrepFaceList brepFaces = environment.Faces;
    foreach(BrepFace face in brepFaces)
    {
      Surface srf = face.ToBrep().Surfaces[0];
      if(face.OrientationIsReversed)
      {
        brepSrfs.Add(srf.Reverse(0));
      }
      else {
        brepSrfs.Add(srf);
      }
    }

      /*
      for each point, get the closest point to each surface
      */
    foreach(Point3d pt in pts) {
      List<Plane> framesTemp = new List<Plane>();
      foreach(Surface srf in brepSrfs) {
        double u;
        double v;
        srf.ClosestPoint(pt, out u, out v);
        Plane frame;
        srf.FrameAt(u, v, out frame);
        if(pt.DistanceTo(frame.Origin) <= epsilon) {
          framesTemp.Add(frame);
        }
      }
        /*
        if there is 1 close surface:
          add the two normal vectors together to get the bisector
        */
      Vector3d brepNormal = framesTemp[0].Normal;
        /*
        if there are 2 equally close surfaces:
          add the two normal vectors together to get the bisector
        */
      if(framesTemp.Count > 1) {
        for(int j = 1; j < framesTemp.Count; j++) {
          Plane pln = framesTemp[j];
          brepNormal = Vector3d.Add(brepNormal, pln.Normal);
        }
      }

      brepNormal.Unitize();

      normals.Add(brepNormal);
    }
    return normals;
  }

  private Brep[] GetBorderWalls(Curve borderCrv, IEnumerable<Point3d> pts, IEnumerable<Vector3d> nrmls, double dist)
  {
    List<Point3d> ptsOut = new List<Point3d>();
    List<Point3d> ptsIn = new List<Point3d>();
    IEnumerator ptEnum = pts.GetEnumerator();
    IEnumerator nrmlEnum = nrmls.GetEnumerator();
    while ((ptEnum.MoveNext()) && (nrmlEnum.MoveNext()))
    {
      Point3d pt = (Point3d) ptEnum.Current;
      Vector3d nrml = (Vector3d) nrmlEnum.Current;
      Transform mvOut = Transform.Translation(nrml * dist);
      Transform mvIn = Transform.Translation(nrml * -dist);
      Point3d ptOut = new Point3d(pt);
      Point3d ptIn = new Point3d(pt);
      ptOut.Transform(mvOut);
      ptIn.Transform(mvIn);
      ptsOut.Add(ptOut);
      ptsIn.Add(ptIn);
    }

    Curve crvOut;
    Curve crvIn;

    if(borderCrv.IsPolyline()) {
      crvOut = new PolylineCurve(ptsOut);
      crvIn = new PolylineCurve(ptsIn);
    }
    else {
      crvOut = Curve.CreateInterpolatedCurve(ptsOut, 3);
      crvIn = Curve.CreateInterpolatedCurve(ptsIn, 3);
    }
    List<Curve> crvs = new List<Curve>();
    crvs.Add(crvOut);
    crvs.Add(crvIn);
    Brep[] lofts = Brep.CreateFromLoft(crvs, Point3d.Unset, Point3d.Unset, LoftType.Normal, false);

    double minSoFar = Double.MaxValue;
    Interval interval = new Interval(0, 1);
    Point3d loftPt = lofts[0].Faces[0].PointAt(0, 0);
    BrepFace testFace = environment.Faces[0];
    Point3d facePt = testFace.PointAt(0.25, 0.25);
    foreach(BrepFace face in environment.Faces) {
      double u, v;
      face.ClosestPoint(loftPt, out u, out v);
      facePt = face.PointAt(u, v);
      dist = loftPt.DistanceTo(facePt);
      if(dist < minSoFar) {
        minSoFar = dist;
        testFace = face;
      }
    }

    Vector3d loftNrml = lofts[0].Faces[0].NormalAt(0, 0);
    testFace.SetDomain(0, interval);
    testFace.SetDomain(1, interval);
    facePt = testFace.PointAt(0.5, 0.5);
    Vector3d testVec = Vector3d.Subtract(new Vector3d(facePt), new Vector3d(loftPt));
    double dotProd = Vector3d.Multiply(loftNrml, testVec) / (loftNrml.Length * testVec.Length);
    if(dotProd >= 0) {
      foreach(Brep brep in lofts) {
        brep.Flip();
      }
    }
    return lofts;
  }

  private static Curve GetFeelerCrv(Vector3d feelerVec, Point3d position,
    double bodySize, double visionAngle,
    Vector3d rotAxis)
  {
    feelerVec.Rotate(visionAngle, rotAxis);
    feelerVec = Vector3d.Multiply(feelerVec, bodySize);
    return new Line(position, feelerVec).ToNurbsCurve();
  }

  private static Curve[] GetFeelerCrvs(AgentType agent, double visionDistance,
    bool accurate)
  {
    Curve[] feelers;
    if (accurate)
    {
      feelers = new Curve[5];
    }
    else
    {
      feelers = new Curve[1];
    }

    double feelerAngle = Math.PI / 2;
    //Calculate straight ahead feeler with length visionDistance
    Vector3d feelerVec = agent.Velocity;
    feelerVec.Unitize();
    feelerVec = Vector3d.Multiply(feelerVec, visionDistance);
    feelers[0] = new Line(agent.Position, feelerVec).ToNurbsCurve();

    if (!accurate)
    {
      return feelers;
    }

    //Calculate tertiary feelers with length bodySize
    feelerVec = agent.Velocity;
    feelerVec.Unitize();
    Plane rotPln = new Plane(agent.Position, agent.Velocity);
    Vector3d rotAxis = rotPln.XAxis;
    feelers[1] = GetFeelerCrv(feelerVec, agent.RefPosition, agent.BodySize, feelerAngle, rotAxis);
    feelers[2] = GetFeelerCrv(feelerVec, agent.RefPosition, agent.BodySize, -feelerAngle, rotAxis);
    rotAxis = rotPln.YAxis;
    feelers[3] = GetFeelerCrv(feelerVec, agent.RefPosition, agent.BodySize, feelerAngle, rotAxis);
    feelers[4] = GetFeelerCrv(feelerVec, agent.RefPosition, agent.BodySize, -feelerAngle, rotAxis);

    return feelers;
  }

  public class AgentType {
    public Point3d Position, RefPosition;
    public Vector3d Velocity;
    public double BodySize;
    public AgentType(Point3d position, Vector3d velocity, double bodySize) {
      this.Position = this.RefPosition = position;
      this.Velocity = velocity;
      this.BodySize = bodySize;
    }
  }

  class Vector
  {
    private Vector() { }

    public static double RadToDeg(double rad)
    {
      return rad * (180 / Math.PI);
    }

    public static double DotProduct(Vector3d a, Vector3d b)
    {
      return a.Length * b.Length * Math.Cos(Vector3d.VectorAngle(a, b));
    }

    public static Vector3d Reflect(Vector3d to, Vector3d about)
    {
      return Vector3d.Subtract(to, Vector3d.Multiply(2 * DotProduct(to, about), about));
    }

    public static void GetProjectionComponents(Vector3d of, Vector3d to, out Vector3d parVec, out Vector3d perpVec)
    {
      double scalar = DotProduct(of, to) / (to.Length * to.Length);
      parVec = Vector3d.Multiply(to, scalar);
      perpVec = Vector3d.Subtract(of, parVec);
    }

    public static double LengthSq(Vector3d vec)
    {
      return Math.Pow(vec.X, 2) + Math.Pow(vec.Y, 2) + Math.Pow(vec.Z, 2);
    }

    public static Vector3d Limit(Vector3d vec, double max)
    {
      if (LengthSq(vec) > max * max)
      {
        vec.Unitize();
        vec = Vector3d.Multiply(vec, max);
      }
      return vec;
    }

    public static double CalcAngle(Vector3d vec1, Vector3d vec2, Plane pl)
    {
      double angle = Vector3d.VectorAngle(vec1, vec2, pl);
      angle = RadToDeg(angle);
      if (angle > 180) angle = 360 - angle;
      return angle;
    }
  }
# ---------- end c_script_2 ----------
# SYSTEM
# Creates a system of Agents that the engine will be able to run.
system = System(Agents=agent, Emitters=ptemit, Environment=polysrfenv.Environment)
getbrepnormals = CSharpScript(environment=brep_2, P=pt_2, V=vec2pt.Vector, S=number_slider_3)  # -> out, A, B, C, D, E, F, AA; inputs environment: Brep, P: Point3d, V: Vector3d, S: Double
# ---------- getbrepnormals: C# ----------
    this.environment = environment;
    Curve[] borderCrvs = GetNakedEdges();
    A = borderCrvs.ToList();

    int n = borderCrvs.Length;

    Point3d[][] edgePtsArray = new Point3d[n][];
    for(int i = 0; i < n; i++) {
      edgePtsArray[i] = DivByAngle(borderCrvs[i], 1.0).ToArray();
    }

    B = ptArray2dToDatatree(edgePtsArray);
    List<Plane> frames = new List<Plane>();
    Vector3d[][] normalsArray = new Vector3d[n][];
    for(int i = 0; i < n; i++) {
      Point3d[] pts = edgePtsArray[i];
      //Initialize variables
      List<Surface> brepSrfs = new List<Surface>();
      List<Vector3d> normals = new List<Vector3d>();
      const double epsilon = 0.0001; //The minimum distance to determine which surface a pt is touching.

      //Explode brep
      Rhino.Geometry.Collections.BrepFaceList brepFaces = environment.Faces;
      foreach(BrepFace face in brepFaces)
      {
        Surface srf = face.ToBrep().Surfaces[0];
        if(face.OrientationIsReversed)
        {
          brepSrfs.Add(srf.Reverse(0));
        }
        else {
          brepSrfs.Add(srf);
        }
      }

      /*
      for each point, get the closest point to each surface
      */
      foreach(Point3d pt in pts) {
        List<Plane> framesTemp = new List<Plane>();
        foreach(Surface srf in brepSrfs) {
          double u;
          double v;
          srf.ClosestPoint(pt, out u, out v);
          Plane frame;
          srf.FrameAt(u, v, out frame);
          if(pt.DistanceTo(frame.Origin) <= epsilon) {
            framesTemp.Add(frame);
            frames.Add(frame);
          }
        }
        /*
        if there is 1 close surface:
          add the two normal vectors together to get the bisector
        */
        Vector3d brepNormal = framesTemp[0].Normal;
        /*
        if there are 2 equally close surfaces:
          add the two normal vectors together to get the bisector
        */
        if(framesTemp.Count > 1) {
          for(int j = 1; j < framesTemp.Count; j++) {
            Plane pln = framesTemp[j];
            brepNormal = Vector3d.Add(brepNormal, pln.Normal);
          }
        }

        brepNormal.Unitize();

        normals.Add(brepNormal);
      }
      normalsArray[i] = normals.ToArray();
    }

    C = vecArray2dToDatatree(normalsArray);
    D = frames;
    /*
    double borderSize = environment.GetBoundingBox(Plane.WorldXY).Diagonal.Length / 10;

    borderWallsArray = new Brep[n][];
    for(int i = 0; i < n; i++) {
      borderWallsArray[i] = GetBorderWalls(borderCrvs[i], edgePtsArray[i], normalsArray[i], borderSize);
    }

    D = brepArray2dToDatatree(borderWallsArray);

    AgentType agent = new AgentType(P, V, S);

    Vector3d velocity = agent.Velocity;
    Point3d position = agent.Position;

    double distance = 1.0;

    Vector3d steer = new Vector3d();
    Vector3d avoidVec, parVec;
    double tol = 0.01;
    Curve[] overlapCrvs;
    Point3d[] intersectPts;

    Curve[] feelers = GetFeelerCrvs(agent, distance, true);

    E = feelers.ToList();
    List<Vector3d> borderNormals = new List<Vector3d>();

    int count = 0;
    foreach(Brep[] borderWalls in borderWallsArray)
    {
      foreach (Brep brep in borderWalls)
      {
        foreach (Curve feeler in feelers)
        {
          //Check feeler intersection with each brep face
          foreach (BrepFace face in brep.Faces)
          {
            Rhino.Geometry.Intersect.Intersection.CurveBrepFace(feeler, face, tol, out overlapCrvs, out intersectPts);
            if (intersectPts.Length > 0)
            {
              Point3d testPt = feeler.PointAtEnd;
              double u, v;
              face.ClosestPoint(testPt, out u, out v);
              Vector3d normal = face.NormalAt(u, v);
              normal.Reverse();
              Vector.GetProjectionComponents(normal, velocity, out parVec, out avoidVec);
              avoidVec.Unitize();
              //weight by distance
              if (!position.DistanceTo(intersectPts[0]).Equals(0))
              {
                avoidVec = Vector3d.Divide(avoidVec, position.DistanceTo(intersectPts[0]));
              }
              steer = Vector3d.Add(steer, avoidVec);
              count++;
              break; //Break when we hit a face
            }
          }
        }
      }
    }
    if (count > 0)
    {
      steer = Vector3d.Divide(steer, count);
    }
    F = steer;
    */
# ---------- getbrepnormals: C# additional code ----------
  public DataTree<Point3d> ptArray2dToDatatree(Point3d[][] array) {
    DataTree<Point3d> tree = new DataTree<Point3d>();
    GH_Path trunk = new GH_Path();
    GH_Path branch = new GH_Path();

    for(int i = 0; i < array.Length; i++) {
      branch = trunk.AppendElement(i);

      // ...with 4 items each
      for(int j = 0; j < array[i].Length; j++) {
        tree.Add(array[i][j], branch);
      }
    }
    return tree;
  }

  public DataTree<Vector3d> vecArray2dToDatatree(Vector3d[][] array) {
    DataTree<Vector3d> tree = new DataTree<Vector3d>();
    GH_Path trunk = new GH_Path();
    GH_Path branch = new GH_Path();

    for(int i = 0; i < array.Length; i++) {
      branch = trunk.AppendElement(i);

      // ...with 4 items each
      for(int j = 0; j < array[i].Length; j++) {
        tree.Add(array[i][j], branch);
      }
    }
    return tree;
  }

  public DataTree<Brep> brepArray2dToDatatree(Brep[][] array) {
    DataTree<Brep> tree = new DataTree<Brep>();
    GH_Path trunk = new GH_Path();
    GH_Path branch = new GH_Path();

    for(int i = 0; i < array.Length; i++) {
      branch = trunk.AppendElement(i);

      // ...with 4 items each
      for(int j = 0; j < array[i].Length; j++) {
        tree.Add(array[i][j], branch);
      }
    }
    return tree;
  }

  public Brep environment;
  public Brep[][] borderWallsArray;
  private Curve[] GetNakedEdges()
  {
    List<Curve> nakedEdges = new List<Curve>();
    foreach (BrepEdge edge in environment.Edges)
    {
      // Find only the naked edges
      if (edge.Valence == EdgeAdjacency.Naked)
      {
        Curve crv = edge.DuplicateCurve();
        if (null != crv)
          nakedEdges.Add(crv);
      }
    }
    RhinoDoc doc = RhinoDoc.ActiveDoc;
    double tol = 2.1 * doc.ModelAbsoluteTolerance;

    return Curve.JoinCurves(nakedEdges, tol);
  }

    /**
     * divideCrvsByDeltaTan : Curve[] * double -> LinkedList<Plane>
     * REQUIRES: theta > 0
     * ENSURES: divideCrvsByDeltaTan(crvs, theta) returns a linked list of planes
     *          along the curves s.t. there is a plane at every point along
     *          the curve where the change in the tangent vector between
     *          two points is greater than theta.
    **/
  private IEnumerable<Point3d> DivByAngle(Curve crv, double angle)
  {

    //initialize parameters
    double theta = angle;
    const double stepSize = 0.5;

    //initialize list
    List<Point3d> pts = new List<Point3d>();

    Continuity c = Continuity.C1_continuous;
    //initialize data
    Interval dom = crv.Domain;
    double rover = dom.Min; //steps along the curve by stepSize

    //Add plane at start point of curve to list
    Point3d pt = crv.PointAt(rover);
    pts.Add(pt);

    //Increment
    Vector3d prevTan = crv.TangentAt(rover);
    double oldRover = rover; //stores the previous rover for comparison
    rover += stepSize;

    while (rover < dom.Max)
    {
      Vector3d currTan = crv.TangentAt(rover);
      //If there is a discontinuity between the oldRover and rover
      //then place a point at the discontinuity and update prevTan.
      double discontinuity;
      bool isDisc = crv.GetNextDiscontinuity(c, oldRover, rover,
        out discontinuity);
      if (isDisc)
      {
        pt = crv.PointAt(discontinuity);
        pts.Add(pt);
        prevTan = crv.TangentAt(discontinuity);
      }

      //If the change in tangent vector is greater than theta,
      //then drop a target at the rover and update prevTan.
      double delta = RhinoMath.ToDegrees(Math.Abs(Vector3d.VectorAngle(prevTan, currTan)));
      if (delta > theta)
      {
        pt = crv.PointAt(rover);
        pts.Add(pt);
        prevTan = currTan;
      }
      //Increment
      oldRover = rover;
      rover += stepSize;
    }

    //Add target at end point of curve
    pt = crv.PointAt(dom.Max);
    pts.Add(pt);
    return pts;
  }

  private IEnumerable<Vector3d> GetBrepNormals(IEnumerable<Point3d> pts)
  {
    //Initialize variables
    List<Surface> brepSrfs = new List<Surface>();
    List<Vector3d> normals = new List<Vector3d>();
    const double epsilon = 0.0001; //The minimum distance to determine which surface a pt is touching.

    //Explode brep
    Rhino.Geometry.Collections.BrepFaceList brepFaces = environment.Faces;
    foreach(BrepFace face in brepFaces)
    {
      Surface srf = face.ToBrep().Surfaces[0];
      if(face.OrientationIsReversed)
      {
        brepSrfs.Add(srf.Reverse(0));
      }
      else {
        brepSrfs.Add(srf);
      }
    }

      /*
      for each point, get the closest point to each surface
      */
    foreach(Point3d pt in pts) {
      List<Plane> framesTemp = new List<Plane>();
      foreach(Surface srf in brepSrfs) {
        double u;
        double v;
        srf.ClosestPoint(pt, out u, out v);
        Plane frame;
        srf.FrameAt(u, v, out frame);
        if(pt.DistanceTo(frame.Origin) <= epsilon) {
          framesTemp.Add(frame);
        }
      }
        /*
        if there is 1 close surface:
          add the two normal vectors together to get the bisector
        */
      Vector3d brepNormal = framesTemp[0].Normal;
        /*
        if there are 2 equally close surfaces:
          add the two normal vectors together to get the bisector
        */
      if(framesTemp.Count > 1) {
        foreach(Plane pln in framesTemp) {
          Vector3d plnNormal = pln.Normal;
          brepNormal = Vector3d.Add(brepNormal, pln.Normal);
        }
      }

      brepNormal.Unitize();

      normals.Add(brepNormal);
    }
    return normals;
  }

  private Brep[] GetBorderWalls(Curve borderCrv, IEnumerable<Point3d> pts, IEnumerable<Vector3d> nrmls, double dist)
  {
    List<Point3d> ptsOut = new List<Point3d>();
    List<Point3d> ptsIn = new List<Point3d>();
    IEnumerator ptEnum = pts.GetEnumerator();
    IEnumerator nrmlEnum = nrmls.GetEnumerator();
    while ((ptEnum.MoveNext()) && (nrmlEnum.MoveNext()))
    {
      Point3d pt = (Point3d) ptEnum.Current;
      Vector3d nrml = (Vector3d) nrmlEnum.Current;
      Transform mvOut = Transform.Translation(nrml * dist);
      Transform mvIn = Transform.Translation(nrml * -dist);
      Point3d ptOut = new Point3d(pt);
      Point3d ptIn = new Point3d(pt);
      ptOut.Transform(mvOut);
      ptIn.Transform(mvIn);
      ptsOut.Add(ptOut);
      ptsIn.Add(ptIn);
    }

    Curve crvOut;
    Curve crvIn;

    if(borderCrv.IsPolyline()) {
      crvOut = new PolylineCurve(ptsOut);
      crvIn = new PolylineCurve(ptsIn);
    }
    else {
      crvOut = Curve.CreateInterpolatedCurve(ptsOut, 3);
      crvIn = Curve.CreateInterpolatedCurve(ptsIn, 3);
    }
    List<Curve> crvs = new List<Curve>();
    crvs.Add(crvOut);
    crvs.Add(crvIn);
    Brep[] lofts = Brep.CreateFromLoft(crvs, Point3d.Unset, Point3d.Unset, LoftType.Normal, false);

    double minSoFar = Double.MaxValue;
    Interval interval = new Interval(0, 1);
    Point3d loftPt = lofts[0].Faces[0].PointAt(0, 0);
    BrepFace testFace = environment.Faces[0];
    Point3d facePt = testFace.PointAt(0.25, 0.25);
    foreach(BrepFace face in environment.Faces) {
      double u, v;
      face.ClosestPoint(loftPt, out u, out v);
      facePt = face.PointAt(u, v);
      dist = loftPt.DistanceTo(facePt);
      if(dist < minSoFar) {
        minSoFar = dist;
        testFace = face;
      }
    }

    Vector3d loftNrml = lofts[0].Faces[0].NormalAt(0, 0);
    testFace.SetDomain(0, interval);
    testFace.SetDomain(1, interval);
    facePt = testFace.PointAt(0.5, 0.5);
    Vector3d testVec = Vector3d.Subtract(new Vector3d(facePt), new Vector3d(loftPt));
    double dotProd = Vector3d.Multiply(loftNrml, testVec) / (loftNrml.Length * testVec.Length);
    if(dotProd >= 0) {
      foreach(Brep brep in lofts) {
        brep.Flip();
      }
    }
    return lofts;
  }

  private static Curve GetFeelerCrv(Vector3d feelerVec, Point3d position,
    double bodySize, double visionAngle,
    Vector3d rotAxis)
  {
    feelerVec.Rotate(visionAngle, rotAxis);
    feelerVec = Vector3d.Multiply(feelerVec, bodySize);
    return new Line(position, feelerVec).ToNurbsCurve();
  }

  private static Curve[] GetFeelerCrvs(AgentType agent, double visionDistance,
    bool accurate)
  {
    Curve[] feelers;
    if (accurate)
    {
      feelers = new Curve[5];
    }
    else
    {
      feelers = new Curve[1];
    }

    double feelerAngle = Math.PI / 2;
    //Calculate straight ahead feeler with length visionDistance
    Vector3d feelerVec = agent.Velocity;
    feelerVec.Unitize();
    feelerVec = Vector3d.Multiply(feelerVec, visionDistance);
    feelers[0] = new Line(agent.Position, feelerVec).ToNurbsCurve();

    if (!accurate)
    {
      return feelers;
    }

    //Calculate tertiary feelers with length bodySize
    feelerVec = agent.Velocity;
    feelerVec.Unitize();
    Plane rotPln = new Plane(agent.Position, agent.Velocity);
    Vector3d rotAxis = rotPln.XAxis;
    feelers[1] = GetFeelerCrv(feelerVec, agent.RefPosition, agent.BodySize, feelerAngle, rotAxis);
    feelers[2] = GetFeelerCrv(feelerVec, agent.RefPosition, agent.BodySize, -feelerAngle, rotAxis);
    rotAxis = rotPln.YAxis;
    feelers[3] = GetFeelerCrv(feelerVec, agent.RefPosition, agent.BodySize, feelerAngle, rotAxis);
    feelers[4] = GetFeelerCrv(feelerVec, agent.RefPosition, agent.BodySize, -feelerAngle, rotAxis);

    return feelers;
  }

  public class AgentType {
    public Point3d Position, RefPosition;
    public Vector3d Velocity;
    public double BodySize;
    public AgentType(Point3d position, Vector3d velocity, double bodySize) {
      this.Position = this.RefPosition = position;
      this.Velocity = velocity;
      this.BodySize = bodySize;
    }
  }

  class Vector
  {
    private Vector() { }

    public static double RadToDeg(double rad)
    {
      return rad * (180 / Math.PI);
    }

    public static double DotProduct(Vector3d a, Vector3d b)
    {
      return a.Length * b.Length * Math.Cos(Vector3d.VectorAngle(a, b));
    }

    public static Vector3d Reflect(Vector3d to, Vector3d about)
    {
      return Vector3d.Subtract(to, Vector3d.Multiply(2 * DotProduct(to, about), about));
    }

    public static void GetProjectionComponents(Vector3d of, Vector3d to, out Vector3d parVec, out Vector3d perpVec)
    {
      double scalar = DotProduct(of, to) / (to.Length * to.Length);
      parVec = Vector3d.Multiply(to, scalar);
      perpVec = Vector3d.Subtract(of, parVec);
    }

    public static double LengthSq(Vector3d vec)
    {
      return Math.Pow(vec.X, 2) + Math.Pow(vec.Y, 2) + Math.Pow(vec.Z, 2);
    }

    public static Vector3d Limit(Vector3d vec, double max)
    {
      if (LengthSq(vec) > max * max)
      {
        vec.Unitize();
        vec = Vector3d.Multiply(vec, max);
      }
      return vec;
    }

    public static double CalcAngle(Vector3d vec1, Vector3d vec2, Plane pl)
    {
      double angle = Vector3d.VectorAngle(vec1, vec2, pl);
      angle = RadToDeg(angle);
      if (angle > 180) angle = 360 - angle;
      return angle;
    }
  }
# ---------- end getbrepnormals ----------
Z_3 = UnitZ(Factor=1)
vec = Vector(c_script.F)
brep_7 = Brep(c_script.D)
crv = Curve(c_script.A)
crv_2 = Curve(c_script.E)
vec_2 = Vector(c_script.C)
pt_4 = Point(c_script.B)
crv_3 = Curve(c_script_2.A)
pt_5 = Point(c_script_2.B)
# Pause the simlation by double-clicking the Timer.
timer = Timer(TimerInterval=20, Target=[engine, system])
# Reset the simulation by double-clicking the reset switch.
toggle_2 = BooleanToggle(False)
avr = Average(Input=vec_2)
# DECONSTRUCT SYSTEM
# Exposes the list of Agents, A, and the AgentCollection, AC, which is a spatial data structure that allows for the fast lookup of neighbors.
# The Agent's vision radius for separation here has a stable ratio to the cohesion vision radius so that a stable behavior is formed
division = Division(A=agent_cohesion_vision_radius, B=agent_vision_radius_multiplier)
deplane = DeconstructPlane(Plane=getbrepnormals.D)  # -> Origin, XAxis, YAxis, ZAxis
deconstructsystem = DeconstructSystem(System=system)  # -> Agents, AgentCollection
item = ListItem(List=deplane.ZAxis, Index=0, Wrap=True)
vdis = VectorDisplay(Anchor=pt_4, Vector=vec_2)
c_script_3 = CSharpScript(avgNrml=avr, axisVec=Z_3)  # -> out, A; inputs avgNrml: Vector3d, axisVec: Vector3d
# ---------- c_script_3: C# ----------
    avgNrml.Unitize();
    axisVec.Unitize();
    double dotProd = DotProduct(avgNrml, axisVec);
    A = dotProd;
# ---------- c_script_3: C# additional code ----------
  public double DotProduct(Vector3d a, Vector3d b) {
    return Vector3d.Multiply(a, b) / (a.Length * b.Length);
  }
# ---------- end c_script_3 ----------
panel = Panel(c_script_3.A)
vdis_2 = VectorDisplay(Anchor=getbrepnormals.B, Vector=getbrepnormals.C)
vdis_3 = VectorDisplay(Anchor=pt_5, Vector=c_script_2.C)
vdis_4 = VectorDisplay(Anchor=pt_2, Vector=c_script_2.F)
item_2 = ListItem(List=deplane.ZAxis, Index=Slider(1, range=0..1), Wrap=True)
vdis_5 = VectorDisplay(Anchor=pt_4, Vector=avr)
vdis_6 = VectorDisplay(Anchor=pt_2, Vector=vec)
vdis_7 = VectorDisplay(Anchor=deplane.Origin, Vector=deplane.ZAxis)
item_3 = ListItem(List=deplane.Origin, Index=0, Wrap=True)
addition = Addition(A=item, B=item_2)
ma = MassAddition(Input=deplane.ZAxis)  # -> Result, PartialResults
# Finds all agents 5 units away
bouncecontain = BounceContainBehavior(Agent=deconstructsystem.Agents, Apply=True, Environment=polysrfenv.Environment)
engine = Engine(Reset=toggle_2, System=system)
vdis_8 = VectorDisplay(Anchor=item_3, Vector=addition)
getborderwalls = CSharpScript(environment=brep_2, borderCrv=crv, pts=c_script.B, nrmls=c_script.C)  # -> out, A, B, C, D, E, F, AA, AB, AC; inputs environment: Brep, borderCrv: Curve, pts: list of Point3d, nrmls: list of Vector3d
# ---------- getborderwalls: C# ----------
    double dist = 1.5;

    List<Point3d> ptsOut = new List<Point3d>();
    List<Point3d> ptsIn = new List<Point3d>();
    IEnumerator ptEnum = pts.GetEnumerator();
    IEnumerator nrmlEnum = nrmls.GetEnumerator();
    while ((ptEnum.MoveNext()) && (nrmlEnum.MoveNext()))
    {
      Point3d pt = (Point3d) ptEnum.Current;
      Vector3d nrml = (Vector3d) nrmlEnum.Current;
      Transform mvOut = Transform.Translation(nrml * dist);
      Transform mvIn = Transform.Translation(nrml * -dist);
      Point3d ptOut = new Point3d(pt);
      Point3d ptIn = new Point3d(pt);
      ptOut.Transform(mvOut);
      ptIn.Transform(mvIn);
      ptsOut.Add(ptOut);
      ptsIn.Add(ptIn);
    }

    Curve crvOut;
    Curve crvIn;

    if(borderCrv.IsPolyline()) {
      crvOut = new PolylineCurve(ptsOut);
      crvIn = new PolylineCurve(ptsIn);
    }
    else {
      crvOut = Curve.CreateInterpolatedCurve(ptsOut, 3);
      crvIn = Curve.CreateInterpolatedCurve(ptsIn, 3);
    }
    List<Curve> crvs = new List<Curve>();
    crvs.Add(crvOut);
    crvs.Add(crvIn);
    Brep[] lofts = Brep.CreateFromLoft(crvs, Point3d.Unset, Point3d.Unset, LoftType.Normal, false);

    double minSoFar = Double.MaxValue;
    Interval interval = new Interval(0, 1);
    Point3d loftPt = lofts[0].Faces[0].PointAt(0, 0);
    BrepFace testFace = environment.Faces[0];
    Point3d facePt = testFace.PointAt(0.25, 0.25);
    foreach(BrepFace face in environment.Faces) {
      double u, v;
      face.ClosestPoint(loftPt, out u, out v);
      facePt = face.PointAt(u, v);
      dist = loftPt.DistanceTo(facePt);
      if(dist < minSoFar) {
        minSoFar = dist;
        testFace = face;
      }
    }
    AA = testFace.ToBrep();
    AB = testFace.DuplicateFace(false);

    Vector3d loftNrml = lofts[0].Faces[0].NormalAt(0, 0);
    B = loftPt;
    C = loftNrml;
    testFace.SetDomain(0, interval);
    testFace.SetDomain(1, interval);
    facePt = testFace.PointAt(0.5, 0.5);
    Vector3d testVec = Vector3d.Subtract(new Vector3d(facePt), new Vector3d(loftPt));
    D = loftPt;
    E = testVec;
    double dotProd = Vector3d.Multiply(loftNrml, testVec) / (loftNrml.Length * testVec.Length);
    F = dotProd;
    if(dotProd >= 0) {
      foreach(Brep brep in lofts) {
        brep.Flip();
      }
    }
    A = lofts.ToList();
# ---------- end getborderwalls ----------
contain = ContainForce(Agent=deconstructsystem.Agents, Apply=True, WeightMultiplier=1, Environment=polysrfenv.Environment, VisionRadius=1)
neighbors = GetNeighborsInRadius(
    Agent=deconstructsystem.Agents,
    AgentCollection=deconstructsystem.AgentCollection,
    VisionRadius=agent_cohesion_vision_radius,
    VisionAngle=360)
panel_2 = Panel(getborderwalls.F)
brep_8 = Brep(getborderwalls.A)
vdis_9 = VectorDisplay(Anchor=getborderwalls.B, Vector=getborderwalls.C)
vdis_10 = VectorDisplay(Anchor=getborderwalls.D, Vector=getborderwalls.E)
brep_9 = Brep(getborderwalls.AB)
srf = Surface(getborderwalls.AA)
deconstructagent = DeconstructAgent(Agent=deconstructsystem.Agents)  # -> Position, graft(Velocity), Acceleration, Lifespan, ReferencePosition
# DECONSTRUCT AGENT:
# Exposes the Agents' Position and other fields so you can see them.
pt_6 = Point(deconstructagent.ReferencePosition)
pt_7 = Point(deconstructagent.Position)
item_4 = ListItem(List=pt_7, Index=0, Wrap=True)  # -> flatten(Item)
vdis_11 = VectorDisplay(Anchor=item_4, Vector=contain)
# Looks at all agents within 5 units away and finds the ones within 5/3 units away - this makes the runtime faster
neighbors_2 = GetNeighborsInRadius(Agent=deconstructsystem.Agents, AgentCollection=neighbors, VisionRadius=division, VisionAngle=360)
intcrv = Interpolate(Vertices=deconstructagent.Position, Degree=3, Periodic=False, KnotStyle=1)  # -> Curve, Length, Domain
vdis_12 = VectorDisplay(Anchor=pt_7, Vector=deconstructagent.Velocity)
# COHESE AND SEPARATE:
# A takes in agent. This will look at each individual agent in the system.
# AC takes in output from neighbors component to get all of the neighbors within the vision radius.
# W is the strength of the force. Default to 1.
separate = SeparateForce(Agent=deconstructsystem.Agents, Apply=True, WeightMultiplier=1, GetNeighborsInRadius=neighbors_2)
cohese = CoheseForce(Agent=deconstructsystem.Agents, Apply=True, WeightMultiplier=1, GetNeighborsInRadius=neighbors)  # disabled
item_5 = ListItem(List=deconstructagent.Position, Index=0, Wrap=True)
# You can preview the force vectors from each force component by using the vector preview component.
vdis_13 = VectorDisplay(Anchor=flatten(item_5), Vector=separate)
