# Grasshopper definition refactorTest_20150322.gh (Grasshopper 0.9.75)
# plug-ins: Agent

number_slider = Slider(100, range=0..100)
pt = Point(<point referenced from the Rhino model>)
box = CenterBox(Base=PlaneXY(0, 0, 0), X=1, Y=1, Z=1)
crv = Curve(<curve referenced from the Rhino model>)
agent = ConstructAgent(Lifespan=number_slider, Mass=1, BodySize=1, MaxSpeed=0.5, MaxForce=0.1, HistoryLength=1)
ptemit = PointEmitter(ContinuousFlow=True, CreationRate=1, NumberOfAgents=number_slider, Point=pt)
boxemit = BoxEmitter(ContinuousFlow=True, CreationRate=1, NumberOfAgents=0, Box=box)
crvemit = CurveEmitter(ContinuousFlow=True, CreationRate=1, NumberOfAgents=0, Curve=crv)
system = System(Agents=agent, Emitters=boxemit)
deconstructsystem = DeconstructSystem(System=system)  # -> Agents, AgentCollection
timer = Timer(TimerInterval=20, Target=[engine, system])  # disabled
deconstructagent = DeconstructAgent(Agent=deconstructsystem.Agents)  # -> Position, Velocity, Acceleration, Lifespan, ReferencePosition
engine = Engine(Reset=Toggle(True), System=system)
