# Grasshopper definition restrictTest.gh (Grasshopper 0.9.75)
# plug-ins: Agent

crv = Curve([<curve referenced from the Rhino model> x2])
number_slider = Slider(100, range=0..100)

# ----
# POINT EMITTER
# Point from which to emit agents.
# If continuous flow, Agents will be consistently emitted. Limit the number of agnets allowed at once with the Number of Agents setting.
toggle = BooleanToggle(True)
agent_vision_radius_multiplier = Slider(3, range=0..10)
agent_cohesion_vision_radius = Slider(5, range=0..10)

loft = Loft(Curves=crv, Options={Adjust=False, Closed=False, LoftEnds=0, LoftSimp=0, LoftType=0, Rebuild=10, Refit=0.01})
pt = Point(<point referenced from the Rhino model>)
srfenv = SurfaceEnvironment(Surface=loft)
# CONSTRUCT AGENT
# Agent Settings:
# Initializes agents with these settings. The settings cannot change once the agent has been emitted. If there is just 1 Agent output from A, all the agents will have that setting. If you would like a diversity of agent settings for each agent, feed in a list of values into the settings you would like to be different.
agent = ConstructAgent(
    Lifespan=Slider(100, range=0..100),
    Mass=1,
    BodySize=1,
    MaxSpeed=Slider(0.5, range=0..1),
    MaxForce=Slider(0.1, range=0..1),
    HistoryLength=Slider(5, range=0..10))
ptemit = PointEmitter(Point=pt, ContinuousFlow=toggle, CreationRate=1, NumberOfAgents=Slider(100, range=0..100))
# SYSTEM
# Creates a system of Agents that the engine will be able to run.
system = System(Agents=agent, Emitters=ptemit, Environment=srfenv)
# Pause the simlation by double-clicking the Timer.
timer = Timer(TimerInterval=20, Target=[engine, system])
# Reset the simulation by double-clicking the reset switch.
toggle_2 = BooleanToggle(False)
# DECONSTRUCT SYSTEM
# Exposes the list of Agents, A, and the AgentCollection, AC, which is a spatial data structure that allows for the fast lookup of neighbors.
# The Agent's vision radius for separation here has a stable ratio to the cohesion vision radius so that a stable behavior is formed
division = Division(A=agent_cohesion_vision_radius, B=agent_vision_radius_multiplier)
deconstructsystem = DeconstructSystem(System=system)  # -> Agents, AgentCollection
crv_2 = Curve(<curve referenced from the Rhino model>)
engine = Engine(Reset=toggle_2, System=system)
# Finds all agents 5 units away
neighbors = GetNeighborsInRadius(
    Agent=deconstructsystem.Agents,
    AgentCollection=deconstructsystem.AgentCollection,
    VisionRadius=agent_cohesion_vision_radius,
    VisionAngle=360)
followpath = FollowPathForce(
    Agent=deconstructsystem.Agents,
    WeightMultiplier=Slider(0.339, range=0..1),
    Curve=crv_2,
    PathRadius=Slider(0.2, range=0..1),
    PredictionDistance=Slider(0.2, range=0..10),
    PathTargetDistance=Slider(0.3, range=0..10))
# DECONSTRUCT AGENT:
# Exposes the Agents' Position and other fields so you can see them.
deconstructagent = DeconstructAgent(Agent=deconstructsystem.Agents)  # -> Position, Velocity, Acceleration, Lifespan, ReferencePosition
intcrv = Interpolate(Vertices=deconstructagent.Position, Degree=3, Periodic=False, KnotStyle=1)  # -> Curve, Length, Domain
item = ListItem(List=deconstructagent.Position, Index=0, Wrap=True)
# Looks at all agents within 5 units away and finds the ones within 5/3 units away - this makes the runtime faster
neighbors_2 = GetNeighborsInRadius(Agent=deconstructsystem.Agents, AgentCollection=neighbors, VisionRadius=division, VisionAngle=360)
vdis = VectorDisplay(Anchor=flatten(deconstructagent.ReferencePosition), Vector=deconstructagent.Velocity)
cohese = CoheseForce(Agent=deconstructsystem.Agents, GetNeighborsInRadius=neighbors, WeightMultiplier=Slider(0.125, range=0..1))
# COHESE AND SEPARATE:
# A takes in agent. This will look at each individual agent in the system.
# AC takes in output from neighbors component to get all of the neighbors within the vision radius.
# W is the strength of the force. Default to 1.
separate = SeparateForce(Agent=deconstructsystem.Agents, GetNeighborsInRadius=neighbors_2, WeightMultiplier=Slider(0.125, range=0..1))
contain = ContainForce(Agent=deconstructsystem.Agents, Environment=srfenv, WeightMultiplier=1, VisionRadius=Slider(0.7, range=0..10))
# You can preview the force vectors from each force component by using the vector preview component.
vdis_2 = VectorDisplay(Anchor=deconstructagent.Position, Vector=separate)
