# Grasshopper definition sensoryBitmap.gh (Grasshopper 0.9.75)
# plug-ins: Agent

# ---- group: Pre-Loaded Values
min = Panel("466000.0")
max = Panel("1259000.0")
solar_exposure_values = Panel("""1172436.75
1047414.5
1001287.875
1011595.25
1054090.75
1104832.0
1147844.5
1114301.25
1004563.25
1011193.75
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""")
solarexposurevalues = Number(solar_exposure_values)
min_2 = Number(min)
max_2 = Number(max)

# ---- group: inputs
V = Slider(7, range=1..100)
U = Slider(31, range=1..100)
inputsrf = Surface(<surface referenced from the Rhino model>)

# ----
divide = DivideDomain²(Domain=inputsrf, UCount=U, VCount=V)
number_slider = Slider(50, range=0..100)
subsrf = Isotrim(Surface=inputsrf, Domain=divide)
gradient = Gradient(LowerLimit=min_2, UpperLimit=max_2, Parameter=solarexposurevalues, stops=[0: RGB(255, 255, 255), 1: RGB(0, 0, 0)])
gradient_2 = Gradient(
    LowerLimit=min_2,
    UpperLimit=max_2,
    Parameter=solarexposurevalues,
    stops=[0: RGB(75, 107, 169), 0.329: RGB(254, 244, 84), 0.655: RGB(234, 126, 0), 1: RGB(234, 38, 0)])
dim = Dimensions(Surface=reparameterize(inputsrf))  # -> UDimension, VDimension
number_slider_2 = Slider(0.36, range=0..1)
division = Division(A=dim.UDimension, B=number_slider)
division_2 = Division(A=dim.VDimension, B=number_slider)
number_slider_3 = Slider(0.15, range=0..1)
preview = CustomPreview(Geometry=subsrf, Shader=gradient_2)
planesrf = PlaneSurface(Plane=PlaneXY(0, 0, 0), XSize=division, YSize=division_2)
division_3 = Division(A=dim.UDimension, B=Slider(26, range=0..100))
division_4 = Division(A=dim.VDimension, B=number_slider)
number_slider_4 = Slider(150, range=0..1000)
vec = VectorXYZ(XComponent=expr("-x", number_slider_3), YComponent=expr("-x", number_slider_3), ZComponent=0)  # -> Vector, Length
divide_2 = DivideDomain²(Domain=planesrf, UCount=U, VCount=V)
vec_2 = VectorXYZ(XComponent=Slider(0.2, range=0..1), YComponent=0, ZComponent=0)  # -> Vector, Length
vec_3 = VectorXYZ(XComponent=number_slider_3, YComponent=number_slider_3, ZComponent=0)  # -> Vector, Length
planesrf_2 = PlaneSurface(Plane=PlaneXY(0, 0, 0), XSize=division_3, YSize=division_4)
number_slider_5 = Slider(0.015, range=0..0.1)
subsrf_2 = Isotrim(Surface=planesrf, Domain=divide_2)
number_slider_6 = Slider(16, range=0..100)
particle = ConstructParticle(
    MinimumInitialVelocity=vec.Vector,
    MaximumInitialVelocity=vec_3.Vector,
    Acceleration=Vector(0, 0, 0),
    Lifespan=Slider(-1, range=-1..1000),
    Mass=1,
    BodySize=Slider(1, range=0..10),
    HistoryLength=Slider(1000, range=0..1000))
number_slider_7 = Slider(2, range=0..10)
srfenv = SurfaceEnvironment(Surface=planesrf)
preview_2 = CustomPreview(Geometry=subsrf_2, Shader=gradient_2)
edges = BrepEdges(Brep=planesrf)  # -> Naked, Interior, NonManifold
agent = ConstructAgent(Particle=particle, MaxSpeed=0.5, MaxForce=0.1, VisionRadius=5, VisionAngle=360)
pt = Point(<point referenced from the Rhino model>)
item = ListItem(List=edges.Naked, Index=3, Wrap=True)
item_2 = ListItem(List=edges.Naked, Index=1, Wrap=True)
vehicle = ConstructVehicle(Agent=agent, Orientation=PlaneXY(0, 0, 0), WheelRadius=Slider(1, range=0..1))
crvpts = CrvPts(C=edges.Naked, N=number_slider_6)
ptemit = PointEmitter(ContinuousFlow=Toggle(False), CreationRate=Slider(5, range=0..10), NumberOfQuelea=Slider(1, range=0..10), Point=crvpts)  # -> flatten(Emitter)
crvpts_2 = CrvPts(C=item_2, N=number_slider_6)
timer = Timer(TimerInterval=20, Target=[engine, system])
system = System(Quelea=vehicle, Emitters=ptemit)
number_slider_8 = Slider(10, range=0..10)  # disabled
desystem = DeconstructSystem(System=system)  # -> Quelea, QueleaNetwork
pt_2 = Point(<point referenced from the Rhino model>)  # disabled
devehicle = DeconstructVehicle(Vehicle=desystem.Quelea)  # -> Orientation, simplify(WheelPositions), WheelTangentialVelocity, WheelAngles, WheelRadii, WheelAngularVelocity
departicle = DeconstructParticle(Particle=desystem.Quelea)  # -> Position, Velocity, Acceleration, Lifespan, Mass, BodySize, ReferencePosition
contain = ContainForce(Apply=True, Agent=desystem.Quelea, WeightMultiplier=1, Environment=srfenv, VisionRadius=1)
pline = PolyLine(Vertices=departicle.Position, Closed=False)  # -> flatten(Polyline)
pln = Plane(devehicle.Orientation)
len = Length(Curve=pline)
divbyangle = CSharpScript()  # -> out, P; inputs crvs: list of Curve, angle: Double
# ---------- divbyangle: C# ----------
                                                                                                                              /*
  divideCrvsByDeltaTan : Curve[] * double -> LinkedList<Plane>
  REQUIRES: theta > 0
  ENSURES: divideCrvsByDeltaTan(crvs, theta) returns a linked list of planes
           along the curves s.t. there is a plane at every point along
           the curve where the change in the tangent vector between
           two points is greater than theta.
  */
    //initialize parameters
    double theta = angle;
    int n = crvs.Count;
    double stepSize = 0.5;
    Vector3d xAxis = new Vector3d(1, 0, 0);
    double rover; //steps along the curve by stepSize
    double oldRover; //stores the previous rover for comparison
    double discontinuity;
    Vector3d prevTan;
    Vector3d currTan;
    Curve crv;
    Interval dom;

    //initialize list
    List< Point3d > pts = new List<Point3d>();
    Point3d pt;

    Rhino.Geometry.Continuity c = Rhino.Geometry.Continuity.C1_continuous;

    for(int i = 0; i < n; i++)
    {
      crv = crvs[i];

      //initialize data
      dom = crv.Domain;
      rover = dom.Min;

      //Add plane at start point of curve to list
      pt = crv.PointAt(rover);
      pts.Add(pt);

      //Increment
      prevTan = crv.TangentAt(rover);
      oldRover = rover;
      rover += stepSize;

      while(rover < dom.Max)
      {
        currTan = crv.TangentAt(rover);
        //If there is a discontinuity between the oldRover and rover
        //then place a point at the discontinuity and update prevTan.
        bool isDisc = crv.GetNextDiscontinuity(c, oldRover, rover,
          out discontinuity);
        if(isDisc)
        {
          pt = crv.PointAt(discontinuity);
          pts.Add(pt);
          prevTan = crv.TangentAt(discontinuity);
        }

        //If the change in tangent vector is greater than theta,
        //then drop a target at the rover and update prevTan.
        double delta = RhinoMath.ToDegrees(Math.Abs(Vector3d.VectorAngle(prevTan, currTan)));
        if(delta > theta)
        {
          pt = crv.PointAt(rover);
          pts.Add(pt);
          prevTan = currTan;
        }
        //Increment
        oldRover = rover;
        rover += stepSize;
      }

      //Add target at end point of curve
      pt = crv.PointAt(dom.Max);
      pts.Add(pt);
    }
    P = pts;
# ---------- end divbyangle ----------
item_3 = ListItem(List=departicle.Position, Index=0, Wrap=True)  # -> flatten(Item)
divide_3 = DivideCurve(Curve=pline, Count=len, Kinks=False)  # -> Points, Tangents, Parameters
srf_cp = SurfaceClosestPoint(Point=divide_3.Points, Surface=reparameterize(planesrf))  # -> Point, UVPoint, Distance
vdis = VectorDisplay(Anchor=item_3, Vector=departicle.Velocity)
preview_3 = CustomPreview(
    Geometry=item_3,
    Shader={ambient=RGB(0, 0, 0), diffuse=RGB(255, 105, 180), emission=RGB(76, 32, 54), shine=0.5, specular=RGB(255, 255, 255), transparency=0})
evalsrf = EvaluateSurface(Surface=reparameterize(inputsrf), Point=srf_cp.UVPoint)  # -> Point, Normal, Frame
pline_2 = PolyLine(Vertices=evalsrf.Point, Closed=False)
swatch = ColourSwatch(SwatchColor=RGB(0, 255, 255))
preview_4 = CustomPreview(Geometry=pline, Shader=swatch)
preview_5 = CustomPreview(Geometry=pline_2, Shader=swatch)
sdivide = DivideSurface(Surface=reparameterize(planesrf), UCount=Slider(111, range=0..1000), VCount=Slider(18, range=0..100))  # -> Points, Normals, simplify(Parameters)
image = ImageSampler(
    simplify(sdivide.Parameters),
    FilePath="E:\OneDrive\Documents\cmu\11-Fall_2014\Thesis\Demos\ecoSkinBitmapBlurredSmall.jpg",
    Filter="Colour",
    Interpolate=False,
    Umax=1,
    Umin=0,
    Vmax=1,
    Vmin=0,
    Wrap=1)
panel = Panel("E:\OneDrive\Documents\cmu\11-Fall_2014\Thesis\Demos\ecoSkinBitmapInvBlurredSmall.jpg")
panel_2 = Panel("E:\OneDrive\Documents\cmu\11-Fall_2014\Thesis\Demos\ecoSkinBitmapBlurredSmall.jpg")
c_script = CSharpScript(filepath=panel_2)  # -> out, I; inputs filepath: String
# ---------- c_script: C# ----------
    if(!filepath.Equals(oldFilepath)) {
      bitmap = new Bitmap(filepath);
    }

    oldFilepath = filepath;
    I = bitmap;
# ---------- c_script: C# additional code ----------
  Bitmap bitmap;
  string oldFilepath;
# ---------- end c_script ----------
preview_6 = CustomPreview(Geometry=simplify(sdivide.Points), Shader=image)
engine = Engine(Reset=Toggle(True), System=system)
sensefield = SensoryFieldForce(Apply=True, Vehicle=desystem.Quelea, WeightMultiplier=1, BitmapImage=c_script.I, Crossed=Toggle(False))  # -> Force, SL, SR
sensefield_2 = SensoryFieldForce(Apply=True, WeightMultiplier=1, Bitmap=panel_2, Crossed=False)  # -> Force, flatten(SL), flatten(SR)
cluster = Cluster(S=division, V=desystem.Quelea, P=devehicle.WheelPositions, S_2=division_2)  # -> flatten(sl), flatten(sr); disabled
panel_3 = Panel(sensefield.SL)
panel_4 = Panel(sensefield.SR)
addition = Addition(A=cluster.sl, B=cluster.sr)
remap = RemapNumbers(Value=addition, Source=Domain(0, 2), Target=Domain(0, 1))  # -> Mapped, Clipped
panel_5 = Panel(cluster.sl)
panel_6 = Panel(cluster.sr)

crv = Curve(<curve referenced from the Rhino model>)  # disabled
pt_3 = Point(crvpts_2)  # disabled
incurve = PointInCurve(Point=item_3, Curve=crv)  # -> Relationship, Point; disabled
rev = ReverseList(List=pt_3)  # disabled
number_slider_9 = Slider(0.12, range=0..1)  # disabled
dom = ConstructDomain(DomainStart=number_slider_9, DomainEnd=1)  # disabled
dist = Distance(PointA=item_3, PointB=rev)  # disabled
bool = Boolean(incurve.Relationship)  # disabled
not = GateNot(A=bool)  # disabled

number_slider_10 = Slider(10, range=0..100)  # disabled
number_slider_11 = Slider(105, range=0..1000)  # disabled
number_slider_12 = Slider(0, range=0..100)  # disabled
number_slider_13 = Slider(0, range=0..1)  # disabled
number_slider_14 = Slider(1, range=0..1)  # disabled
X = UnitX(Factor=expr("-x", number_slider_10))  # disabled
move = Move(Geometry=rev, Motion=X)  # -> Geometry, Transform; disabled
dist_2 = Distance(PointA=item_3, PointB=move.Geometry)  # disabled
dom_2 = ConstructDomain(DomainStart=number_slider_11, DomainEnd=number_slider_12)  # disabled
dom_3 = ConstructDomain(DomainStart=number_slider_13, DomainEnd=number_slider_14)  # disabled
remap_2 = RemapNumbers(Value=dist_2, Source=dom_2, Target=dom_3)  # -> Mapped, Clipped; disabled
graph = GraphMapper(remap_2.Mapped, x0=0, x1=1, y0=0, y1=1, container_name="Power", Gx=0.6594203115, Gy=0.3550724387, power=2.486666702)  # disabled
seek = SeekForce(Apply=not, Agent=desystem.Quelea, WeightMultiplier=graph, TargetPoint=move.Geometry)  # disabled

attract = AttractForce(
    Apply=not,
    Particle=desystem.Quelea,
    WeightMultiplier=1,
    TargetPoint=pt_2,
    Mass=number_slider_8,
    DistanceLowerLimit=5,
    DistanceUpperLimit=100)  # disabled

dom_4 = ConstructDomain(DomainStart=number_slider_10, DomainEnd=0)  # disabled
remap_3 = RemapNumbers(Value=dist, Source=dom_4, Target=dom)  # -> Mapped, Clipped; disabled
switch = CSharpScript(within=bool, low=number_slider_9, high=remap_3.Mapped)  # -> out, W; inputs within: Boolean, low: Double, high: Double; disabled
# ---------- switch: C# ----------
    double weight = low;
    if(within) {
      weight = high;
    }
    W = weight;
# ---------- end switch ----------
seek_2 = SeekForce(Apply=True, Agent=desystem.Quelea, WeightMultiplier=switch.W, TargetPoint=rev)  # disabled

# ==== cluster CrvPts
C = ClusterInput()
N = ClusterInput()
divide = DivideCurve(Curve=C, Count=expr("x-1", N), Kinks=False)  # -> Points, Tangents, Parameters
shift = ShiftList(List=divide.Points, Shift=1, Wrap=False)
shift_2 = ShiftList(List=shift, Shift=-1, Wrap=False)
L = ClusterOutput(shift_2)

# ==== cluster Cluster
number_slider = Slider(1.5, range=0..10)
P = ClusterInput()
pdecon = Deconstruct(Point=P)  # -> XComponent, YComponent, ZComponent
S = ClusterInput()
S_2 = ClusterInput()
remap = RemapNumbers(Value=pdecon.XComponent, Source=S, Target=Domain(0, 1))  # -> Mapped, Clipped
remap_2 = RemapNumbers(Value=pdecon.YComponent, Source=S_2, Target=Domain(0, 1))  # -> Mapped, Clipped
pt = ConstructPoint(XCoordinate=remap.Mapped, YCoordinate=remap_2.Mapped, ZCoordinate=0)
image = ImageSampler(
    pt,
    FilePath="E:\OneDrive\Documents\cmu\11-Fall_2014\Thesis\Demos\ecoSkinBitmapBlurredSmall.jpg",
    Filter="Value",
    Interpolate=False,
    Umax=1,
    Umin=0,
    Vmax=1,
    Vmin=0,
    Wrap=1)
item = ListItem(List=image, Index=1, Wrap=True)
item_2 = ListItem(List=image, Index=0, Wrap=True)
V = ClusterInput()
sensorforce = SensorForce(Apply=True, Vehicle=graft(V), WeightMultiplier=1, SL=item_2, SR=item, Crossed=False)  # -> Force, SL, SR
sl = ClusterOutput(sensorforce.SL)
sr = ClusterOutput(sensorforce.SR)
