# Grasshopper definition surfaceEnvironmentTest.gh (Grasshopper 0.9.75)
# plug-ins: Agent

number_slider = Slider(0.1, range=0..1)
number_slider_2 = Slider(10, range=0..10)
number_slider_3 = Slider(0.05, range=0..1)
vec = VectorXYZ(XComponent=expr("-x", number_slider), YComponent=expr("-x", number_slider), ZComponent=expr("-x", number_slider))  # -> Vector, Length
vec_2 = VectorXYZ(XComponent=number_slider, YComponent=number_slider, ZComponent=number_slider)  # -> Vector, Length
crv = Curve([<curve referenced from the Rhino model> x2])
number_slider_4 = Slider(0.01, range=0..0.1)
particle = ConstructParticle(
    MinimumInitialVelocity=vec.Vector,
    MaximumInitialVelocity=vec_2.Vector,
    Acceleration=Vector(0, 0, 0),
    Lifespan=Slider(-1, range=-1..1000),
    Mass=1,
    BodySize=1,
    HistoryLength=1)
pt = Point(<point referenced from the Rhino model>)
loft = Loft(Curves=crv, Options={Adjust=False, Closed=False, LoftEnds=0, LoftSimp=0, LoftType=0, Rebuild=10, Refit=0.01})
number_slider_5 = Slider(6, range=0..10)
ptemit = PointEmitter(ContinuousFlow=Toggle(False), CreationRate=1, NumberOfQuelea=Slider(3, range=0..10), Point=pt)
agent = ConstructAgent(Particle=particle, MaxSpeed=0.5, MaxForce=0.1, VisionRadius=5, VisionAngle=360)
srfenv = SurfaceEnvironment(Surface=loft)  # -> Environment, _2DReferenceSurface
multiplication = Multiplication(A=number_slider_5, B=Slider(0.333, range=0..1))
number_slider_6 = Slider(1, range=0..1)
timer = Timer(TimerInterval=20, Target=[engine, system])  # disabled
system = System(Quelea=agent, Emitters=ptemit)
desystem = DeconstructSystem(System=system)  # -> Quelea, QueleaNetwork
neighbors = GetNeighborsInRadius(Agent=desystem.Quelea, QueleaNetwork=desystem.QueleaNetwork, VisionRadius=number_slider_5, VisionAngle=360)
neighbors_2 = GetNeighborsInRadius(Agent=desystem.Quelea, QueleaNetwork=neighbors, VisionRadius=multiplication, VisionAngle=360)
engine = Engine(Reset=Toggle(True), System=system)
pt_2 = Point(<point referenced from the Rhino model>)
cohese = CoheseForce(Apply=True, Agent=desystem.Quelea, WeightMultiplier=1, GetNeighborsInRadius=neighbors)
departicle = DeconstructParticle(Particle=desystem.Quelea)  # -> Position, Velocity, Acceleration, Lifespan, Mass, BodySize, SurfacePosition, SurfaceVelocity, SurfaceAcceleration
seek = SeekForce(Apply=True, Agent=desystem.Quelea, WeightMultiplier=Slider(0.1, range=0..1), TargetPoint=pt_2)  # disabled
separate = SeparateForce(Apply=True, Agent=desystem.Quelea, WeightMultiplier=1, GetNeighborsInRadius=neighbors_2)  # disabled
item = ListItem(List=departicle.Position, Index=0, Wrap=True)  # -> flatten(Item)
pt_3 = Point(departicle.SurfacePosition)
attract = AttractForce(
    Apply=True,
    Particle=desystem.Quelea,
    WeightMultiplier=1,
    TargetPoint=pt_2,
    Mass=Slider(23, range=0..100),
    DistanceLowerLimit=5,
    DistanceUpperLimit=100)
vlen = VectorLength(Vector=departicle.Acceleration)
vlen_2 = VectorLength(Vector=cohese)
vdis = VectorDisplay(Anchor=pt_3, Vector=departicle.SurfaceVelocity)
vdis_2 = VectorDisplay(Anchor=item, Vector=departicle.Velocity)
vlen_3 = VectorLength(Vector=departicle.Velocity)
vdis_3 = VectorDisplay(Anchor=pt_3, Vector=attract)
vdis_4 = VectorDisplay(Anchor=pt_3, Vector=cohese)
vlen_4 = VectorLength(Vector=attract)
larger = LargerThan(FirstNumber=vlen, SecondNumber=Slider(0.1001, range=0..1))  # -> LargerThan, OrEqualTo
preview = CustomPreview(Geometry=item, Shader=ColourSwatch(SwatchColor=RGB(255, 255, 255)))
panel = Panel(vlen_2)
panel_2 = Panel(vlen)
panel_3 = Panel(vlen_3)
panel_4 = Panel(vlen_4)
panel_5 = Panel(larger.LargerThan)
