# Grasshopper definition test.gh (Grasshopper 0.9.75)
# plug-ins: Agent

pt = Point(<point referenced from the Rhino model>)
pt_2 = ConstructPoint(XCoordinate=Slider(3, range=-5..5), YCoordinate=0, ZCoordinate=0)
crv = Curve([<curve referenced from the Rhino model> x2])
loft = Loft(Curves=crv, Options={Adjust=False, Closed=False, LoftEnds=0, LoftSimp=0, LoftType=0, Rebuild=10, Refit=0.01})
pt_3 = Point(pt_2)
sph = Sphere(Base=PlaneXY(0, 0, 0), Radius=Slider(7, range=0..100))
pt_4 = Point(<point referenced from the Rhino model>)
srf = Surface(loft)
toggle = BooleanToggle(False)
preview = CustomPreview(Geometry=pt_3, Shader=ColourSwatch(SwatchColor=RGB(0, 255, 255)))
box = DomainBox(Base=pt_4, X=Slider(10, range=0..10), Y=Slider(10, range=0..10), Z=Slider(10, range=0..10))
brep = Brep(sph)
srfenv = SurfaceEnvironment(Surface=srf)
dedom2num = DeconstructDomain²(Domain=srf)  # -> UMin, UMax, VMin, VMax
agent = Agent(
    Lifespan=Slider(28, range=0..1000),
    Mass=1,
    BodySize=1,
    MaximumSpeed=0.5,
    MaximumForce=0.1,
    VisionAngle=15,
    VisionRadius=5,
    LengthOfPositionHistory=1)
pemit = PointEmitter(Point=pt_3, ContinuousFlow=True, CreationRate=1, NumberOfAgents=Slider(3, range=0..10))
brepenv = BrepEnvironment(Brep=brep)
wboxenv = WorldBoxEnvironment(Box=box)
swatch = ColourSwatch(SwatchColor=RGBA(0, 72, 0, 155))
avoidedges = AvoidEdgesForce(Weight=1, VisionMultiplier=1, Environment=brepenv)
cohese = CoheseForce(Weight=1, VisionMultiplier=1)
separate = SeparateForce(Weight=1, VisionMultiplier=0.3333333333)
preview_2 = CustomPreview(Geometry=box, Shader=swatch)
planesrf = PlaneSurface(Plane=PlaneXY(0, 0, 0), XSize=dedom2num.UMax, YSize=dedom2num.VMax)
preview_3 = CustomPreview(Geometry=srf, Shader=swatch)
align = AlignForce(Weight=1, VisionMultiplier=0.6666666667)
system = AgentSystem(Agents=agent, Emitters=pemit, Forces=align)
timer = Timer(TimerInterval=20, Target=engine)  # disabled
engine = Engine(Reset=Toggle(False), LiveUpdate=Toggle(True), Systems=system)
debugdeconstructagent = DebugDeconstructAgent(Agent=engine)  # -> Position, Velocity, Acceleration, Lifespan, RefPosition
pt_5 = Point(debugdeconstructagent.Position)
pt_6 = Point(debugdeconstructagent.RefPosition)
preview_4 = CustomPreview(Geometry=pt_5, Shader=ColourSwatch(SwatchColor=RGB(0, 255, 0)))
preview_5 = CustomPreview(Geometry=pt_6, Shader=ColourSwatch(SwatchColor=RGBA(255, 255, 0, 153)))
