# Grasshopper definition test2.gh (Grasshopper 0.9.75)
# plug-ins: Agent

number_slider = Slider(1000, range=0..1000)
number_slider_2 = Slider(100, range=0..100)
toggle = BooleanToggle(False)
crvemit = CurveEmitter(Curve=<geometry referenced from the Rhino model>, ContinuousFlow=toggle, CreationRate=1, NumberOfAgents=number_slider)
pt = Point(<point referenced from the Rhino model>)
box = DomainBox(Base=PlaneXY(0, 0, 0), X=number_slider_2, Y=number_slider_2, Z=number_slider_2)
pemit = PointEmitter(Point=pt, ContinuousFlow=toggle, CreationRate=1, NumberOfAgents=number_slider)
agent = Agent(
    Lifespan=Slider(1000, range=0..1000),
    Mass=1,
    BodySize=1,
    MaximumSpeed=0.5,
    MaximumForce=0.1,
    VisionAngle=15,
    VisionRadius=5,
    LengthOfPositionHistory=1)
separate = SeparateForce(Weight=1, VisionMultiplier=Slider(1, range=0..1))
cohese = CoheseForce(Weight=1, VisionMultiplier=1)
boxemit = BoxEmitter(Box=box, ContinuousFlow=toggle, CreationRate=1, NumberOfAgents=number_slider)
system = AgentSystem(Agents=agent, Emitters=boxemit, Forces=cohese)
timer = Timer(TimerInterval=20, Target=engine)  # disabled
engine = Engine(Reset=Toggle(True), Systems=system)
deconstructagent = DeconstructAgent()  # -> Position, Velocity, Acceleration, Lifespan; disabled
deconstructagent_2 = DeconstructAgent(Agent=engine)  # -> Position, Velocity, Acceleration, Lifespan
swatch = ColourSwatch(SwatchColor=RGB(255, 0, 255))  # disabled
preview = CustomPreview(Geometry=deconstructagent.Position, Shader=swatch)  # disabled
preview_2 = CustomPreview(Geometry=deconstructagent_2.Position, Shader=ColourSwatch(SwatchColor=RGB(255, 255, 255)))
