# Grasshopper definition test3.gh (Grasshopper 0.9.75)
# plug-ins: Agent

number_slider = Slider(1000, range=0..1000)
number_slider_2 = Slider(30, range=0..100)
number_slider_3 = Slider(1, range=0..1)
toggle = BooleanToggle(False)
pt = ConstructPoint(XCoordinate=number_slider_2, YCoordinate=0, ZCoordinate=0)
crvemit = CurveEmitter(Curve=<geometry referenced from the Rhino model>, ContinuousFlow=toggle, CreationRate=1, NumberOfAgents=number_slider)
pt_2 = Point(<point referenced from the Rhino model>)
box = DomainBox(Base=pt, X=number_slider_2, Y=number_slider_2, Z=number_slider_2)
box_2 = DomainBox(Base=PlaneXY(0, 0, 0), X=number_slider_2, Y=number_slider_2, Z=number_slider_2)
pemit = PointEmitter(Point=pt_2, ContinuousFlow=toggle, CreationRate=1, NumberOfAgents=number_slider)
agent = Agent(
    Lifespan=Slider(1000, range=0..1000),
    Mass=1,
    BodySize=1,
    MaximumSpeed=0.5,
    MaximumForce=0.1,
    VisionAngle=15,
    VisionRadius=5,
    LengthOfPositionHistory=1)
separate = SeparateForce(Weight=1, VisionMultiplier=0.3333333333)
cohese = CoheseForce(Weight=1, VisionMultiplier=1)
boxemit = BoxEmitter(Box=box_2, ContinuousFlow=toggle, CreationRate=1, NumberOfAgents=number_slider)
boxemit_2 = BoxEmitter(Box=box, ContinuousFlow=toggle, CreationRate=1, NumberOfAgents=number_slider)
system = AgentSystem(Agents=agent, Emitters=boxemit, Forces=cohese)
system_2 = AgentSystemList(Agents=agent, Emitters=boxemit_2, Forces=cohese)
timer = Timer(TimerInterval=20, Target=[engine, engine_2])
toggle_2 = BooleanToggle(True)
engine = Engine(Reset=toggle_2, Systems=system_2)  # disabled
engine_2 = Engine(Reset=toggle_2, Systems=system)
deconstructagent = DeconstructAgent()  # -> Position, Velocity, Acceleration, Lifespan; disabled
deconstructagent_2 = DeconstructAgent(Agent=engine)  # -> Position, Velocity, Acceleration, Lifespan
deconstructagent_3 = DeconstructAgent(Agent=engine_2)  # -> Position, Velocity, Acceleration, Lifespan
swatch = ColourSwatch(SwatchColor=RGB(255, 0, 255))  # disabled
preview = CustomPreview(Geometry=deconstructagent.Position, Shader=swatch)  # disabled
preview_2 = CustomPreview(Geometry=deconstructagent_2.Position, Shader=ColourSwatch(SwatchColor=RGB(0, 255, 255)))
preview_3 = CustomPreview(Geometry=deconstructagent_3.Position, Shader=ColourSwatch(SwatchColor=RGB(255, 255, 255)))
