# Grasshopper definition test4.gh (Grasshopper 0.9.75)
# plug-ins: Agent

number_slider = Slider(37, range=0..100)
number_slider_2 = Slider(22, range=0..100)
number_slider_3 = Slider(1000, range=0..1000)
pt = ConstructPoint(XCoordinate=Slider(150, range=0..1000), YCoordinate=0, ZCoordinate=0)
dom = ConstructDomain(DomainStart=expr("-x", number_slider), DomainEnd=number_slider)
dom_2 = ConstructDomain(DomainStart=expr("-x", number_slider_2), DomainEnd=number_slider_2)
toggle = BooleanToggle(False)
box = DomainBox(Base=PlaneXY(0, 0, 0), X=dom, Y=dom, Z=dom)
box_2 = DomainBox(Base=pt, X=dom_2, Y=dom_2, Z=dom_2)
boxemit = BoxEmitter(Box=box_2, ContinuousFlow=toggle, CreationRate=1, NumberOfAgents=number_slider_3)
boxemit_2 = BoxEmitter(Box=box, ContinuousFlow=toggle, CreationRate=1, NumberOfAgents=number_slider_3)
agent = Agent(
    Lifespan=Slider(1000, range=0..1000),
    Mass=1,
    BodySize=1,
    MaximumSpeed=0.5,
    MaximumForce=0.1,
    VisionAngle=15,
    VisionRadius=Slider(5, range=0..100),
    LengthOfPositionHistory=1)
cohese = CoheseForce(Weight=1, VisionMultiplier=1)
pemit = PointEmitter(Point=Point(0, 0, 0), ContinuousFlow=toggle, CreationRate=1, NumberOfAgents=number_slider_3)
system = AgentSystem(Agents=agent, Emitters=pemit, Forces=cohese)
timer = Timer(TimerInterval=20, Target=engine)
engine = Engine(Reset=Toggle(True), Systems=system)
deconstructagent = DeconstructAgent(Agent=engine)  # -> Position, Velocity, Acceleration, Lifespan
