# Grasshopper definition test5.gh (Grasshopper 0.9.75)
# plug-ins: Agent

number_slider = Slider(68, range=0..100)
number_slider_2 = Slider(6, range=5..6)
pemit = PointEmitter(Point=Point(0, 0, 0), ContinuousFlow=True, CreationRate=1, NumberOfAgents=0)
cohese = CoheseForce(Weight=1, VisionMultiplier=1)
agent = Agent(
    Lifespan=Slider(100, range=0..100),
    Mass=1,
    BodySize=1,
    MaximumSpeed=0.5,
    MaximumForce=0.1,
    VisionAngle=15,
    VisionRadius=5,
    LengthOfPositionHistory=Slider(15, range=0..100))
system = AgentSystem(Agents=agent, Emitters=pemit, Forces=cohese)
timer = Timer(TimerInterval=20, Target=engine)  # disabled
engine = Engine(Reset=Toggle(False), Systems=system)
deconstructagent = DeconstructAgent(Agent=engine)  # -> Position, Velocity, Acceleration, Lifespan, PositionHistory
pt = Point(deconstructagent.Position)
intcrv = Interpolate(Vertices=deconstructagent.PositionHistory, Degree=3, Periodic=False, KnotStyle=1)  # -> Curve, Length, Domain
rec = DataRecorder(intcrv.Curve, DataLimit=-10, RecordData=True)
crv = Curve(flatten(rec))
lng = ListLength(List=flatten(crv))
range = Range(Domain=lng, Steps=lng)
gradient = Gradient(LowerLimit=0, UpperLimit=lng, Parameter=range, stops=[0: RGB(255, 130, 160), 0.381: RGB(220, 0, 40)])
shader = Shader(gradient)
preview = CustomPreview(Geometry=simplify(graft(crv)), Shader=simplify(graft(shader)))
panel = Panel(gradient)
