# Grasshopper definition test6.gh (Grasshopper 0.9.75)
# plug-ins: Agent

number_slider = Slider(12, range=0..100)
number_slider_2 = Slider(5, range=0..10)
box = DomainBox(Base=PlaneXY(0, 0, 0), X=number_slider, Y=number_slider, Z=number_slider)
agent = Agent(
    Lifespan=Slider(100, range=0..100),
    Mass=1,
    BodySize=1,
    MaximumSpeed=0.5,
    MaximumForce=0.1,
    VisionAngle=15,
    VisionRadius=number_slider_2,
    LengthOfPositionHistory=1)
boxemit = BoxEmitter(Box=box, ContinuousFlow=Toggle(False), CreationRate=1, NumberOfAgents=Slider(100, range=0..1000))
timer = Timer(TimerInterval=20, Target=[engine, system])  # disabled
system = AgentSystem(Agents=agent, Emitters=boxemit)
deconstructsystem = DeconstructSystem(System=system)  # -> Agents, AgentSystem
engine = Engine(Reset=Toggle(False), System=system)
neighbors3 = NeighborsInRadius(Agent=deconstructsystem.Agents, AgentCollection=deconstructsystem.AgentSystem, VisionRadius=5, VisionAngle=360)
neighbors3_2 = NeighborsInRadius(Agent=deconstructsystem.Agents, AgentCollection=neighbors3, VisionRadius=Slider(1.667, range=0..10), VisionAngle=360)
deconstructagent = DeconstructAgent(Agent=deconstructsystem.Agents)  # -> Position, Velocity, Acceleration, Lifespan, simplify(PositionHistory)
cohese = CoheseForce(Agent=deconstructsystem.Agents, Neighbors=deconstructsystem.AgentSystem)
item = ListItem(List=deconstructsystem.Agents, Index=0, Wrap=True)
vdis = VectorDisplay(Anchor=deconstructagent.Position, Vector=cohese)
separate = SeparateForce(Agent=deconstructsystem.Agents, Neighbors=neighbors3_2)
addition = Addition(A=cohese, B=separate)
item_2 = ListItem(List=neighbors3, Index=0, Wrap=True)
vdis_2 = VectorDisplay(Anchor=deconstructagent.Position, Vector=separate)
vdis_3 = VectorDisplay(Anchor=deconstructagent.Position, Vector=addition)
deconstructagent_2 = DeconstructAgent(Agent=item)  # -> Position, Velocity, Acceleration, Lifespan, simplify(PositionHistory)
deconstructac = DeconstructAgentCollection()
deconstructac_2 = DeconstructAgentCollection(AgentCollection=item_2)
vdis_4 = VectorDisplay(Anchor=deconstructagent.Position, Vector=deconstructagent.Velocity)
deconstructagent_3 = DeconstructAgent(Agent=deconstructac_2)  # -> Position, Velocity, Acceleration, Lifespan, simplify(PositionHistory)
sph = Sphere(Base=deconstructagent_2.Position, Radius=number_slider_2)
preview = CustomPreview(
    Geometry=deconstructagent_3.Position,
    Shader={ambient=RGB(0, 0, 0), diffuse=RGB(255, 105, 180), emission=RGB(76, 32, 54), shine=0.5, specular=RGB(255, 255, 255), transparency=0})
