# Grasshopper definition vehicle.gh (Grasshopper 0.9.75)
# plug-ins: Agent

number_slider = Slider(0.11, range=0..1)
number_slider_2 = Slider(1, range=0..1)
X = UnitX(Factor=Slider(0.15, range=0..1))
vec = VectorXYZ(XComponent=expr("-x", number_slider), YComponent=expr("-x", number_slider), ZComponent=0)  # -> Vector, Length
number_slider_3 = Slider(2, range=0..100)
vec_2 = VectorXYZ(XComponent=number_slider, YComponent=number_slider, ZComponent=0)  # -> Vector, Length
number_slider_4 = Slider(1, range=0..1)
number_slider_5 = Slider(1, range=0..1)
particle = ConstructParticle(
    MinimumInitialVelocity=vec.Vector,
    MaximumInitialVelocity=vec_2.Vector,
    Acceleration=Vector(0, 0, 0),
    Lifespan=Slider(1000, range=0..1000),
    Mass=1,
    BodySize=number_slider_2,
    HistoryLength=Slider(95, range=0..1000))
box = Box({Plane=PlaneXY(-9.25202645, -9.578513353, -4.11110834), X=Domain(0, 20.23596919), Y=Domain(0, 16.60702639), Z=Domain(0, 9.910331127)})
wires = BrepWireframe(Brep=box, Density=-1)
pt = Point(<point referenced from the Rhino model>)
pt_2 = Point(<point referenced from the Rhino model>)
pt_3 = Point(<point referenced from the Rhino model>)
agent = ConstructAgent(
    Particle=particle,
    MaxSpeed=Slider(1.5, range=0..10),
    MaxForce=Slider(0.01, range=0..0.01),
    VisionRadius=5,
    VisionAngle=360)
xy = XYPlane(Origin=Point(0, 0, 0))
aaboxenv = AxisAlignedBoxEnvironment(Box=box)
vec2pt = Vector2Pt(PointA=pt_3, PointB=pt, Unitize=False)  # -> Vector, Length
ptemit = PointEmitter(ContinuousFlow=True, CreationRate=1, NumberOfQuelea=Slider(1, range=0..100), Point=pt_2)
vehicle = ConstructVehicle(Agent=agent, Orientation=PlaneXY(0, 0, 0), WheelRadius=1)
vdis = VectorDisplay(Anchor=pt_3, Vector=vec2pt.Vector)
c_script = CSharpScript(position=pt_3, velocity=vec2pt.Vector, bodySize=Slider(1, range=0..10), orientation=xy)  # -> out, A, B, C; inputs position: Point3d, velocity: Vector3d, bodySize: Double, orientation: Plane
# ---------- c_script: C# ----------
    double halfBodySize = bodySize / 2;
    double halfPi = Math.PI / 2;

    Vector3d wheelLeftVec = velocity;
    Vector3d wheelRightVec = velocity;
    wheelLeftVec.Rotate(halfPi, orientation.ZAxis);
    wheelRightVec.Rotate(-halfPi, orientation.ZAxis);
    wheelLeftVec.Unitize();
    wheelRightVec.Unitize();
    wheelLeftVec = Vector3d.Multiply(wheelLeftVec, halfBodySize);
    wheelRightVec = Vector3d.Multiply(wheelRightVec, halfBodySize);
    A = wheelLeftVec;
    B = wheelRightVec;
    double angle = Vector3d.VectorAngle(Vector3d.XAxis, velocity);


    double wheelLeftX = position.X + halfBodySize * Math.Cos(angle - halfPi);
    double wheelLeftY = position.Y + halfBodySize * Math.Sin(angle - halfPi);

    double wheelRightX = position.X + halfBodySize * Math.Cos(angle + halfPi);
    double wheelRightY = position.Y + halfBodySize * Math.Sin(angle + halfPi);
    //A = new Point3d(wheelLeftX, wheelLeftY, 0);
    //B = new Point3d(wheelRightX, wheelRightY, 0);
    C = angle;
# ---------- end c_script ----------
number_slider_6 = Slider(15, range=0..100)
timer = Timer(TimerInterval=20, Target=[engine, system])  # disabled
system = System(Quelea=vehicle, Emitters=ptemit)
vdis_2 = VectorDisplay(Anchor=pt_3, Vector=c_script.A)
vdis_3 = VectorDisplay(Anchor=pt_3, Vector=c_script.B)
desystem = DeconstructSystem(System=system)  # -> Quelea, QueleaNetwork
contain = ContainForce(Apply=True, Agent=desystem.Quelea, WeightMultiplier=1, Environment=aaboxenv, VisionRadius=1)
pt_4 = Point(<point referenced from the Rhino model>)
pt_5 = Point(<point referenced from the Rhino model>)
sph = Sphere(Base=pt_5, Radius=number_slider_6)
engine = Engine(Reset=Toggle(True), System=system)
toggle = BooleanToggle(True)
sensept = SensoryPointForce(Apply=True, Vehicle=desystem.Quelea, WeightMultiplier=1, Point=pt_4, Radius=number_slider_6, Crossed=toggle)  # -> Force, SL, SR
departicle = DeconstructParticle(Quelea=desystem.Quelea)  # -> Position, Velocity, Acceleration, Lifespan, Mass, BodySize, ReferencePosition
pt_6 = Point(<point referenced from the Rhino model>)
sensept_2 = SensoryPointForce(Apply=True, Vehicle=desystem.Quelea, WeightMultiplier=1, Point=pt_5, Radius=number_slider_6, Crossed=toggle)  # -> Force, SL, SR
sensept_3 = SensoryPointForce(Apply=True, Vehicle=desystem.Quelea, WeightMultiplier=1, Point=pt_6, Radius=number_slider_6, Crossed=Toggle(True))  # -> Force, SL, SR; disabled
intcrv = Interpolate(Vertices=departicle.Position, Degree=3, Periodic=False, KnotStyle=1)  # -> Curve, Length, Domain
Z = UnitZ(Factor=1)
devehicle = DeconstructVehicle(Vehicle=desystem.Quelea)  # -> Orientation, WheelPositions, WheelTangentialVelocity, WheelAngles, WheelRadii, WheelAngularVelocity
panel = Panel(sensept_2.SL)
panel_2 = Panel(sensept_2.SR)
pl = ConstructPlane(Origin=devehicle.WheelPositions, XAxis=departicle.Velocity, YAxis=Z)
panel_3 = Panel(pl)
item = ListItem(List=departicle.Position, Index=0, Wrap=True)  # -> flatten(Item)
sph_2 = Sphere(Base=item, Radius=expr("x/2", number_slider_2))
neighbors = GetNeighborsInRadius(Agent=desystem.Quelea, QueleaNetwork=desystem.QueleaNetwork, VisionRadius=Slider(2, range=0..10), VisionAngle=360)  # disabled
pln = Plane(devehicle.Orientation)
deplane = DeconstructPlane(Plane=simplify(pl))  # -> Origin, XAxis, YAxis, ZAxis
vdis_4 = VectorDisplay(Anchor=item, Vector=departicle.Velocity)
vdis_5 = VectorDisplay(Anchor=devehicle.WheelPositions, Vector=devehicle.WheelTangentialVelocity)
panel_4 = Panel(deplane.Origin)
separate = SeparateForce(Apply=True, Agent=desystem.Quelea, WeightMultiplier=Slider(0.62, range=0..1), GetNeighborsInRadius=neighbors)
vdis_6 = VectorDisplay(Anchor=item, Vector=departicle.Acceleration)
circle = CircleCNR(Center=devehicle.WheelPositions, Normal=deplane.ZAxis, Radius=devehicle.WheelRadii)
panel_5 = Panel(deplane.ZAxis)
rotate = Rotate(Geometry=circle, Angle=expr("-x", devehicle.WheelAngles), Plane=pl)  # -> Geometry, Transform
panel_6 = Panel(devehicle.WheelAngles)
divide = DivideCurve(Curve=rotate.Geometry, Count=5, Kinks=False)  # -> Points, Tangents, Parameters
ln = Line(StartPoint=graft(devehicle.WheelPositions), EndPoint=divide.Points)
curvepoint = PointOnCurve(rotate.Geometry, parameter=0)
