# Grasshopper definition vehicleForceTest.gh (Grasshopper 0.9.75)
# plug-ins: Agent

number_slider = Slider(0.08, range=0..1)
vec = VectorXYZ(XComponent=number_slider, YComponent=expr("-x", number_slider), ZComponent=0)  # -> Vector, Length
particle = ConstructParticle(
    MinimumInitialVelocity=vec.Vector,
    MaximumInitialVelocity=vec.Vector,
    Acceleration=Vector(0, 0, 0),
    Lifespan=Slider(-1, range=-1..1000),
    Mass=1,
    BodySize=1,
    HistoryLength=Slider(1000, range=0..1000))
agent = ConstructAgent(Particle=particle, MaxSpeed=0.5, MaxForce=0.1, VisionRadius=5, VisionAngle=360)
number_slider_2 = Slider(4, range=0..100)
vehicle = ConstructVehicle(Agent=agent, Orientation=PlaneXY(0, 0, 0), WheelRadius=Slider(1, range=0..10))
ptemit = PointEmitter(ContinuousFlow=True, CreationRate=1, NumberOfQuelea=Slider(1, range=0..10), Point=Point(0, 0, 0))
timer = Timer(TimerInterval=20, Target=[engine, system])  # disabled
system = System(Quelea=vehicle, Emitters=ptemit)
pt = Point(<point referenced from the Rhino model>)
pt_2 = Point(<point referenced from the Rhino model>)
circle = CircleCNR(Center=[pt, pt_2], Normal=Vector(0, 0, 1), Radius=number_slider_2)
desystem = DeconstructSystem(System=system)  # -> Quelea, QueleaNetwork
engine = Engine(Reset=Toggle(True), System=system)
sensept = SensoryPointForce(Apply=True, Vehicle=desystem.Quelea, WeightMultiplier=1, Point=pt, Radius=number_slider_2, Crossed=Toggle(True))  # -> Force, SL, SR
sensept_2 = SensoryPointForce(Apply=True, Vehicle=desystem.Quelea, WeightMultiplier=1, Point=pt_2, Radius=number_slider_2, Crossed=Toggle(True))  # -> Force, SL, SR; disabled
devehicle = DeconstructVehicle(Vehicle=desystem.Quelea)  # -> Orientation, WheelPositions, WheelTangentialVelocity, WheelAngles, WheelRadii, WheelAngularVelocity
departicle = DeconstructParticle(Particle=desystem.Quelea)  # -> Position, Velocity, Acceleration, Lifespan, Mass, BodySize, ReferencePosition
intcrv = Interpolate(Vertices=departicle.Position, Degree=3, Periodic=False, KnotStyle=1)  # -> Curve, Length, Domain
item = ListItem(List=departicle.Position, Index=0, Wrap=True)  # -> flatten(Item)
vlen = VectorLength(Vector=sensept.Force)
vlen_2 = VectorLength(Vector=sensept_2.Force)
vdis = VectorDisplay(Anchor=item, Vector=sensept.Force)
vlen_3 = VectorLength(Vector=departicle.Velocity)
vdis_2 = VectorDisplay(Anchor=item, Vector=departicle.Velocity)
vdis_3 = VectorDisplay(Anchor=item, Vector=sensept.Force)
vdis_4 = VectorDisplay(Anchor=item, Vector=sensept_2.Force)
panel = Panel(vlen_3)
panel_2 = Panel(sensept.Force)
panel_3 = Panel(vlen)
panel_4 = Panel(sensept_2.Force)
panel_5 = Panel(vlen_2)
